# Grasshopper definition 1.01.E02.ghx (Grasshopper 0.9.75)
# plug-ins: Decodes Python Interpreter

number_slider = Slider(7, range=0..10)
md_slider = MDSlider(
    slider_value=Point(0.8332317631, 0.4890240925, 0.5),
    SliderMode=0,
    x_domain=Domain(2, 8),
    y_domain=Domain(2, 8),
    z_domain=Domain(0, 1))
trigrid = Triangular(Plane=PlaneXY(0, 0, 0), Size=1, ExtentX=expr("x*2", number_slider), ExtentY=number_slider)  # -> Cells, Points
cp = ControlPoints(Curve=trigrid.Cells)  # -> Points, Weights, Knots
pt = Point(md_slider)

panel = Panel("a simple attractor script")
decodes = DecodesPythonScript(pts=cp.Points, attr_pt=pt, power=Slider(0.3, range=0..1), max_dist_pct=Slider(0.75, range=0..1))  # -> console, a; inputs pts: list, attr_pt: Point3d
# ---------- decodes: Python ----------
'''
2.01.E02a
Pulls a set of points toward an attractor point.

required:
pts [Point]A list of points to displace.
attr_pt Point An "attractor" point that influences a given list of points.
power float The strength of the attraction, described as the exponent number to raise the distance between a given point and the attractor point. For example, a power value of 0.5 will apply a square root function to the measured distance, while a power value of 3.0 will raise the measured distance to the power of three.
max_dist_pct float The maximum distance that any point may move, described as a percentage of the distance between a given point and the attractor point. This has the effect of ensuring that no point overshoots the attractor point.

result:
outie	An outie containing a list of points that have been moved
'''

"""
Iterate through each given point using a loop, applying the attractor routine to each point in succession.
"""
new_pts = []
for grid_pt in pts: 
    # first, create a vector from 'pt' to the attractor point
    vec = Vec(grid_pt,attr_pt)
    
    # next, calculate the distance to move 'pt'
    max_dist = vec.length*max_dist_pct
    desired_dist = vec.length**power
    dist = min(max_dist,desired_dist)
    
    # create a new point in the desired position
    new_pt = grid_pt + vec.normalized(dist)
    
    # put this new point in our outie
    new_pts.append(new_pt)
    
a.put(new_pts)
# ---------- end decodes ----------

unflatten = UnflattenTree(Tree=decodes.a, Guide=cp.Points)
pline = PolyLine(Vertices=unflatten, Closed=False)
