# Grasshopper definition 1.01.E03.ghx (Grasshopper 0.9.76)
# plug-ins: Decodes Python Interpreter

# Monsters I
vec = Vector(Vector(40, 0, 0))
count_v = Integer(Slider(20, range=0..100))
count_u = Integer(Slider(60, range=0..100))
tor_a = Number(Slider(10, range=-10..10))
tor_b = Number(Slider(6, range=-10..10))
mon_a = Number(Slider(3, range=-10..10))
mon_b = Number(Slider(5, range=-10..10))

# ---- group: 1.01.E03a1
# RATIONAL
decodes = DecodesPythonScript(a=tor_a, b=tor_b, count_n=count_u)  # -> console, out
# ---------- decodes: Python ----------
from math import *
#########################################
"""
An Ellipse
"""
for n in Interval.twopi()/count_n:
    x = a*cos(n)
    y = b*sin(n)
    pt = Point(x,y)
    out.put(pt)

#########################################
# ---------- end decodes ----------

# ---- group: 1.01.E03a2
# MONSTER
decodes_2 = DecodesPythonScript(a=tor_a, b=tor_b, count_n=count_u)  # -> console, out
# ---------- decodes_2: Python ----------
from math import *
#########################################
"""
An Ellipse Crossed with A Diamond
"""
for n in Interval.twopi()/count_n:
    x = a*cos(n)
    y = b*abs(sin(n))*sin(n)
    pt = Point(x,y)
    out.put(pt)

#########################################
# ---------- end decodes_2 ----------

# ---- group: 1.01.E03a3
decodes_3 = DecodesPythonScript(a=tor_a, b=mon_b, count_n=count_u)  # -> console, out
# ---------- decodes_3: Python ----------
from math import *
#########################################
"""
An Ellipse Crossed with A Hypocycloid
"""

for n in Interval.twopi()/count_n:
    num_cusps = 5
    x = a*cos(n)
    y = (b-1)*sin(n) + sin((b-1)*n)
    pt = Point(x,y)
    out.put(pt)

#########################################
# ---------- end decodes_3 ----------
