# Grasshopper definition 1.02.E01.ghx (Grasshopper 0.9.76)
# plug-ins: Decodes Python Interpreter

# Monsters II
vec = Vector(Vector(40, 0, 0))
# RATIONAL
count_v = Integer(Slider(20, range=0..100))
count_u = Integer(Slider(60, range=0..100))
tor_a = Number(Slider(10, range=-10..10))
tor_b = Number(Slider(6, range=-10..10))

# ---- group: 1.02.E01a
decodes = DecodesPythonScript(a=tor_a, b=tor_b, count_u=count_u, count_v=count_v)  # -> console, out, out_props, clrs, clrs_props
# ---------- decodes: Python ----------
from math import *
#########################################

for u in Interval.twopi()/count_u:
    pts = []
    for v in Interval.twopi()/count_v:
        x = (a+b*cos(v))*cos(u)
        y = (a+b*cos(v))*sin(u)
        z = b*math.sin(v)
        pts.append(Point(x,y,z))
    cent = Point.centroid(pts)
    for spt in pts:
        ept = Point.interpolate(spt,cent,0.25)
        seg = Segment(spt,ept)
        clr = Color.HSB(u/math.pi,1,1)
        seg.set_color(clr)
        out.put(seg)

#########################################
        clrs.put(clr)
# ---------- end decodes ----------

# ----
mon_a = Number(Slider(3, range=-10..10))
mon_b = Number(Slider(5, range=-10..10))
move = Move(Geometry=decodes.out, Motion=vec)  # -> Geometry, Transform
hardboil = DecodesHardBoil(Geometry=move.Geometry, Properties=decodes.out_props)

# ---- group: for graphic output
geo = Geometry(move.Geometry)
col = Colour(decodes.clrs)

# ---- group: 1.02.E01b
# MONSTER
decodes_2 = DecodesPythonScript(a=mon_a, b=mon_b, count_u=count_u, count_v=count_v)  # -> console, out, out_props, clrs, clrs_props
# ---------- decodes_2: Python ----------
from math import *
#########################################

for u in Interval.twopi()/count_u:
    pts = []
    for v in Interval.twopi()/count_v:
        x = ( (a+1)*cos(u) + cos(u*(a+1)) ) * v
        y = ( (a+1)*sin(u) + sin(u*(a+1)) ) * v
        z = 3.0*sin(v*b)
        pts.append(Point(x,y,z))
    cent = Point.centroid(pts)
    for spt in pts:
        ept = Point.interpolate(spt,cent,0.5)
        seg = Segment(spt,ept)
        clr = Color.HSB(u/math.pi,1,1)
        seg.set_color(clr)
        out.put(seg)
        
#########################################
        clrs.put(clr)
# ---------- end decodes_2 ----------

# ----
hardboil_2 = DecodesHardBoil(Geometry=decodes_2.out, Properties=decodes_2.out_props)

# ---- group: for graphic output
geo_2 = Geometry(decodes_2.out)
col_2 = Colour(decodes_2.clrs)

# ----
pipe = Pipe(Curve=geo_2, Radius=Slider(0.1, range=0..1), Caps=0)  # -> flatten(Pipe)
