# Grasshopper definition 1.04.E01.ghx (Grasshopper 0.9.76)
# plug-ins: Decodes Python Interpreter

vec = Vector(Vector(40, 0, 0))
count_v = Integer(Slider(20, range=0..100))
count_u = Integer(Slider(60, range=0..100))
tor_a = Number(Slider(10, range=-10..10))
tor_b = Number(Slider(6, range=-10..10))

# ---- group: 1.04.E01a
# Monsters III
decodes = DecodesPythonScript(a=tor_a, b=tor_b, count_u=count_u, count_v=count_v)  # -> console, out
# ---------- decodes: Python ----------
from math import *
import itertools
row_periodic = False
#########################################

pt_grid = []
for u in Interval.twopi()/count_u:
    pt_grid.append([])
    for v in Interval.twopi()/count_v:
        x = ( (a+1)*cos(u) + cos(u*(a+1)) ) * (v + 1)
        y = ( (a+1)*sin(u) + sin(u*(a+1)) ) * (v + 1)
        z = 3.0*sin(v*b)   
        pt_grid[-1].append(Point(x,y,z))
        
seg_grid = []
for row in pt_grid:
    segs = [Segment(pa,pb) for pa,pb in zip(row[:-1],row[1:])]
    if row_periodic: segs.append(Segment(row[-1],row[0]))
    seg_grid.append(segs)


#########################################
out.put(seg_grid)
# ---------- end decodes ----------

# ---- group: 1.04.E01b
decodes_2 = DecodesPythonScript(a=tor_a, b=tor_b, count_u=count_u, count_v=count_v)  # -> console, out
# ---------- decodes_2: Python ----------
from math import *
import itertools
col_periodic = True

pt_grid = []
for u in Interval.twopi()/count_u:
    pt_grid.append([])
    for v in Interval.twopi()/count_v:
        x = ( (a+1)*cos(u) + cos(u*(a+1)) ) * (v + 1)
        y = ( (a+1)*sin(u) + sin(u*(a+1)) ) * (v + 1)
        z = 3.0*sin(v*b)   
        pt_grid[-1].append(Point(x,y,z))
        
#########################################

segs_transposed = [[] for v in range(len(pt_grid[0]))]
for u,v in itertools.product(range(count_u),range(count_v)):
    pa = pt_grid[u][v]
    pb = pt_grid[u-1][v]
    segs_transposed[v].append(Segment(pa,pb))

#########################################
out.put(segs_transposed)
# ---------- end decodes_2 ----------

# ---- group: 1.04.E01c
decodes_3 = DecodesPythonScript(a=tor_a, b=tor_b, count_u=count_u, count_v=count_v)  # -> console, out
# ---------- decodes_3: Python ----------
from math import *
import itertools
count_u*=2

pt_grid = []
for u in Interval.twopi()/count_u:
    pt_grid.append([])
    for v in Interval.twopi()/count_v:
        x = ( (a+1)*cos(u) + cos(u*(a+1)) ) * (v + 1)
        y = ( (a+1)*sin(u) + sin(u*(a+1)) ) * (v + 1)
        z = 3.0*sin(v*b)   
        pt_grid[-1].append(Point(x,y,z))
#########################################

off = 2
segs_diag = []
for u,v in itertools.product(range(count_u),range(count_v)):
    pa = pt_grid[u][v]
    pb = pt_grid[u-1][v-off]
    if v-off>=0: segs_diag.append(Segment(pa,pb))



#########################################
out.put(segs_diag)
# ---------- end decodes_3 ----------

# ----
mon_a = Number(Slider(3, range=-10..10))
mon_b = Number(Slider(5, range=-10..10))
