# Grasshopper definition 1.05.E01.ghx (Grasshopper 0.9.75)
# plug-ins: Decodes Python Interpreter

pt = Point(Point(0.158103851, 0.2736816553, 0))
pt_2 = Point(Point(0.7144039834, 0.2290148637, 0))
merge = Merge(Data1=pt_2, Data2=pt)
crv = Curve(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)

# ---- group: don't mess
sort_pt = SortPoints(Points=merge)  # -> Points, Indices
merge_2 = Merge(Data1={imaginary=0, real=0}, Data2=sort_pt.Points, Data3={imaginary=0, real=1})
pt_3 = Point(merge_2)

# ----
decodes = DecodesPythonScript(sides=Slider(6, range=3..10))  # -> console, a; inputs sides: Int32
# ---------- decodes: Python ----------
rg = RGon(sides,radius=1.0)
for edge in rg.edges: a.put(edge)
# ---------- end decodes ----------
explode = Explode(Curve=crv, Recursive=True)  # -> Segments, Vertices
number_slider = Slider(4, range=1..4)
line = Line(explode.Segments)
decodes_2 = DecodesPythonScript(seed_segs=line, prm_pts=pt_3, gens=number_slider)  # -> console, a, b; inputs seed_segs: list, prm_pts: list, gens: Int32; disabled
# ---------- decodes_2: Python ----------
segs = seed_segs
b.put(segs)

# try these - they describe Koch and Gosper
prms = [(0,0),(0.357,0.124),(0.643,-0.124),(1,0)]
prms = [(0,0),(0.33,0.0),(0.5,0.25),(0.66,0.0),(1,0)]

print prm_pts
prms = [(pt.x,pt.y) for pt in prm_pts]

def thread(pts):
    return [Segment(pa,pb) for pa,pb in zip(pts[:-1],pts[1:])]

#########################################

subsegs = []
    
def v_vec(seg,prev_seg,next_seg,u,v):
    fac = seg.length/2
    va = Vec.bisector(seg.vec.inverted(),prev_seg.vec).normalized(fac)
    vb = Vec.bisector(seg.vec,next_seg.vec.inverted()).normalized(fac)
    return Vec.interpolate(va,vb,u)*v

def displace_seg(seg,prv,nxt):
    # vecs to displace along and away from given Segment
    u_vec = seg.vec
    #construct division Points by displacement and thread
    subs = thread([seg.spt+(u_vec*u)+v_vec(seg,prv,nxt,u,v) for u,v in prms])
    subsegs.extend(subs)
    
for n in range(gens):
    subsegs = []
    segs_prev = [segs[-1]] + segs[:-1]
    segs_next = segs[1:] + [segs[0]]
    map(displace_seg,segs,segs_prev,segs_next)
    segs = subsegs
    
#########################################
    b.put(subsegs)
    
a.put(segs)
# ---------- end decodes_2 ----------
decodes_3 = DecodesPythonScript(seed_segs=decodes.a, prm_pts=pt_3, gens=number_slider)  # -> console, a, b; inputs seed_segs: list, prm_pts: list, gens: Int32
# ---------- decodes_3: Python ----------
segs = seed_segs
b.put(segs)

# try these - they describe Koch and Gosper
prms = [(0,0),(0.357,0.124),(0.643,-0.124),(1,0)]
prms = [(0,0),(0.33,0.0),(0.5,0.25),(0.66,0.0),(1,0)]

prms = [(pt.x,pt.y) for pt in prm_pts]

#########################################

def thread(pts):
    return [Segment(pa,pb) for pa,pb in zip(pts[:-1],pts[1:])]

def displace_seg(seg):
    # vecs to displace along and away from given Segment
    u_vec, v_vec = seg.vec, seg.vec.cross(UZ)
    #construct division Points by displacement and thread
    subs = thread( [seg.spt + (u_vec*u) + (v_vec*v) for u,v in prms] )
    subsegs.extend(subs)
    
for n in range(gens):
    subsegs = []
    map(displace_seg,segs)
    segs = subsegs
    
#########################################
    b.put(subsegs)
    
a.put(segs)
# ---------- end decodes_3 ----------
line_2 = Line(decodes_2.a)
line_3 = Line(decodes_3.a)
line_4 = Line(decodes_2.b)
line_5 = Line(decodes_3.b)
