# Grasshopper definition 1.05.E03.gh (Grasshopper 0.9.75)
# plug-ins: Decodes Python Interpreter

crv = Curve(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)
crv_2 = Curve(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)

# ---- group: tri
explode = Explode(Curve=crv, Recursive=True)  # -> Segments, Vertices

# ---- group: square
explode_2 = Explode(Curve=crv_2, Recursive=True)  # -> Segments, Vertices

# ----
seed_segments = Line(explode_2.Segments)
number_slider = Slider(6, range=0..10)

# ---- group: library of subdivision functions
decodes = DecodesPythonScript()  # -> console, a, b
# ---------- decodes: Python ----------
#########################################


"""
Face Center
Returns the center of a given face
"""
def face_cen(fac):
    return Point.centroid([seg.ept for seg in fac])
    
"""
Split Face Edges
Returns the division Points, starting starting sub-segments and ending sub-segments that result from division of each given edge at a given t-value.
"""
def split_edges(fac, tval=0.5):
    pts = [seg.eval(tval) for seg in fac]
    ssubs = [Segment(seg.spt,pt) for seg,pt in zip(fac,pts)]
    esubs = [Segment(pt,seg.ept) for seg,pt in zip(fac,pts)]
    return pts, ssubs, esubs

"""
Corner-to-Center Rectangular Subdivision
"""
def quadsub_corner_to_ctr(fac):
        subfaces = []
        cen = face_cen(fac)
        csubs = [Segment(seg.ept,cen) for seg in fac]
        subfaces.append( (fac[0],csubs[0],csubs[3].inverted())  )
        subfaces.append( (fac[1],csubs[1],csubs[0].inverted())  )
        subfaces.append( (fac[2],csubs[2],csubs[1].inverted())  )  
        subfaces.append( (fac[3],csubs[3],csubs[2].inverted())  )  
        return subfaces
        
"""
Edge-to-Center Triangular Subdivision
Subdivides a triangular face into three quadrilateral faces connected at the center of the given face.
"""     
def trisub_edge_to_ctr(fac):
        subfaces = []
        cen = face_cen(fac)
        # split edges at the middle
        pts, ssubs, esubs = split_edges(fac)
        msubs = [Segment(pt,cen) for pt in pts]
        
        subfaces.append( (ssubs[0],msubs[0],msubs[2].inverted(),esubs[2]) )
        subfaces.append( (ssubs[1],msubs[1],msubs[0].inverted(),esubs[0]) )
        subfaces.append( (ssubs[2],msubs[2],msubs[1].inverted(),esubs[1]) )
        return subfaces

"""
Diagonal Rectangular Subdivision
Subdivides a quadrilateral face into two triangular faces by connecting the corners that result in the shortest possible diagonal.
"""
def quadsub_diagonal(fac):
        subfaces = []
        if fac[0].spt.dist(fac[1].ept) < fac[1].spt.dist(fac[2].ept):
            subfaces.append( (fac[0],fac[1],Segment(fac[1].ept,fac[0].spt)) )
            subfaces.append( (fac[2],fac[3],Segment(fac[3].ept,fac[2].spt)) )
        else:
            subfaces.append( (fac[1],fac[2],Segment(fac[2].ept,fac[1].spt)) )
            subfaces.append( (fac[3],fac[0],Segment(fac[0].ept,fac[3].spt)) )        
        return subfaces


        
"""
Corner-to-Center Triangular Subdivision
Subdivides a triangular face into three triangular faces connected at the center of the given face.
"""
def trisub_corner_to_ctr(fac):
        subfaces = []
        cen = face_cen(fac)
        csubs = [Segment(seg.ept,cen) for seg in fac]
        subfaces.append( (fac[0],csubs[0],csubs[2].inverted())  )
        subfaces.append( (fac[1],csubs[1],csubs[0].inverted())  )
        subfaces.append( (fac[2],csubs[2],csubs[1].inverted())  )  
        return subfaces

"""
Edge-to-Edge Triangular Subdivision
Subdivides a triangular face into four triangular faces that connect the midpoint of each edge of the given face.
"""
def trisub_edge_to_edge(fac):
        subfaces = []
        # split edges at the middle
        pts, ssubs, esubs = split_edges(fac)
        msubs = [Segment(pa,pb) for pa,pb in zip(pts,pts[-1:]+pts[:-1])]
        
        subfaces.append( tuple([sub.inverted() for sub in msubs]) )
        subfaces.append( (ssubs[0],msubs[0],esubs[2]) )
        subfaces.append( (ssubs[1],msubs[1],esubs[0]) )
        subfaces.append( (ssubs[2],msubs[2],esubs[1]) )
        return subfaces
        


#########################################



a.put(trisub_corner_to_ctr)
a.put(trisub_edge_to_edge)
a.put(trisub_edge_to_ctr)

b.put(quadsub_corner_to_ctr)
b.put(quadsub_diagonal)
# ---------- end decodes ----------

# ----
pt = Point(Point(59.7572315, 51.13840391, 0))

# ---- group: patterned
decodes_2 = DecodesPythonScript(segs=seed_segments, tri_funcs=decodes.a, quad_funcs=decodes.b, gens=number_slider)  # -> console, a; inputs segs: list, tri_funcs: list, quad_funcs: list, gens: Int32; disabled
# ---------- decodes_2: Python ----------
segs = tuple(segs)
faces = [segs]

trisub_corner_to_ctr = tri_funcs[0]
trisub_edge_to_edge = tri_funcs[1]
trisub_edge_to_ctr = tri_funcs[2]

quadsub_corner_to_ctr = quad_funcs[0]
quadsub_diagonal = quad_funcs[1]


#########################################

quad_funcs = [\
    quadsub_corner_to_ctr,\
    quadsub_diagonal
    ]

tri_funcs = [\
    trisub_corner_to_ctr,\
    trisub_edge_to_edge,\
    trisub_edge_to_ctr\
    ]

def subdivide(gen):
    subfaces = []
    for fac in faces:
        # if this face is a quad
        if len(fac) == 4: subfaces.extend( quad_funcs[gen%2](fac) )
        # if this face is a tri
        if len(fac) == 3: subfaces.extend( tri_funcs[gen%3](fac) )
            
    return subfaces

for n in range(gens): faces = subdivide(n)

#########################################
a.put(faces)
# ---------- end decodes_2 ----------

# ---- group: attr
decodes_3 = DecodesPythonScript(segs=seed_segments, tri_funcs=decodes.a, quad_funcs=decodes.b, gens=number_slider, attr_pt=pt)  # -> console, a; inputs segs: list, tri_funcs: list, quad_funcs: list, gens: Int32; disabled
# ---------- decodes_3: Python ----------
segs = tuple(segs)
faces = [segs]

trisub_corner_to_ctr = tri_funcs[0]
trisub_edge_to_edge = tri_funcs[1]
trisub_edge_to_ctr = tri_funcs[2]

quadsub_corner_to_ctr = quad_funcs[0]
quadsub_diagonal = quad_funcs[1]


#########################################



def subdivide():
    subfaces = []
    while faces:
        fac = faces.pop()
        dist = Point.centroid([seg.ept for seg in fac]).dist(attr_pt)
        
        # if this face is a quad
        if len(fac) == 4:
            if dist > 2.8: subfaces.extend(quadsub_corner_to_ctr(fac))
            else: subfaces.extend(quadsub_diagonal(fac))
        # if this face is a tri
        if len(fac) == 3:
            if dist < 5.8: subfaces.extend(trisub_edge_to_ctr(fac))
            else: subfaces.extend(trisub_edge_to_edge(fac))
            
    return subfaces

for n in range(gens): faces = subdivide()

#########################################
a.put(faces)
# ---------- end decodes_3 ----------

# ----
result_segments = Line(simplify(decodes_3.a))
panel = Panel(result_segments)
