# Grasshopper definition 1.05.E04.gh (Grasshopper 0.9.75)
# plug-ins: Decodes Python Interpreter

pop2d = Populate2D(
    Region={Plane=PlaneXY(4.918586286, 3.112529845, 0), Size=Domain2(u=0..19.02726683, v=0..10.47655178)},
    Count=Slider(85, range=4..500),
    Seed=1)
pt = Point(pop2d)
lng = ListLength(List=pt)
dom = ConstructDomain(DomainStart=0, DomainEnd=lng)
remap = RemapNumbers(Value=Slider(0.59, range=0..1), Source=Domain(0, 1), Target=dom)  # -> Mapped, Clipped
int = Integer(remap.Mapped)
decodes = DecodesPythonScript(pts=pt)  # -> console, a; inputs pts: list
# ---------- decodes: Python ----------
pts = Point.cull_duplicates(pts)
#########################################

def sort_by_angle(origin,*args):
    spts = sorted(args,key=lambda pt: UX.angle(Vec(origin,pt)))
    return origin, spts
    
def tip_is_ccw_concave(pts):
    pa, pb, pc = pts[-3],pts[-2],pts[-1]
    return Vec(pa,pb).cross(Vec(pb,pc)).z < 0    

pts = Point.cull_duplicates(pts)
pts = sorted(pts,key=lambda pt: pt.y)
opt, pts = sort_by_angle(*pts)

cvx_pts = [opt,pts[0],pts[1]]
for pt in pts[2:]:
    cvx_pts.append(pt)
    while tip_is_ccw_concave(cvx_pts):
        cvx_pts.pop(-2)

#########################################
a.put(PGon(cvx_pts))
# ---------- end decodes ----------
decodes_2 = DecodesPythonScript(pts=pt, lim=int)  # -> console, a, b, c; inputs pts: list, lim: Int32
# ---------- decodes_2: Python ----------
pts = Point.cull_duplicates(pts)
#########################################

def sort_by_angle(origin,*args):
    spts = sorted(args,key=lambda pt: UX.angle(Vec(origin,pt)))
    return origin, spts
    
def tip_is_ccw_concave(pts):
    pa, pb, pc = pts[-3],pts[-2],pts[-1]
    return Vec(pa,pb).cross(Vec(pb,pc)).z < 0    

pts = sorted(pts,key=lambda pt: pt.y)
opt, pts = sort_by_angle(*pts)

cvx_pts = [opt,pts[0],pts[1]]
for pt in pts[2:lim]:
    cvx_pts.append(pt)
    while tip_is_ccw_concave(cvx_pts):
        cvx_pts.pop(-2)

#########################################
segs = [Segment(pa,pb) for pa,pb in zip(cvx_pts[:-1],cvx_pts[1:])]
segs.append(Segment(cvx_pts[-1],cvx_pts[0]))
a.put(opt)
b.put(pts)
c.put(segs)
# ---------- end decodes_2 ----------
crv = Curve(decodes.a)
line = Line(decodes_2.c)
pt_2 = Point(decodes_2.a)
points = PointList(Points=decodes_2.b, Size=Slider(0.43, range=0.1..1))
