# Grasshopper definition 1.09.E02.ghx (Grasshopper 0.9.75)
# plug-ins: Decodes Python Interpreter

pt = Point([Point(12.27450028, 16.42760242, 0), Point(20.01348547, 20.16811193, 0), Point(21.56128251, 13.58997451, 0)])
pt_2 = Point(Point(24.96619631, 20.55506119, 0))
metaball = MetaBall(Points=pt, Plane=PlaneXY(0, 0, 0), Point=pt_2)
simplify = SimplifyCurve(Curve=metaball, Tolerance=Slider(0.56, range=0..0.6), AngleTolerance=Slider(2.7, range=0..30))  # -> Curve, Simplified
explode = Explode(Curve=simplify.Curve, Recursive=True)  # -> Segments, Vertices
test_b = Curve(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)
test_c = Curve(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)
test_d = Curve(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)
test_a = Curve(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)
test_e = Curve(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)
test_f = Curve(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)
test_g = Curve(<curve referenced from the Rhino model>)
test_h = Curve(<curve referenced from the Rhino model>)
_15_tests = Curve([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])
blob = Curve(simplify.Curve)
test_d2 = Curve(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)
offst_dist = Number(Slider(-3.51, range=-10..30))
test_pgon = Curve(blob)
panel = Panel(test_pgon)

# ---- group: simple offset
# a
decodes = DecodesPythonScript(pg=test_pgon, val=offst_dist)  # -> console, a, b; disabled
# ---------- decodes: Python ----------
#########################################


"""
Simple Offset
Allows bisectors to cross each other, and allows polygon to become self-intersecting.
"""
def offset(self,dist,flip=False):
    # NOTE THE SPLAT OPERATOR
    vecs, angles = zip(*[self.angle_bisector(i) for i in range(len(self))])
    off_dists = [dist/math.sin(angle) for angle in angles]
    if flip: off_dists = [-d for d in off_dists]
    bones = [Segment(p, p + v.normalized(d)) for v,d,p in zip(vecs,off_dists,self.pts) ]
    
    b.put(bones)
    
    return PGon([bone.ept for bone in bones])


#########################################

off = offset(pg,val)
a.put(off.edges)
# ---------- end decodes ----------

# ---- group: offset that resolves crossed bisectors
# b
decodes_2 = DecodesPythonScript(pg=test_pgon, val=offst_dist)  # -> console, a, b, c; disabled
# ---------- decodes_2: Python ----------
"""
Offset Routine Handling Edge Event
Resolves edge events which occurs when angle bisectors cross 
"""
def offset(self,offset_dist,flip=False):
    vecs, angles = zip(*[self.angle_bisector(i) for i in range(len(self))])
    off_dists = [offset_dist/math.sin(angle) for angle in angles]
    if flip: off_dists = [-d for d in off_dists]
    bones = [Segment(p, p + v.normalized(d)) for v,d,p in zip(vecs,off_dists,self.pts) ]
    dead_bones = []
    while True:
        still_cleaning = clean_crossed_bones(bones)
        if not still_cleaning: break
        else: 
            bones = still_cleaning[0]
            dead_bones.extend(still_cleaning[1])
        
    b.put(bones)
    c.put(dead_bones)
    return PGon([bone.ept for bone in bones])

def clean_crossed_bones(bones):
    xsec = Intersector()
    for n, pair in enumerate(match(bones,[0,-1])):
        bone, other = pair
        if xsec.of(bone,other):
            va,vb = bone.vec*(1-xsec.ta), other.vec*(1-xsec.tb)
            bones[n] = Segment(xsec[0],Vec.average([va,vb]))
            bones.pop(n-1)
            return bones, [Segment(bone.spt,xsec[0]),Segment(other.spt,xsec[0])]
    return False


off = offset(pg,val)
a.put(off.edges)
# ---------- end decodes_2 ----------

# ----
# c
decodes_3 = DecodesPythonScript(pg=test_pgon)  # -> console, a, b, c, d; disabled
# ---------- decodes_3: Python ----------
edges = pg.edges
rays = [Ray(pg.pts[n],pg.angle_bisector(n)[0].normalized()) for n in range(len(pg))]
for ry in rays:
    if not ry.spt+ry.vec in pg: ry.vec = ry.vec.inverted()

def appx_less_than(a,b):
    return a < b or a-b < EPSILON

cnt,lmt = 0,100
#########################################

xsec = Intersector()
nice_bones = []
while True:
    # at each step, we reduce.
    # if only two rays remain, we may connect them and be done.
    if len(rays) <= 2:
        nice_bones.append( Segment(rays[0].spt,rays[1].spt) )
        break
    
    xsec_prms = []
    # for each ray, a tuple of the t-val of intersection with neighbors (prev,next)
    for ry_this, ry_prev, ry_next in match(rays,[0,-1,1]):
        t_prev, t_next = False, False
        if xsec.of(ry_this, ry_prev): t_prev = xsec.ta
        if xsec.of(ry_this, ry_next): t_next = xsec.ta
        xsec_prms.append({'prev':t_prev,'next':t_next})
        
        
    # for this step, produce a list of rays that may be reduced. 
    # for each ray, a distance to the relevant intersection and the index of the ray (dist,index)
    reducables = []
    for n, pair in enumerate(match(xsec_prms,[0,-1])):
        this_prms, prev_prms = pair
        # if this ray does not intersect the previous, continue
        if not this_prms['prev']: continue
        # if this ray intersects the previous before the next
        if not this_prms['next'] or appx_less_than(this_prms['prev'],this_prms['next']):
            # if the previous intersects this one before its other neighbor
            if not prev_prms['prev'] or appx_less_than(prev_prms['next'], prev_prms['prev']):
                # this is an appropriate ray to reduce. log it.
                rank = this_prms['prev'] + prev_prms['next']
                reducables.append( (rank,{'param':this_prms['prev'],'idx':n}) )
    
    if len(reducables)>0:
        choice = sorted(reducables)[0][1]
        t,idx = choice['param'], choice['idx']
        pt = rays[idx].eval(t)
        sa,sb = Segment(rays[idx].spt,pt), Segment(rays[idx-1].spt,pt)
        nice_bones.extend([sa,sb])
        
        # figuring out which of the possible bisectors to use is a real pain.
        if edges[idx].is_parallel(edges[idx-2]):
            # in case of parallel edges 
            bsecs = [edges[idx].vec.normalized(), edges[idx-2].vec.normalized()]
        else: 
            bsecs = Vec.bisectors(edges[idx].vec, edges[idx-2].vec)
        
        guide = Vec.bisector(sa.vec,sb.vec)
        vec = guide.best_match(bsecs)
        
        edges.pop(idx-1)
        rays[idx] = Ray(pt,vec)
        rays.pop(idx-1)
            
    else:
        print "CANT REDUCE ANY?!"
        break

#########################################
    
    cnt += 1
    if cnt >= lmt: break

a.put(nice_bones)
# ---------- end decodes_3 ----------

# ---- group: DEBUG VERSION
decodes_4 = DecodesPythonScript(pg=test_pgon, lmt=Slider(21, range=0..30))  # -> console, a, b, c, d
# ---------- decodes_4: Python ----------
BIG = 1/EPSILON

edges = pg.edges
rays = [Ray(pg.pts[n],pg.angle_bisector(n)[0].normalized()) for n in range(len(pg))]
for ry in rays:
    if not ry.spt+ry.vec in pg: ry.vec = ry.vec.inverted()

def appx_less_than(a,b):
    return a < b or a-b < EPSILON


xsec = Intersector()
cnt = 0
while True:
    if cnt >= lmt: break    
    if len(rays) <= 2:
        print "only ", len(rays), "rays left, all done"
        sc = Segment(rays[0].spt,rays[1].spt)
        c.put(sc)
        break
    
    xsec_prms = []
    # for each ray, a tuple of the t-val of intersection with neighbors (prev,next)
    for ry_this, ry_prev, ry_next in match(rays,[0,-1,1]):
        t_prev, t_next = False, False
        if xsec.of(ry_this, ry_prev): t_prev = xsec.ta
        if xsec.of(ry_this, ry_next): t_next = xsec.ta
        xsec_prms.append({'prev':t_prev,'next':t_next})
        #c.put(ry_this.eval(min(tp,tn)))
        
    reducables = []
    for n, pair in enumerate(match(xsec_prms,[0,-1])):
        this_prms, prev_prms = pair
        # if this ray does not intersect the previous, continue
        if not this_prms['prev']: continue
        # if this ray intersects the previous before the next
        if not this_prms['next'] or appx_less_than(this_prms['prev'],this_prms['next']):
            # if the previous intersects this one before its other neighbor
            if not prev_prms['prev'] or appx_less_than(prev_prms['next'], prev_prms['prev']):
                # this is an appropriate ray to reduce. log it.
                rank = this_prms['prev'] + prev_prms['next']
                reducables.append( (rank,{'param':this_prms['prev'],'idx':n}) )
    
    for reducable in reducables:
        t,idx = reducable[1]['param'], reducable[1]['idx']
        pt = rays[idx].eval(t)
        sa = Segment(rays[idx].spt,pt)
        sb = Segment(rays[idx-1].spt,pt)
        d.put(sa)
        d.put(sb)        
    
    if len(reducables)>0:
        choice = sorted(reducables)[0][1]
        t,idx = choice['param'], choice['idx']
        pt = rays[idx].eval(t)
        print "reducing at index: ", idx
        
        sa = Segment(rays[idx].spt,pt)
        sb = Segment(rays[idx-1].spt,pt)
        c.put(sa)
        c.put(sb)
        
        print edges[idx].vec, edges[idx-2].vec
        
        # figuring out which of the possible bisectors to use is a real pain.
        if edges[idx].is_parallel(edges[idx-2]): bsecs = [edges[idx].vec.normalized(), edges[idx-2].vec.normalized()]
        else: bsecs = Vec.bisectors(edges[idx].vec, edges[idx-2].vec)
        try:
            guide = Vec.average([sa.vec.normalized(),sb.vec.normalized()])
            #guide = edges[idx].vec
            #guide = Vec(pt,Point.centroid([e.eval(0.5) for e in edges]))
            #guide = edges[idx-1].vec.cross(Vec(0,0,1))
            vec = guide.best_match(bsecs)
        except:
            print "i don't do well with symmetry"
            break
        
        
        edges.pop(idx-1)
        rays[idx] = Ray(pt,vec)
        rays.pop(idx-1)
            
    else:
        print "CANT REDUCE ANY?!"
        break
    
    cnt += 1


#d.put(xsec_pts)
a.put(edges)
b.put(rays)
# ---------- end decodes_4 ----------

# ----
line = Line(decodes_2.b)
number_slider = Slider(0.52, range=0..1)
line_2 = Line(decodes_2.c)
geo = Geometry(decodes_3.a)
panel_2 = Panel(decodes_4.console)
geo_2 = Geometry(decodes_4.b)
crv = Curve(decodes.a)
crv_2 = Curve(decodes_2.a)
curvepoint = PointOnCurve(crv, parameter=0.512)
seg_viz = SEGVIZ(num=number_slider, line=decodes_4.a)
ray_viz = RAYVIZ(rhobj=geo_2, num=number_slider)
curvepoint_2 = PointOnCurve(crv_2, parameter=0.512)
points = PointList(Points=curvepoint, Size=Slider(0.6, range=0..10))
points_2 = PointList(Points=curvepoint_2, Size=Slider(0.6, range=0..10))

# ---- group: broken / offset that attempts to resolve crossed bisectors and splits
decodes_5 = DecodesPythonScript(pg=test_pgon, val=offst_dist)  # -> console, a, b, c; disabled
# ---------- decodes_5: Python ----------
def clean_crossed_bisectors(bones,offset_dist):
    xsec = Intersector()
    for n,bone in enumerate(bones):
        other = bones[n-1]
        if xsec.of(bone,other):
            vec = Vec.average([ bone.vec*(1-xsec.ta), other.vec*(1-xsec.tb) ])
            bones[n] = Segment(xsec[0],vec)
            bones.pop(n-1)
            return bones, [Segment(bone.spt,xsec[0]),Segment(other.spt,xsec[0])]
    return False

"""
Offset Routine Handling Edge and Split Events
Additionally handles split events which result in polygons split upon shrinking 
"""
    
def offset(self,offset_dist,flip=False):
    vecs, angles = zip(*[self.angle_bisector(i) for i in range(len(self))])
    off_dists = [offset_dist/math.sin(angle) for angle in angles]
    if flip: off_dists = [-d for d in off_dists]
    
    bones = [Segment(p, p + v.normalized(d)) for v,d,p in zip(vecs,off_dists,self.pts) ]
    dead_bones = []
    while True:
        still_cleaning = clean_crossed_bisectors(bones,offset_dist)
        if not still_cleaning: break
        else: 
            bones = still_cleaning[0]
            dead_bones.extend(still_cleaning[1])
    
    b.put(bones)
    a.put(PGon([bone.ept for bone in bones]).edges)
    
    pgons = [PGon([bone.ept for bone in bones])]
    clean_pgons = []
    while pgons:
        split_result = split_pgon(pgons.pop(0))
        if len(split_result) > 1: pgons.extend(split_result)
        else: clean_pgons.extend(split_result)
        
    # for shrinking polygons, any pgons crossed by a bone is inside-out, and should be removed
    clean_pgons = [pg for pg in clean_pgons if is_boneless(pg,bones)]
    
    return clean_pgons



def is_boneless(pg,bones):
    return all( [bone.eval(0.99) not in pg for bone in bones] )

def split_pgon(pg):
    xsec = Intersector()
    #clean_pts = []
    for n,edge in enumerate(pg.edges):
        #clean_pts.append(edge.spt)
        for other in pg.edges[n+2:]:
            if xsec.of(edge,other):
                if xsec[0] == edge.spt: continue
                idx = pg.edges.index(other)
                print "XSEC:", n, idx
                #clean_pts.append(xsec[0])
                #for post in pg.edges[idx+1:]: clean_pts.append(post.spt)
                clean_pts = list(pg.pts[:n+1]) + [xsec[0]] + list(pg.pts[idx+1:])
                dirty_pts = [xsec[0]] + [p for p in pg.pts if p not in clean_pts]
                return [PGon(clean_pts),PGon(dirty_pts)]
                
    return [pg]

c.put(offset(pg,val))
# ---------- end decodes_5 ----------

# ---- group: broken
crv_3 = Curve(decodes_5.a)
curvepoint_3 = PointOnCurve(crv_3, parameter=0.512)
points_3 = PointList(Points=curvepoint_3, Size=Slider(2.4, range=0..10))

# ==== cluster RAYVIZ
rhobj = ClusterInput()
num = ClusterInput()
sortbytype = SortObjectsByType(RhinoObjects=rhobj)  # -> Points, Curves, Surfaces, Breps, Meshes, TextObjects, HatchObjects, LightObjects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
num_2 = Number(num)
pt = Point(sortbytype.Points)
line = Line(sortbytype.Curves)
pt_2 = Point(pt)
line_2 = Line(line)
rev = Reverse(Vector=line_2)
amp = Amplitude(Vector=rev, Amplitude=num_2)
move = Move(Geometry=pt_2, Motion=amp)  # -> Geometry, Transform
points = PointList(Points=move.Geometry, Size=num_2)

# ==== cluster SEGVIZ
line = ClusterInput()
num = ClusterInput()
line_2 = Line(line)
num_2 = Number(num)
curvepoint = PointOnCurve(line_2, parameter=0.5)
points = PointList(Points=curvepoint, Size=num_2)
