# Grasshopper definition 1.11.E05.ghx (Grasshopper 0.9.75)
# plug-ins: Decodes Python Interpreter

# ---- group: Simple Helix
decodes = DecodesPythonScript(rad=Slider(8.54, range=1..50), height=Slider(36.69, range=1..50), turns=Slider(6.2, range=1..10))  # -> console, a
# ---------- decodes: Python ----------
from math import *
two_pi = 2*pi
#########################################

"""
A Simple Helix
"""
def func(t):
    theta = turns * two_pi * t/height
    return CS().eval_cyl(rad, theta,t)

ival = Interval(0,height)
crv = Curve(func,ival)




#########################################
crv.tol = 0.05
a.put(crv.surrogate)
# ---------- end decodes ----------

# ---- group: Bezier Profile Helix
decodes_2 = DecodesPythonScript(
    height=Slider(28, range=1..28),
    rad_cap=Slider(10, range=0..10),
    rad_mid=Slider(-2.9, range=-4..10),
    mid_height=Slider(0.7, range=0..1),
    turns=Slider(5.92, range=1..10),
    k=Slider(1.91, range=0.6..3))  # -> console, a
# ---------- decodes_2: Python ----------
from math import *
two_pi = 2*pi
#########################################
"""
Bezier Profile Helix
Produces a helical curve with a profile that follows a Bezier curve through three Points 
"""

def calc_radius_at(t):
    pt_a = Point(rad_cap,0)
    pt_b = Point(rad_mid,mid_height*height)
    pt_c = Point(rad_cap,height)
    rad = Curve.bezier([pt_a,pt_b,pt_c]).eval(t).x
    return rad

def func(t):
    rad = calc_radius_at(t)
    theta = turns * two_pi * t**k
    return CS().eval_cyl(rad, theta, t*height)
    

ival = Interval()
crv = Curve(func,ival)

#########################################
crv.tol = 0.005
a.put(crv.surrogate)
# ---------- end decodes_2 ----------

# ---- group: Sinusoidal Profile Helix
decodes_3 = DecodesPythonScript(height=Slider(28, range=1..28), turns=Slider(20, range=1..20), k=Slider(3, range=0.2..3))  # -> console, a
# ---------- decodes_3: Python ----------
from math import *
two_pi = 2*pi
#########################################
"""
Sinusoidal Profile Helix
"""

rad_min = 0.2
rad_mult = 2.0
humps = 1.75
def func(t):
    rad = rad_min + rad_mult * ( sin(pi*t*humps) + 1 )
    theta = turns * two_pi * t**k
    return CS().eval_cyl(rad, theta, t*height)

ival = Interval()
crv = Curve(func,ival)


#########################################
crv.tol = 0.003
a.put(crv.surrogate)
# ---------- end decodes_3 ----------

# ---- group: Linear Profile Helix
decodes_4 = DecodesPythonScript(
    height=Slider(28, range=1..28),
    rad_bot=Slider(3.1, range=0..10),
    rad_top=Slider(8.5, range=0..10),
    turns=Slider(5, range=1..10))  # -> console, a
# ---------- decodes_4: Python ----------
from math import *
two_pi = 2*pi
#########################################
"""
A Helix with a linear profile
"""

def func(t):
    rad = Interval(rad_bot,rad_top).eval(t/height)
    theta = turns * two_pi * t/height
    return CS().eval_cyl(rad, theta, t)

ival = Interval(0,height)
crv = Curve(func,ival)


#########################################
crv.tol = 0.05
a.put(crv.surrogate)
# ---------- end decodes_4 ----------

# ---- group: Bespoke Helix
decodes_5 = DecodesPythonScript(
    height=Slider(28, range=1..28),
    rad_bot=Slider(3, range=0..10),
    rad_top=Slider(9, range=0..10),
    turns=Slider(3.75, range=1..10))  # -> console, a, b
# ---------- decodes_5: Python ----------
from math import *
two_pi = 2*pi
#########################################
"""
Bespoke Helix
"""

def func(t):
    if t < 0.5:
        tt = t*2
        rad = Interval(rad_bot,rad_top).eval(tt)
        theta = turns * two_pi * tt
        z = Interval(0,height).eval(tt)
    else:
        tt = (t-0.5)*2
        rad = Interval(rad_top,rad_bot).eval(tt)
        theta = (turns * two_pi * tt) + (turns * two_pi)
        z = Interval(height,0).eval(tt)
    return CS().eval_cyl(rad,theta,z)

ival = Interval()
crv = Curve(func,ival)

#########################################
crv.tol = 0.005
a.put(crv.surrogate)
# ---------- end decodes_5 ----------
