# Grasshopper definition 1.12.E03.ghx (Grasshopper 0.9.75)
# plug-ins: Decodes Python Interpreter

# ---- group: superseded
decodes = DecodesPythonScript()  # -> console, a; disabled
# ---------- decodes: Python ----------
from math import *
"""
Cone 
Constructed as a rotational surface of a straight line
"""


rot_axis = Vec(0,0,1)
base_pt = Point()
ln_rot = Line(Point(), Point(h/sqrt(3), 0, h))


def func_cone(u,v):
    xf = Xform.rotation(axis=rot_axis,angle=u,center=base_pt )
    return ln_rot.eval(v)*xf


a.put(func_cone)
# ---------- end decodes ----------
slider = Slider(0.377, range=0..1)  # disabled
slider_2 = Slider(0.346, range=0..1)  # disabled
slider_3 = Slider(0.664, range=0..1)  # disabled
slider_4 = Slider(0.22, range=0..1)  # disabled
decodes_2 = DecodesPythonScript(func_cone=decodes.a, len_top=slider_2, len_bot=slider, mid=slider_4, len_mid=slider_3)  # -> console, a, b; disabled
# ---------- decodes_2: Python ----------
from math import *


two_pi = 2*pi
p_top = func_cone(len_top*two_pi, 1)
p_bot = func_cone(len_bot*two_pi, 0)
p_mid = func_cone(len_mid*two_pi, mid)
a.put([p_bot, p_mid, p_top])


pts_domain = [Point(len_top*two_pi, 1), Point(len_mid*two_pi, mid), Point(len_bot*two_pi, 0)]
crv_domain = Curve.bezier(pts_domain)

def func_crv_cone(t):
    pt_domain = crv_domain.eval(t)
    u = pt_domain.x
    v = pt_domain.y
    return func_cone(u,v)    
    
    
crv = Curve(func_crv_cone, Interval())

b.put(crv)
# ---------- end decodes_2 ----------

# ----
number_slider = Slider(2, range=0..10)
md_slider = MDSlider(slider_value=Point(0, 0.5, 0.5), SliderMode=0, x_domain=Domain(0, 1), y_domain=Domain(0, 1), z_domain=Domain(0, 1))

# ---- group: Cylindrical Geometry
decodes_3 = DecodesPythonScript(h=number_slider)  # -> console, a
# ---------- decodes_3: Python ----------
from math import *

"""
Cone in cylindrical coordinates (rewritten with cylindrical CS)
"""

def func(u,v):
    r = v/sqrt(3)
    theta = u
    z = v
    return CS().eval_cyl(r,theta,z)
    
ival_u = Interval.twopi()
ival_v = Interval(0,h)
srf = Surface(func,ival_u,ival_v)
srf.tol_u = ival_u.length/20

a.put(srf.surrogate)
# ---------- end decodes_3 ----------

# ---- group: Spherical Geometry
decodes_4 = DecodesPythonScript(h=number_slider)  # -> console, a
# ---------- decodes_4: Python ----------
from math import *


"""
Cone in spherical coordinates
"""
def func(u,v):
    rho = v 
    phi = pi/6 
    theta = u 
    return CS().eval_sph(rho, phi, theta)

ival_u = Interval.twopi()
ival_v = Interval(0, 2*h/sqrt(3))
srf = Surface(func, ival_u, ival_v)
srf.tol_u = ival_u.length/20

a.put(srf.surrogate)
# ---------- end decodes_4 ----------

# ---- group: By Rotation
decodes_5 = DecodesPythonScript(h=number_slider, infl_pt=md_slider, twist=Slider(0.5, range=-1..1))  # -> console, a, b
# ---------- decodes_5: Python ----------
from math import *
h = 2


#########################################

"""
Construct Domain Curve
[noprint]
"""
ival_u, ival_v = Interval(0,pi*2*twist), Interval(0,h)
crds = [(0,0),(infl_pt.x,infl_pt.y),(1,1)]
dom_crv = Curve.bezier([Point(ival_u.eval(x),ival_v.eval(y)) for x,y in crds])


"""
Construct Curve on Cone
Given a Curve in the domain of a cylindrical cone, reconstruct this Curve such that it lies along the surface of the cone.
"""
def func_crv(t):
    dom_pt = dom_crv.eval(t)
    return CS().eval_cyl( dom_pt.y / sqrt(3), dom_pt.x, dom_pt.y )

cone_crv = Curve(func_crv)


"""
Construct Surface by Rotation
Given a Curve on the cone, construct a Surface through the evaluation of this Curve on the v, and through the rotation of this Curve on the u. The domain_u of this Surface relates to the rotation of the curve about the central axis (0->2pi), and the domain_v relates to the evaluation of the Curve along its length (0->1)
"""
def func_srf(u,v):
    xf = Xform.rotation( angle = u )
    return cone_crv.eval(v) * xf
    
ival_u, ival_v = Interval.twopi(), Interval()
srf = Surface(func_srf, ival_u, ival_v)



#########################################
a.put(dom_crv.surrogate)
a.put(cone_crv.surrogate)
b.put(srf)
# ---------- end decodes_5 ----------

# ---- group: superseded / Rotation of Freeform Profile
decodes_6 = DecodesPythonScript(crv_rot=decodes_2.b)  # -> console, a; disabled
# ---------- decodes_6: Python ----------
from math import *

"""
Cone constructed as a rotational surface of a "freeform" profile
"""

rot_axis = Vec(0,0,1)
base_pt = Point()

def func(u,v):
    xf = Xform.rotation(axis=rot_axis,angle=u,center=base_pt )
    return crv_rot.eval(v)*xf

ival_u = Interval.twopi()
ival_v = Interval(0,1)
srf = Surface(func, ival_u,ival_v)
srf.tol_u = ival_u.length/30
srf.tol_v = ival_v.length/20


a.put(srf.surrogate)
# ---------- end decodes_6 ----------

# ---- group: viz
decodes_7 = DecodesPythonScript(srf=decodes_5.b, res=Slider(30, range=6..40))  # -> console, a, b, c; inputs res: Int32
# ---------- decodes_7: Python ----------
a.put(srf.to_mesh(True,False,res*2,res))


b.put([ srf.isopolyline(u_val=srf.domain_u.eval(t), res=80) for t in Interval()/int(res/2)])
c.put([ srf.isopolyline(v_val=srf.domain_v.eval(t), res=80) for t in Interval()/int(res/4)])
# ---------- end decodes_7 ----------
crv = Curve(decodes_7.c)
crv_2 = Curve(decodes_7.b)

# ----
mesh = Mesh(decodes_7.a)
