# Grasshopper definition 1.03.E01.ghx (Grasshopper 0.9.76)
# plug-ins: Decodes Python Interpreter

pt = Point([Point(6.914409599, 7.351226513, 0), Point(4.92717813, 4.332601643, 0), Point(5.924808669, 1.608796755, 0), Point(9.814934608, 0.4146983521, 0), Point(10.81734065, 3.546513181, 0), Point(7.860646852, 4.947876958, 0), Point(8.761668202, 6.025211547, 0)])
pline = PolyLine(Vertices=pt, Closed=True)
decodes = DecodesPythonScript(pgon=pline)  # -> console, a, b
# ---------- decodes: Python ----------
"""
a non-planar grasshopper polyline
will be translated into a decodes PLine
in this case, flatten containing Points and convert
"""
if type(pgon) is not PGon:
    print type(pgon)
    flat_pts = []
    for pt in pgon: flat_pts.append(Point(pt.x,pt.y))
    pgon = PGon(flat_pts[:-1])
    
#########################################

cp_points_up = []
for n in range(len(pgon)):
    ray_a, ray_b = pgon.cnr(n)
    vec_crs = ray_a.vec.cross(ray_b.vec)
    cp_points_up.append(vec_crs.z > 0)

if sum(cp_points_up) >= len(pgon)/2 : 
    print "most point up"
    is_concave = [not d for d in cp_points_up]
else: 
    print "most point down"
    is_concave = cp_points_up
    
concave_pts = []
for n in range(len(pgon)):
    if is_concave[n]: concave_pts.append(pgon.pts[n])


#########################################

b.put(concave_pts)

for n in range(len(pgon)):
    ray_a, ray_b = pgon.cnr(n)
    vec_crs = ray_a.vec.cross(ray_b.vec)
    a.put(Ray(ray_a.spt,vec_crs.normalized()))
# ---------- end decodes ----------
# a
cir = Circle(Plane=decodes.b, Radius=1)
