# Grasshopper definition 1.04.E02.ghx (Grasshopper 0.9.75)
# plug-ins: Decodes Python Interpreter

# ---- group: space-filling tree
decodes = DecodesPythonScript()  # -> console, a; disabled
# ---------- decodes: Python ----------
#########################################

"""
Establish Basic Parameters
"""
# angle constants of the tree branches
RADS = (0, math.pi/2, math.pi, 3*math.pi/2) #0,90,180,270 deg
# initial length of tree branches
length = 0.5
# factor to scale branches at each step
scale_fac = 0.5

"""
Initialize Collections
Three lists are used in the course of the script: The first, segs, collects the line segments we seek to output. Additionally two lists are required to handle the collection of coordinate systems. Two are required because at each step of a loop, one set of coordinate systems will be iterated over and another one produced.
"""
segs = []
cs_in = [CS()]
cs_out = []

"""
Main Loop
The main cycle of the routine progressively scales the branch length down by a given factor. The main while loop exits once the branch length falls below a given threshold. Each cycle iterates over the cs_in list, and appends a number of coordinate systems to the cs_out list. At the end of the cycle, the contents of cs_out are transferred to cs_in, and the cycle repeats.
"""
# exit if branch length falls below threshold
while length > 0.05:
    for cs in cs_in:
        # for each given angle:
        for rad in RADS:
            # construct a segment using cylindrical coordinates
            seg = Segment(cs.origin, cs.eval_cyl(length,rad))
            segs.append(seg)
            # construct a CS at the tip of this segment
            vec_cross = seg.vec.cross(Vec.uz())
            cs_tip = CS(seg.ept,seg.vec,vec_cross)
            cs_out.append(cs_tip)
        
    # scale the branch length
    length *= scale_fac
    # assign the results of this cycle to the input of the next
    cs_in = cs_out
    cs_out = []


#########################################
a.put(segs)
# ---------- end decodes ----------

# ----
decodes_2 = DecodesPythonScript()  # -> console, a; disabled
# ---------- decodes_2: Python ----------
#########################################

"""
Establish Basic Parameters
"""
# angle constants of the tree branches
RADS = (0, math.pi/2, math.pi, 3*math.pi/2) #0,90,180,270 deg
# factor to scale branches at each step
scale_fac = 0.5
# minimum length of tree branches
min_length = 0.03

"""
Initialize Collections
Two lists are used in the course of the script: The first, segs, collects the line segments we seek to output. 
A second list stores the information needed for a progressive subdivision. This information is structured as a dictionary of two values: a coordinate system that indicates the position and orientation of a branch, and a float that indicates its scale.
"""
segs = []
nodes = [ {"cs":CS(),"size":0.5} ]

"""
Main Loop
The main cycle of the routine progressively scales the branch length down by a given factor. 
The main while loop exits once the branch length falls below a given threshold. 
Each cycle iterates over the cs_in list, and appends a number of coordinate systems to the cs_out list. 
At the end of the cycle, the contents of cs_out are transferred to cs_in, and the cycle repeats.
"""
# exit if branch length falls below threshold
while len(nodes) > 0:
    node = nodes.pop(0)
    # calculate the scale for any tip nodes
    tip_size = node["size"]*scale_fac
    
    # for each given angle:
    for rad in RADS:
        # construct a CS at the tip of this segment
        tip_origin = node["cs"].eval_cyl(node["size"],rad)
        x_vec = Vec(node["cs"].origin,tip_origin)
        y_vec = x_vec.cross(Vec.uz())
        tip_cs = CS(tip_origin,x_vec,y_vec)
        
        # construct a segment at this angle
        # note the use of cylindrical coordinates
        seg = Segment(node["cs"].origin,tip_cs.origin)
        segs.append(seg)
        
        # if the tip node is above threshold length
        if tip_size > min_length:
            # append a child node to our list of l
            nodes.append({"cs":tip_cs,"size":tip_size})
        

#########################################
a.put(segs)
# ---------- end decodes_2 ----------

# ---- group: space-filling tree
decodes_3 = DecodesPythonScript()  # -> console, a
# ---------- decodes_3: Python ----------
#########################################

"""
Establish Basic Parameters
"""
# angle constants of the tree branches
RADS = ( 0, math.pi/2, 3*math.pi/2 ) #0,90,270 deg
# factor to scale branches at each step
scale_fac = 0.5
# minimum length of tree branches
min_length = 0.02

"""
Alternative Branch Configuration
Specifying four branches generates a space-filling curve, but also produces overlapping lines.
[noprint]
"""
#RADS = ( 0, math.pi/2, math.pi, 3*math.pi/2 ) #0,90,180,270 deg

"""
Initialize Collections
Two lists are used in the course of the script: The first, segs, collects the line segments we seek to output. 
A second list stores the information needed for a progressive subdivision. This information is structured as a dictionary of two values: a coordinate system that indicates the position and orientation of a branch, and a float that indicates its scale.
"""
segs = []
nodes = [ {"cs":CS(),"size":0.5} ]

"""
Main Loop
The main cycle of the routine progressively scales the branch length down by a given factor. 
The main while loop exits once the branch length falls below a given threshold. 
Each cycle iterates over the cs_in list, and appends a number of coordinate systems to the cs_out list. 
At the end of the cycle, the contents of cs_out are transferred to cs_in, and the cycle repeats.
"""
# exit if branch length falls below threshold
while len(nodes) > 0:
    node = nodes.pop(0)
    # calculate the scale for any tip nodes
    tip_size = node["size"]*scale_fac
    
    # for each given angle:
    for rad in RADS:
        # construct a segment at this angle
        # note the use of cylindrical coordinates
        seg = Segment(node["cs"].origin,node["cs"].eval_cyl(node["size"],rad))
        segs.append(seg)
        
        # if the tip node is above threshold length
        if tip_size > min_length:
            # construct a CS at the tip of this segment
            vec_cross = seg.vec.cross(Vec.uz())
            tip_cs = CS(seg.ept,seg.vec,vec_cross)
            # append a child node to our list of l
            nodes.append({"cs":tip_cs,"size":tip_size})
            

#########################################
a.put(segs)
# ---------- end decodes_3 ----------

# ---- group: an almost-working triangular version
decodes_4 = DecodesPythonScript()  # -> console, a; disabled
# ---------- decodes_4: Python ----------
rads = [0, 2*math.pi/3, 4*math.pi/3]  #0 deg, 120 deg, 240 deg
scale = 0.5

cs_in = [CS()]
cs_out = []
segs = []

while scale > 0.01:
    print scale
    for cs in cs_in:
        for rad in rads:
            seg = Segment(cs.origin, cs.eval_cyl(scale,rad))
            segs.append(seg)
            cs_out.append(CS(seg.ept,seg.vec))
        
    scale *= 0.5
    cs_in = cs_out
    cs_out = []

a.put(segs)
# ---------- end decodes_4 ----------
