# Grasshopper definition 1.04.E03.ghx (Grasshopper 0.9.75)
# plug-ins: Decodes Python Interpreter

number_slider = Slider(2, range=1..5)
crv = Curve([<curve referenced from the Rhino model> x30])
crv_2 = Curve([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])
gosp_seg = Line(Line((0.8660254038, -0.5, 0), (-0.8660254038, -0.5, 0)))
line = Line(crv_2)

# ---- group: Gosper Curve
# b
decodes = DecodesPythonScript(seed_segs=gosp_seg, count=number_slider)  # -> console, a; inputs seed_segs: list, count: Int32
# ---------- decodes: Python ----------
if count > 8 : 
    print "TOO MANY! ", count
    count = 8

# a list of segments to seed
segs = seed_segs

# source:
# http://ecademy.agnesscott.edu/~lriddle/ifs/ksnow/flowsnake.htm
#########################################

params = [
    (0,0),
    (0.07143,0.37115),
    (0.42857,0.49487),
    (0.78571,0.61859),
    (0.71428,0.24743),    
    (0.35714,0.12372),
    (0.64286,-0.12372),    
    (1,0)    
    ]
flips = [
    True,
    False,
    False,
    False,
    True,    
    True,
    False,
]

for n in range(count):
    new_segs = []
    for seg in segs:
        # a vector to displace new line segments
        u_vec = seg.vec
        v_vec = u_vec.cross(Vec.uz())
        
        # construct segments through parameter points
        pts = []
        for u,v in params:
            pt = seg.spt + (u_vec * u) + (v_vec * v)
            pts.append(pt)
            
        
        # zip together point pairs and flip params
        for pa,pb,flip in zip(pts[:-1],pts[1:],flips): 
            if flip: new_segs.append(Segment(pb,pa))
            else: new_segs.append(Segment(pa,pb))
        
    segs = new_segs
    
#########################################
a.put(segs)
# ---------- end decodes ----------

# ---- group: Gosper Island
# a
decodes_2 = DecodesPythonScript(seed_segs=line, count=number_slider)  # -> console, a; inputs seed_segs: list, count: Int32
# ---------- decodes_2: Python ----------
if count > 8 : 
    print "TOO MANY! ", count
    count = 8

# a list of segments to divide
segs = seed_segs
#########################################

# values used to plot center Points along each given Segment
prm = [ (0.357,0.124), (0.643,-0.124) ]

for n in range(count):
    new_segs = []
    for seg in segs:
        # displaces center Points along Segment
        u_vec = seg.vec
        # displaces center Points away from Segment
        v_vec = u_vec.cross(Vec.uz())
        
        # construct end Points of new Segments by displacement
        pts = [
            seg.spt,
            seg.spt + (u_vec * prm[0][0]) + (v_vec * prm[0][1]),
            seg.spt + (u_vec * prm[1][0]) + (v_vec * prm[1][1]),
            seg.ept
        ]
        # zip together two modified copies of point list
        for pa,pb in zip(pts[:-1],pts[1:]): 
            new_segs.append(Segment(pa,pb))
        
    segs = new_segs
    
#########################################
a.put(segs)
# ---------- end decodes_2 ----------
