# Grasshopper definition 1.04.E04.ghx (Grasshopper 0.9.75)
# plug-ins: Decodes Python Interpreter

line = Line(Line((1, 0, 0), (0, 0, 0)))

# ---- group: Koch Snowflake
decodes = DecodesPythonScript(seed_seg=line, min_length=Slider(0.04, range=0.01..0.45), height_ratio=Slider(0.45, range=0..1))  # -> console, a
# ---------- decodes: Python ----------
if min_length < 0.01 : 
    print "TOO SHORT! ", min_length
    min_length = 0.1
max_div = 5000
n = 0

#########################################
"""
Koch Snowflakes
A Segment substitution rule is again defined by defining division parameter values, this time in the service of Koch Snowflake fractal. wherein a given Segment is replaced with three smaller Segments. Rather than limiting the action of this recursive routine by number of iterations, we stop dividing Segments when they fall below a given length threshold.
"""

# parameters to plot subdivisions along a given Segment
prm = [(0,0),(0.33,0.0),(0.5,1.0),(0.66,0.0),(1,0)]

# a list of segments to divide
long_segs = [seed_seg]
# a list of segments that have already been divided
short_segs = []

while len(long_segs) > 0:
    # remove a segment from the front of the list
    seg = long_segs.pop(0)
    #{a} if this segment is too short, set it aside
    if seg.length <= min_length:
        short_segs.append(seg)
        continue
        
    #{b} if it is not too short, construct replacement Segments
    u_vec = seg.vec
    v_vec = u_vec.cross(Vec.uz()).normalized(seg.length*height_ratio)
    pts = [seg.spt + (u_vec*u) + (v_vec*v) for u,v in prm]
    long_segs.extend([Segment(pa,pb) for pa,pb in zip(pts[:-1],pts[1:])])
      

#########################################
    n+=1
    if n >= max_div : 
        print "TOO MANY! ", n
        break

print "divsions: ", n
a.put(short_segs)
# ---------- end decodes ----------
