# Grasshopper definition 1.06.E01.ghx (Grasshopper 0.9.75)
# plug-ins: Decodes Python Interpreter

number_slider = Slider(5, range=1..10)
seg_btm = Line(Line((0, 10, 0), (9.996711624, 9.140671672, 0)))
seg_top = Line(Line((0, 12, 0), (10, 12, 0)))

tolerence = Slider(0.03, range=0.01..0.1)

# ---- group: circle
decodes = DecodesPythonScript(len_x=Slider(2.073, range=1..10), len_y=Slider(5.936, range=1..10), tol=tolerence)  # -> console, a
# ---------- decodes: Python ----------
import math

def func(t):
    c = math.cos(2*math.pi*t)
    s = math.sin(2*math.pi*t)
    pt_out = Point(len_x*c, len_y*s)
    return pt_out
     
     
a.put(Curve(func,tolerance=tol))
# ---------- end decodes ----------

# ---- group: ellipse
decodes_2 = DecodesPythonScript(len_x=Slider(8.608, range=1..10), len_y=Slider(6.386, range=1..10), tol=tolerence)  # -> console, a; same code as decodes

# ---- group: diamond
decodes_3 = DecodesPythonScript(len_x=Slider(5.901, range=1..10), len_y=Slider(4.469, range=1..10), tol=tolerence)  # -> console, a
# ---------- decodes_3: Python ----------
import math

def func(t):
    t_value = 2*math.pi*t
    c = math.cos(t_value)
    s = math.sin(t_value)
    pt_out = Point(len_x*abs(c)*c, len_y*abs(s)*s)
    return pt_out
     

a.put(Curve(func,tolerance=tol))
# ---------- end decodes_3 ----------

# ---- group: Hypocycloid
decodes_4 = DecodesPythonScript(len_x=Slider(10, range=1..10), num_cusps=Slider(4, range=1..20), tol=tolerence)  # -> console, a
# ---------- decodes_4: Python ----------
import math

def func(t):
    t_value = 2*math.pi*t
    c = math.cos(t_value)
    s = math.sin(t_value)
    c_n = math.cos((num_cusps-1)*t_value)
    s_n = math.sin((num_cusps-1)*t_value)
    #pt_out = Point(len_x*c*c*c, len_y*s*s*s)
    factor = len_x/num_cusps
    pt_out = Point(factor*((num_cusps-1)*c - c_n), factor*((num_cusps-1)*s + s_n))
    
    return pt_out
     

a.put(Curve(func,tolerance=tol))
# ---------- end decodes_4 ----------

# ---- group: teardrop
decodes_5 = DecodesPythonScript(len_x=Slider(3.942, range=1..10), len_y=Slider(4.886, range=1..10), n=Slider(4, range=1..10), tol=tolerence)  # -> console, a
# ---------- decodes_5: Python ----------
import math

def func(t):
    t_value = 2*math.pi*t
    c = math.cos(t_value)
    s = math.sin(t_value)
    pt_out = Point(len_x*c, len_y*(math.sin(math.pi*t)**n)*s)
    return pt_out
    
a.put(Curve(func,tolerance=tol))
# ---------- end decodes_5 ----------

# ----
# a
decodes_6 = DecodesPythonScript(seg_top=seg_top, seg_btm=seg_btm, hump_cnt=number_slider, shft=Slider(0, range=0..1), res=Slider(95, range=20..200))  # -> console, a, b; inputs hump_cnt: Int32, res: Int32
# ---------- decodes_6: Python ----------
two_pi = math.pi * 2
#########################################

def guilloche_chain(seg_a, seg_b, shift):
    pts = []
    off = (two_pi / hump_cnt) * shift
    for u,t in zip(Interval()/res, Interval.twopi()/res):
        pt_a, pt_b = seg_a.eval(u), seg_b.eval(u)
        v = math.sin((t+off)*hump_cnt)
        pts.append(Segment(pt_a, pt_b).eval(0.5 + v/2))
    return [Segment(pa,pb) for pa,pb in zip(pts[:-1],pts[1:])]


#########################################
a.put(guilloche_chain(seg_top, seg_btm, shft))
b.put(guilloche_chain)
# ---------- end decodes_6 ----------
decodes_7 = DecodesPythonScript(
    guilloche_chain=decodes_6.b,
    seg_top=seg_top,
    seg_btm=seg_btm,
    hump_count=number_slider,
    chain_count=Slider(3, range=0..10))  # -> console, a; inputs chain_count: Int32
# ---------- decodes_7: Python ----------
#########################################

shfts = [n/chain_count for n in range(chain_count)]
guilloche  = [guilloche_chain(seg_top, seg_btm, shft) for shft in shfts]    

#########################################
a.put(guilloche)
# ---------- end decodes_7 ----------

curve_a = Data(decodes_2.a)
curve_b = Data(decodes_5.a)
# x
decodes_8 = DecodesPythonScript(
    guilloche_chain=decodes_6.b,
    crv_top=curve_a,
    crv_btm=curve_b,
    hump_count=number_slider,
    chain_count=Slider(3, range=0..10))  # -> console, a; inputs chain_count: Int32
# ---------- decodes_8: Python ----------
#########################################

shfts = [n/chain_count for n in range(chain_count)]
guilloche  = [guilloche_chain(crv_top, crv_btm, shft) for shft in shfts]    

#########################################
a.put(guilloche)
# ---------- end decodes_8 ----------
