# Grasshopper definition 1.06.E03.ghx (Grasshopper 0.9.75)
# plug-ins: Decodes Python Interpreter

# ---- group: Solar incidence on a fixed plane visualized through analema lines
# a
number_slider = Slider(54.7, range=0..180)
decodes = DecodesPythonScript(angle_1=number_slider, angle_2=Slider(17.7, range=0..360))  # -> console, a, a_props, out, out_props
# ---------- decodes: Python ----------
from decodes.extensions.solar_geometry import *

#fixed plane for which we will be calculating angle of incidence with sun vectors
from math import cos, sin, radians

phi = radians(angle_1)
theta = radians(angle_2)
normal_vec = Vec(sin(phi)*cos(theta), sin(phi)*sin(theta), cos(phi))

pln = Plane(Point(), normal_vec)
a.put(pln)

#generates the sun position for a given location
sun_pts = [] 
latitude, longitude, timezone = 41.73, -71.43, -5.0 #Providence, RI
sg = SolarGeom(latitude, longitude, timezone)

#stores cosine of the angle of incidence for every hour of year
vals = [] 
days = range(0, 365, 5)
hours = range(24)
amp = 20

for hour in hours:
    for day in days:
        sun_vec = sg.vec_at(day, hour)
        sun_pts.append(Point(sun_vec)*amp)
        cos_angle_incidence = sun_vec.dot(pln.normal)
        if cos_angle_incidence < 0: cos_angle_incidence = 0
        vals.append(cos_angle_incidence)


#graphics, generating colored analema lines
num_days = len(days)
num_hours = len(hours)

analema_lines = []
for i in range(num_hours):
    start = i*num_days
    for j in range(num_days-1):
        index = start + j
        seg = Segment(sun_pts[index], sun_pts[index+1])
        seg.set_color(Color.HSB(0.84, 0.75, vals[index]))
        analema_lines.append(seg)
        
        
out.put(analema_lines)
# ---------- end decodes ----------
pln = Plane(decodes.a)
hardboil = DecodesHardBoil(Geometry=decodes.out, Properties=decodes.out_props)

# ---- group: Solar incidence on a mesh
# b
mesh = Mesh(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)
decodes_2 = DecodesPythonScript(mesh=mesh)  # -> console, a, a_props, out, out_props
# ---------- decodes_2: Python ----------
from decodes.extensions.solar_geometry import *

# find the normals for each mesh face
normals = [mesh.face_normal(i) for i in range(len(mesh.faces))]

# generate sun vector for a given location and time 
latitude, longitude, timezone = 41.73, -71.43, -5.0 #Providence, RI
#latitude, longitude, timezone = -0.23, -78.52, -5.0 #Quito, Ecuador

sg = SolarGeom(latitude, longitude, timezone)
day = sg.str_to_day_of_year("8/23")
hour = sg.str_to_decimal_hour("09:00")
sun_vec = sg.vec_at(day, hour)


vals = []  #houses the cosine of the angle of incidence for each mesh face


for normal in normals:
    cos_angle_incidence = sun_vec.dot(normal)
    if cos_angle_incidence < 0: cos_angle_incidence = 0
    vals.append(cos_angle_incidence)

#graphics, generating individually colored mesh faces

faces = []

eps = 3.0/360 #avoid black which will show up as white in Rhino
remap_vals = [Interval.remap(vals[i],Interval(0,1-eps)) for i in range(len(vals))]

for i, msh in enumerate(Mesh.explode(mesh)):
    msh.set_color(Color.HSB(0.5, vals[i], vals[i]))
    #msh.set_color(Color.HSB(0.5, remap_vals[i], remap_vals[i])) 
    faces.append(msh)
    
out.put(faces)
# ---------- end decodes_2 ----------
hardboil_2 = DecodesHardBoil(Geometry=decodes_2.out, Properties=decodes_2.out_props)
