# Grasshopper definition 1.09.E01.ghx (Grasshopper 0.9.75)
# plug-ins: Decodes Python Interpreter

elaborate_mir = Curve([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])
elaborate_stb = Curve([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])

simple_mir = Curve([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])
simple_stb = Curve([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])

decodes = DecodesPythonScript(rows=Slider(6, range=1..10), cols=Slider(5, range=1..10))  # -> console, a; inputs rows: Int32, cols: Int32
# ---------- decodes: Python ----------
import itertools

factor = 0.3666
factor = 11/30

#########################################

"""
Tile Definition
"""
cnr_pts = [Point(x,y) for x,y in [(0,0),(1,0),(1,1),(0,1)]]
cpt = Point(0.5,0.5)
out_edges = [Segment(pa,pb) for pa,pb in match(cnr_pts,[0,1])]

xf_scl = Xform.scale(factor,cpt)
xf_rot = Xform.rotation(center=cpt,angle=math.pi/6)
xf = xf_rot * xf_scl 
in_edges = [edge*xf for edge in out_edges]

base_tile = [Segment(sa.spt,sb.ept) for sa,sb in zip(out_edges,in_edges)]

#a.put(in_edges)
#a.put(base_tile)

"""
Mirrored Tessellation
"""
for u,v in itertools.product(range(cols),range(rows)):
    xf = Xform.translation(UX * u) * Xform.translation(UY * v)
    if (u+v)%2 == 0: xf *= Xform.mirror(Plane(cpt,Vec(1,0)))
    tile = [seg * xf for seg in base_tile]
    
#########################################    
    a.put(tile)
# ---------- end decodes ----------
decodes_2 = DecodesPythonScript(mir_tile=elaborate_mir, stb_tile=elaborate_stb, rows=Slider(5, range=1..10), cols=Slider(7, range=1..10))  # -> console, a; inputs mir_tile: list, stb_tile: list, rows: Int32, cols: Int32
# ---------- decodes_2: Python ----------
import itertools




#########################################

"""
Selectively Mirrored Tessellation
"""
for u,v in itertools.product(range(cols),range(rows)):
    xf = Xform.translation(UX * u) * Xform.translation(UY * v)
    tile = [seg * xf for seg in stb_tile]
    if (u+v)%2 == 1: xf *= Xform.mirror(Plane(Point(),Vec(1,0)))
    tile.extend([seg * xf for seg in mir_tile])
    
#########################################    
    a.put(tile)
# ---------- end decodes_2 ----------
line = Line(flatten(decodes_2.a))
join = JoinCurves(Curves=line, Preserve=False)
cls = Closed(Curve=join)  # -> Closed, Periodic
cull = CullPattern(List=join, CullPattern=cls.Closed)
