# Grasshopper definition 1.09.E03.ghx (Grasshopper 0.9.75)
# plug-ins: Decodes Python Interpreter

line = Line(Line((4.775265163, -12.78277304, 0), (-2.253384205, 13.2490311, 0)))  # disabled
line_2 = Line(Line((-13.72480395, -2.200219196, 0), (14.04456729, 8.51778374, 0)))  # disabled
line_3 = Line(Line((-4.561870237, -8.898839247, 0), (7.871378855, 6.16777066, 0)))  # disabled
genes = GenePool(Decimals=2, Maximum=0.99, Minimum=0.01, Value=[0.1, 0.5, 0.9])
genes_2 = GenePool(Decimals=2, Maximum=3.14, Minimum=-3.14, Value=[1.49, -1.27, 0.98])

panel = Panel("""-pi/4
-pi/2
pi/2
pi/4""")
panel_2 = Panel("""0.33
0.66
0.33
0.66""")
line_4 = Line(Line((10, 0, 0), (-10, 0, 0)))
num = Number(panel)
num_2 = Number(panel_2)

decodes = DecodesPythonScript(seed_line=line)  # -> console, a, b; disabled
# ---------- decodes: Python ----------
rad = 10.0
bound = Circle(Plane(Point(),UZ),rad)
b.put(bound)

def limit(ray, segs=[]):
    vert_pln = Plane(ray.spt,ray.vec.cross(UZ))
    xsec = Intersector()
    if not xsec.of(bound,vert_pln) or len(xsec) != 2: 
        raise Exception("intersection failed")
    
    results = []
    for pt in xsec:
        near = ray.near(pt)
        if near[1]>0: results.append( (near[1],pt) )
    if len(results) == 2: return Segment(results[0][1],results[1][1])
    
    for seg in segs:
        if xsec.of(ray,seg): results.append((xsec.ta, xsec[0]))
    
    results.sort()
    #print results
    if len(results) == 1: return Segment(ray.spt,results[0][1])
    if len(results) == 2: return Segment(ray.spt,results[1][1])
    return Segment(results[0][1],results[2][1])


branches = [
     {"t":0.33, "xf":Xform.rotation(angle =  math.pi/2)},
     {"t":0.66, "xf":Xform.rotation(angle = -math.pi/4)},
#    {"t":0.25, "xf":Xform.rotation(angle = math.pi/3)},
#    {"t":0.75, "xf":Xform.rotation(angle = 4*math.pi/3)}
]

seed_line = limit( seed_line )
drawn_segs = [seed_line]
brnch_segs = [seed_line]
for n in range(4):
    loop_segs = []
    for seg in brnch_segs:
        for branch in branches:
            nseg = limit(Ray(seg.eval(branch["t"]),seg.vec*branch["xf"]), drawn_segs )
            loop_segs.append(nseg)
            drawn_segs.append(nseg)
    brnch_segs = loop_segs

#segs.append( limit(Ray(segs[0].eval(lib[0]["t"]),seg.vec.cross(UZ)*lib[0]["xf"]), segs) )
#segs.append( limit(Ray(segs[0].eval(lib[1]["t"]),seg.vec.cross(UZ)*lib[1]["xf"]), segs) )
a.put(drawn_segs)
# ---------- end decodes ----------
decodes_2 = DecodesPythonScript(seed_line=line_2)  # -> console, a, b; disabled
# ---------- decodes_2: Python ----------
rad = 10.0
bound = Circle(Plane(Point(),UZ),rad)
b.put(bound)

def limit(ray, segs):
    vert_pln = Plane(ray.spt,ray.vec.cross(UZ))
    xsec = Intersector()
    if xsec.of(bound,vert_pln) and len(xsec) == 2:
        pa, ta, da = ray.near(xsec[0])
        pb, tb, db = ray.near(xsec[1])
        if ta > 0 and tb > 0 : return Segment(pa,pb)
        if ta > 0 : return Segment(ray.spt,pa)
        if tb > 0 : return Segment(ray.spt,pb)
    raise Exception("intersection failed")
    

seg = limit( seed_line , [] )
a.put(seg)

lib = [
    {"t":0.25, "xf":Xform.rotation(angle=0.9)},
    {"t":0.5, "xf":Xform.rotation(angle=-3.9)}
]

nseg = limit(Ray(seg.eval(lib[0]["t"]),seg.vec.cross(UZ)*lib[0]["xf"]))
a.put(nseg)
nseg = limit(Ray(seg.eval(lib[1]["t"]),seg.vec.cross(UZ)*lib[1]["xf"]))
a.put(nseg)
# ---------- end decodes_2 ----------
decodes_3 = DecodesPythonScript(seed_line=line_3)  # -> console, a, b; disabled
# ---------- decodes_3: Python ----------
rad = 10.0
bound = Circle(Plane(Point(),UZ),rad)
b.put(bound)

#xcnt = 1

def limit(ray, segs=[]):
    vert_pln = Plane(ray.spt,ray.vec.cross(UZ))
    xsec = Intersector()
    if not xsec.of(bound,vert_pln) or len(xsec) != 2: 
        raise Exception("intersection failed, ray does not intersect bounds")
    
    results = []
    for pt in xsec:
        near = ray.near(pt)
        if near[1]>0: results.append( (near[1],pt) )
    
    for seg in segs:
        if xsec.of(ray,seg) and xsec.ta > xsec.tol:
            results.append((xsec.ta, xsec[0]))
    
    #n = min(xcnt,len(results)-1)
    result = sorted(results)[0]
    return Segment(ray.spt,result[1])


branches = [
     {"t":0.55, "xf":Xform.rotation(angle =  2*math.pi/3)},
     {"t":0.33, "xf":Xform.rotation(angle = -math.pi/3)},
]

drawn_segs = [seed_line]
brnch_segs = [seed_line]
for n in range(6):
    loop_segs = []
    for seg in brnch_segs:
        for branch in branches:
            nseg = limit(Ray(seg.eval(branch["t"]),seg.vec*branch["xf"]), drawn_segs )
            loop_segs.append(nseg)
            drawn_segs.append(nseg)
    brnch_segs = loop_segs

#segs.append( limit(Ray(segs[0].eval(lib[0]["t"]),seg.vec.cross(UZ)*lib[0]["xf"]), segs) )
#segs.append( limit(Ray(segs[0].eval(lib[1]["t"]),seg.vec.cross(UZ)*lib[1]["xf"]), segs) )
a.put(drawn_segs)
# ---------- end decodes_3 ----------
line_5 = Line(Line((0, -10, 0), (0, 10, 0)))
line_6 = Line(decodes.a)  # disabled
line_7 = Line(decodes_2.a)  # disabled
line_8 = Line(decodes_3.a)  # disabled

# ---- group: ice ray
decodes_4 = DecodesPythonScript(gens=Slider(3, range=0..10), seed_line=line_5, bnds_off=Slider(0.5, range=-0.5..0.5), ts=genes, angs=genes_2)  # -> console, a, a_props; inputs gens: Int32, ts: list, angs: list
# ---------- decodes_4: Python ----------
ctr = seed_line.eval(0.5) + seed_line.vec.cross(UZ) * bnds_off
bound = Circle(Plane(ctr,UZ),ctr.dist(seed_line.spt))

branches = [
     {"t":0.55, "xf":Xform.rotation(angle =  2*math.pi/3)},
     {"t":0.33, "xf":Xform.rotation(angle = -math.pi/3)},
]

branches = []
for t,ang in zip(ts,angs):
    branches.append( {"t":t, "xf":Xform.rotation(angle=ang)} )


min_length = 0.5

#########################################


"""
Ray-Circle Intersection
The Decod.es library does not, at the time of writing, provide a ray-circle intersection, so we implement one here that is limited to two-dimensional Circles and Segments on the xy-plane. This function returns False in the case on no intersection, or a tuple of the t-value of the intersection Point as it lies along the Ray, as well as the intersection Point itself.
"""
def ray_circle_2d_intersection(ray, circle):
    vert_pln = Plane(ray.spt,ray.vec.cross(UZ))
    xsec = Intersector()
    if not xsec.of(bound,vert_pln) or len(xsec) != 2: return False
        
    for pt in xsec:
        near = ray.near(pt)
        if near[1]>0: return ( (near[1],pt) )
    
    return False
    
"""
Limit Function
Given a circular bound, 
"""
def limit(ray, segs=[]):
    bound_xsec = ray_circle_2d_intersection(ray, bound)
    if not bound_xsec: raise Exception("intersection failed, ray does not intersect bounds")
    
    results = [bound_xsec]
    for seg in segs:
        xsec = Intersector()
        if xsec.of(ray,seg) and xsec.ta > xsec.tol:
            results.append((xsec.ta, xsec[0]))
    
    result = sorted(results)[0]
    return Segment(ray.spt,result[1])

"""
Ice Ray Lattice Routine
"""   
seed_line.gen = 0
drawn_segs = [seed_line]
brnch_segs = [seed_line]
for n in range(gens):
    loop_segs = []
    for seg in brnch_segs:
        for branch in branches:
            nseg = limit(Ray(seg.eval(branch["t"]),seg.vec*branch["xf"]), drawn_segs )
            if nseg.length > min_length:
                nseg.gen = n+1
                loop_segs.append(nseg)
                drawn_segs.append(nseg)
    brnch_segs = loop_segs



#########################################

for seg in drawn_segs:
    seg.set_weight(Interval.remap(seg.gen,Interval(0,gens-1),Interval(10,4)))
    
a.put(drawn_segs)
# ---------- end decodes_4 ----------

# ----
hardboil = DecodesHardBoil(Geometry=decodes_4.a, Properties=decodes_4.a_props)

# ---- group: shatter
decodes_5 = DecodesPythonScript(segs=decodes_4.a)  # -> console, a; inputs segs: list
# ---------- decodes_5: Python ----------
#########################################

def shatter_segments_at_endpoints(segs):
    pts = Point.cull_duplicates([s.spt for s in segs]+[s.ept for s in segs])
    ret = []
    for seg in segs:
        rslts = []
        for pt in pts:
            near = seg.near(pt)
            if near[2] < EPSILON: rslts.append( (near[1],pt) )
        
        rslts.sort()
        for a,b in zip(rslts[:-1],rslts[1:]): ret.append( Segment(a[1],b[1]) )
    return ret
    
a.put(shatter_segments_at_endpoints(segs))

#########################################
# ---------- end decodes_5 ----------

# ---- group: append convex hull
cluster = Cluster(line=decodes_5.a)

# ----
decodes_6 = DecodesPythonScript(segs=cluster)  # -> console, a, b; inputs segs: list
# ---------- decodes_6: Python ----------
from decodes.extensions.graph import SpatialGraph
pgon_limit = 100

gph = SpatialGraph()
for seg in segs: gph.add_edge(seg.spt,seg.ept)

    
def rightiness(cvec,nvec):
    ang = cvec.angle(nvec)
    if round(ang,6) == round(math.pi,6) :
        return 999
    if cvec.cross(nvec).z >=0 : return ang
    else: return -ang

nds = gph.nodes.copy()
walked_edges = set()
while len(nds) > 0:
    st_spt = nds.pop()
    for st_ept in gph.edges[st_spt]:
        wpts = [st_spt,st_ept]
        b.put([st_spt,st_ept,Circle(Plane(st_spt),0.1)])
        if not (st_spt,st_ept) in walked_edges:
            walking = True
            found_dup_edge = False
            n = 0
            while walking and n < pgon_limit:
                print n
                for cpt in gph.edges[wpts[-1]]: cpt.r = rightiness(Vec(wpts[-2],wpts[-1]),Vec(wpts[-1],cpt))
                choice = sorted(gph.edges[wpts[-1]], key=lambda cpt: cpt.r)[0]
                # print choice, choice.r
                #if choice.r == 999: print gph.edges[wpts[-1]]
                if choice is wpts[0] : walking = False # got back home
                else: wpts.append(choice)
                n += 1
                if (wpts[-2],wpts[-1]) in walked_edges:
                    found_dup_edge = True
                    break
                
            if len(wpts) > 2 and not found_dup_edge:
                try:
                    pg = PGon(wpts)
                    for n in range(len(wpts)-1): walked_edges.add((wpts[n],wpts[n+1]))
                    #b.put(wpts)
                    a.put(pg)
                except:
                    print "COULD NOT CREATE PGON - are all of these shapes closed?"
# ---------- end decodes_6 ----------
item = ListItem(List=decodes_6.a, Index=Slider(34, range=0..50), Wrap=True)
offset = Offset(Curve=decodes_6.a, Distance=Slider(0.1, range=0.01..0.5), Plane=PlaneXY(0, 0, 0), Corners=1)  # -> flatten(Curve)
panel_3 = Panel(item)
cls = Closed(Curve=offset)  # -> Closed, Periodic
cull = CullPattern(List=offset, CullPattern=cls.Closed)

# ==== cluster Cluster
line = ClusterInput()
line_2 = Line(line)
end = EndPoints(Curve=line_2)  # -> Start, End
pt = Point([end.Start, end.End])
hull = ConvexHull(Points=pt, Plane=PlaneXY(0, 0, 0))  # -> Hull, HullZ, Indices
explode = Explode(Curve=hull.Hull, Recursive=True)  # -> Segments, Vertices
line_3 = Line(flatten([line_2, explode.Segments]))
line_4 = ClusterOutput(line_3)
