# Grasshopper definition 1.07.E01.gh (Grasshopper 0.9.75)
# plug-ins: Decodes Python Interpreter

# ---- group: ValueGrid
decodes = DecodesPythonScript()  # -> console, a
# ---------- decodes: Python ----------
import itertools

#########################################

"""
The Multiple Inheritance of a ValueGrid
In one simple statement we define the ValueGrid type, which inherits the spatialized raster structure of a Grid and the methods related to storing numeric values of a ValueField
"""
class ValueGrid(Grid, ValueField):
    
    """
    Point-Value Quartet
    A quartet represents the center points and values of four ValueGrid cells that meet at a corner. Since four cells are required, the effective pixel_dim of quartets is one fewer in each dimension than that of the ValueField which they describe.
    """
    def quartet(self,x,y):
        if x >= self.px_width-1 or y>= self.px_height-1: 
            raise IndexError("This ValueGrid does not have a quart at index ({},{})".format(x,y))
        idxs = [(x,y),(x+1,y),(x+1,y+1),(x,y+1)]
        # return a Tuple of (values, pts)
        return [self.get(*xy) for xy in idxs], [self.get_cpt(*xy) for xy in idxs]
    
    """
    Quartet Edge Interpolate
    Plots a Point along each edge of a given quartet at a position determined by an interpolation between the values associated with the corner Points of the quartet at a given threshold. A collection of four Point or False values are returned. If the values associated with any pair of corner Points are the same, or if the values do not encompass the given threshold, a value of False is included in the returned collection.
    """
    def interpolate_quartet_edges(self,x,y,t):
        vals, pts = self.quartet(x,y)
        ret = []
        for a, b in [(0,1),(1,2),(2,3),(3,0)]:
            ival = Interval(vals[a], vals[b])
            if ival.delta == 0: ret.append(False)
            elif t not in ival: ret.append(False)
            else: ret.append( Point.interpolate(pts[a], pts[b], ival.deval(t)) )
        return ret
    

#########################################


a.put(ValueGrid)
# ---------- end decodes ----------

# ----
number_slider = Slider(8, range=5..30)
int = Integer(Slider(17, range=5..30))
sqgrid = Square(Plane=PlaneXY(0, 0, 0), Size=expr("1/x", int), ExtentX=int, ExtentY=int)  # -> flatten(Cells), Points; disabled
dom = ConstructDomain(DomainStart=expr("x*3", number_slider), DomainEnd=number_slider)
area = Area(Geometry=sqgrid.Cells)  # -> Area, Centroid
dedomain = DeconstructDomain(Domain=dom)  # -> Start, End
pixel_dim = Domain(dom)
pt = Point(area.Centroid)
recgrid = Rectangular(
    Plane=PlaneXY(0, 0, 0),
    SizeX=expr("3.0/x", dedomain.Start),
    SizeY=expr("1.0/x", dedomain.End),
    ExtentX=dedomain.Start,
    ExtentY=dedomain.End)  # -> flatten(Cells), Points
panel = Panel(pixel_dim)
image = ImageSampler(
    pt,
    FilePath="C:\Users\ksteinfe\Documents\GitHub\fieldguide\u1\1.07 - Algorithmic Types\1.07.E01 - Marching Squares\clock.jpg",
    Filter="Colour",
    Interpolate=False,
    Umax=1,
    Umin=0,
    Vmax=1,
    Vmin=0,
    Wrap=1)
image_2 = ImageSampler(
    pt,
    FilePath="C:\Users\ksteinfe\Documents\GitHub\fieldguide\u1\1.07 - Algorithmic Types\1.07.E01 - Marching Squares\diam.jpg",
    Filter="Colour",
    Interpolate=False,
    Umax=1,
    Umin=0,
    Vmax=1,
    Vmin=0,
    Wrap=1)
image_3 = ImageSampler(
    pt,
    FilePath="C:\Users\ksteinfe\Documents\GitHub\fieldguide\u1\1.07 - Algorithmic Types\1.07.E01 - Marching Squares\spots.jpg",
    Filter="Colour",
    Interpolate=False,
    Umax=1,
    Umin=0,
    Vmax=1,
    Vmin=0,
    Wrap=1)
image_4 = ImageSampler(
    pt,
    FilePath="C:\Users\ksteinfe\Documents\GitHub\fieldguide\u1\1.07 - Algorithmic Types\1.07.E01 - Marching Squares\linear_gradient.jpg",
    Filter="Colour",
    Interpolate=False,
    Umax=1,
    Umin=0,
    Vmax=1,
    Vmin=0,
    Wrap=1)
area_2 = Area(Geometry=recgrid.Cells)  # -> Area, Centroid
rec = Rectangle(recgrid.Cells)
sample_vals = Number(image_3)
pt_2 = Point(area_2.Centroid)
image_5 = ImageSampler(
    pt_2,
    FilePath="C:\Users\ksteinfe\Documents\GitHub\fieldguide\u1\1.07 - Algorithmic Types\1.07.E01 - Marching Squares\flow.jpg",
    Filter="Colour",
    Interpolate=False,
    Umax=3,
    Umin=0,
    Vmax=1,
    Vmin=0,
    Wrap=1)

# ---- group: init ValueGrid
decodes_2 = DecodesPythonScript(ValueGrid=decodes.a, sample_vals=sample_vals, res=int)  # -> console, a; inputs sample_vals: list, res: Int32
# ---------- decodes_2: Python ----------
"""
Here, a ValueGrid is initialized and populated with values 
that match the grasshopper image sampler
"""

bnds = Bounds(ival_x = Interval(),ival_y = Interval())
vg = ValueGrid((res,res),bnds)
for xy,val in zip(vg.addresses, sample_vals):
    x,y = xy
    vg.set(x,y,val)

a.put(vg)
# ---------- end decodes_2 ----------

# ----
hsl = ColourHSL(Alpha=1, Hue=0, Saturation=0, Luminance=sample_vals)
range = Range(Domain=Domain(0.01, 0.99), Steps=Slider(3, range=3..8))
preview = CustomPreview(Geometry=pt, Shader=hsl)
ahsv = SplitAHSV(Colour=image_5)  # -> Alpha, Hue, Saturation, Value
argb = SplitARGB(Colour=image_5)  # -> Alpha, Red, Green, Blue

# ---- group: march!
decodes_3 = DecodesPythonScript(vg=decodes_2.a, thresh=range)  # -> console, a
# ---------- decodes_3: Python ----------
import itertools

#########################################


"""
March Address
"""
def march(x,y,t):
    vals, pts = vg.quartet(x,y)
    pa,pb,pc,pd = vg.interpolate_quartet_edges(x,y,t)
    
    case = tuple([int(val > t) for val in vals])
    
    # case 0 and case 15
    if case == (0,0,0,0) or case == (1,1,1,1): return []
    # case 1
    if case == (1,0,0,0): return [Segment(pd,pa)] 
    # case 2
    if case == (0,1,0,0): return [Segment(pa,pb)]
    # case 3
    if case == (1,1,0,0): return [Segment(pd,pb)]
    # case 4
    if case == (0,0,1,0): return [Segment(pb,pc)]
    # case 6
    if case == (0,1,1,0): return [Segment(pa,pc)] 
    # case 7
    if case == (1,1,1,0): return [Segment(pd,pc)] 
    # case 8
    if case == (0,0,0,1): return [Segment(pc,pd)] 
    # case 9
    if case == (1,0,0,1): return [Segment(pc,pa)]
    # case 11
    if case == (1,1,0,1): return [Segment(pc,pb)]
    # case 12
    if case == (0,0,1,1): return [Segment(pb,pd)]
    # case 13
    if case == (1,0,1,1): return [Segment(pb,pa)]
    # case 14
    if case == (0,1,1,1): return [Segment(pa,pd)]
    
    # case 5
    if case == (1,0,1,0):
        if sum(vals)/4.0 > t: return [Segment(pb,pa), Segment(pd,pc)]
        else: return [Segment(pd,pa), Segment(pb,pc)]
    # case 10    
    if case == (0,1,0,1):
        if sum(vals)/4.0 > t: return [Segment(pa,pd), Segment(pc,pb)]
        else: return [Segment(pc,pd), Segment(pa,pb)]
    
    raise Exception("Unhandled Case. This should never happen.")


"""
Main Routine
"""
segs = []
for x,y in vg.addresses:
    if x < vg.px_width-1 and y < vg.px_height-1:
        segs.extend( march(x,y,thresh) )
    

#########################################
        
a.put(segs)
# ---------- end decodes_3 ----------

# ----
sample_vals_2 = Number(argb.Red)
preview_2 = CustomPreview(Geometry=pt_2, Shader=image_5)
bnd = Bounds(Numbers=sample_vals_2)
remap = RemapNumbers(Value=sample_vals_2, Source=bnd, Target=Domain(0, 1))  # -> Mapped, Clipped
panel_2 = Panel(bnd)
normalized_sample_vals = Number(remap.Mapped)

# ---- group: init ValueGrid
pixel_dim_2 = Domain(pixel_dim)
decodes_4 = DecodesPythonScript(ValueGrid=decodes.a, sample_vals=normalized_sample_vals, pixel_dim=pixel_dim_2)  # -> console, a; inputs sample_vals: list
# ---------- decodes_4: Python ----------
"""
Here, a ValueGrid is initialized and populated with values 
that match the grasshopper image sampler
"""

bnds = Bounds(ival_x = Interval(0,3),ival_y = Interval(0,1))
vg = ValueGrid(pixel_dim,bnds)
for xy,val in zip(vg.addresses, sample_vals):
    x,y = xy
    vg.set(x,y,val)

a.put(vg)
# ---------- end decodes_4 ----------

# ----
range_2 = Range(Domain=Domain(0.01, 0.99), Steps=Slider(8, range=3..8))

# ---- group: march!
decodes_5 = DecodesPythonScript(vg=decodes_4.a, thresh=range_2)  # -> console, a; inputs thresh: list
# ---------- decodes_5: Python ----------
import itertools

#########################################


"""
March Address
"""
def march(x,y,t):
    vals, pts = vg.quartet(x,y)
    pa,pb,pc,pd = vg.interpolate_quartet_edges(x,y,t)
    
    case = tuple([int(val > t) for val in vals])
    
    # case 0 and case 15
    if case == (0,0,0,0) or case == (1,1,1,1): return []
    # case 1
    if case == (1,0,0,0): return [Segment(pd,pa)] 
    # case 2
    if case == (0,1,0,0): return [Segment(pa,pb)]
    # case 3
    if case == (1,1,0,0): return [Segment(pd,pb)]
    # case 4
    if case == (0,0,1,0): return [Segment(pb,pc)]
    # case 6
    if case == (0,1,1,0): return [Segment(pa,pc)] 
    # case 7
    if case == (1,1,1,0): return [Segment(pd,pc)] 
    # case 8
    if case == (0,0,0,1): return [Segment(pc,pd)] 
    # case 9
    if case == (1,0,0,1): return [Segment(pc,pa)]
    # case 11
    if case == (1,1,0,1): return [Segment(pc,pb)]
    # case 12
    if case == (0,0,1,1): return [Segment(pb,pd)]
    # case 13
    if case == (1,0,1,1): return [Segment(pb,pa)]
    # case 14
    if case == (0,1,1,1): return [Segment(pa,pd)]
    
    # case 5
    if case == (1,0,1,0):
        if sum(vals)/4.0 > t: return [Segment(pb,pa), Segment(pd,pc)]
        else: return [Segment(pd,pa), Segment(pb,pc)]
    # case 10    
    if case == (0,1,0,1):
        if sum(vals)/4.0 > t: return [Segment(pa,pd), Segment(pc,pb)]
        else: return [Segment(pc,pd), Segment(pa,pb)]
    
    raise Exception("Unhandled Case. This should never happen.")


"""
Main Routine
"""
bins = []
for t in thresh:
    segs = []
    for x,y in vg.addresses:
        if x < vg.px_width-1 and y < vg.px_height-1:
            segs.extend( march(x,y,t) )
    bins.append(segs)

#########################################
        
a.put(bins)
# ---------- end decodes_5 ----------

# ---- group: smooth
join = JoinCurves(Curves=decodes_5.a, Preserve=False)  # -> simplify(Curves)
smoothpline = SmoothPolyline(Polyline=join, Strength=1, Times=Slider(2, range=0..10))

# ----
crv = Curve(smoothpline)
