# Grasshopper definition 1.07.E02.ghx (Grasshopper 0.9.76)
# plug-ins: Python Interpreter, Decodes Python Interpreter

cluster = Cluster(r1=Slider(0.74, range=0.5..1), r2=Slider(1.19, range=1..1.5), S=Slider(5, range=3..8))
crv = Curve([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])
crv_2 = Curve([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])
crv_3 = Curve(cluster)
crv_4 = Curve(crv_3)
explode = Explode(Curve=crv_2, Recursive=True)  # -> flatten(Segments), Vertices

# ---- group: splits curves by intersection
mcx = MultipleCurves(Curves=explode.Segments)  # -> Points, IndexA, IndexB, ParamA, ParamB
python = PythonScript(crvs=explode.Segments, pts=mcx.Points, ia=mcx.IndexA, ib=mcx.IndexB, ta=mcx.ParamA, tb=mcx.ParamB)  # -> out, a; inputs crvs: list of Curve, pts: list of Point3d, ia: list of Int32, ib: list of Int32, ta: list, tb: list
# ---------- python: Python ----------
dict_of_t_vals = { key : [] for key in range(len(crvs)) }
for i in range(len(pts)):
    dict_of_t_vals[ia[i]].append(ta[i])
    dict_of_t_vals[ib[i]].append(tb[i])

splits = []
for n, crv in zip(dict_of_t_vals, crvs):
    tvals = sorted(dict_of_t_vals[n])
    splits.extend( crv.Split(tvals) )

a = splits
# ---------- end python ----------

# ---- group: choose demo
pt = Point([Point(3.71669152, 0.9983237235, 0), Point(2.649977555, 0.9983237235, 0), Point(2.649977555, 1.723355872, 0), Point(3.166667132, 1.723355872, 0)])  # disabled
pt_2 = Point([Point(4.052539745, 2.188043143, 0), Point(4.288883558, 1.990201037, 0), Point(4.162544623, 2.493556689, 0)])  # disabled
decodes = DecodesPythonScript(wpts=pt, strs=pt_2)  # -> console, a; inputs wpts: list, strs: list; disabled
# ---------- decodes: Python ----------
    
    
def choose(walked_pts,suitors):
    vec_base = Vec(walked_pts[-2], walked_pts[-1])
    def angle_to(pt):
        vec_suit = Vec(walked_pts[-1],pt)
        ang = vec_base.angle(vec_suit)
        if abs(ang - math.pi) < EPSILON: return 1/EPSILON
        if vec_base.cross(vec_suit).z >=0 : return ang
        else: return -ang
    
    return sorted(suitors, key=angle_to)[0]
    
    
wpts.append(choose(wpts,strs))    
a.put(wpts)
# ---------- end decodes ----------
pline = PolyLine(Vertices=decodes.a, Closed=False)  # disabled

# ---- group: planar_angle demo
md_slider = MDSlider(
    slider_value=Point(0.3574999571, 0.2625007629, 0.5),
    SliderMode=0,
    x_domain=Domain(-1, 1),
    y_domain=Domain(-1, 1),
    z_domain=Domain(0, 1))  # disabled
md_slider_2 = MDSlider(
    slider_value=Point(0.7699999809, 0.6625003815, 0.5),
    SliderMode=0,
    x_domain=Domain(-1, 1),
    y_domain=Domain(-1, 1),
    z_domain=Domain(0, 1))  # disabled
X = UnitX(Factor=1)  # disabled
panel = Panel("-1,0")  # disabled
pt_3 = Point(Point(1.121430794, -1.851704079, 0))  # disabled
move = Move(Geometry=pt_3, Motion=X)  # -> Geometry, Transform; disabled
decodes_2 = DecodesPythonScript(base=X, vec_a=md_slider_2, vec_b=panel)  # -> console, a; inputs vec_a: Vector3d, vec_b: Vector3d; disabled
# ---------- decodes_2: Python ----------
def planar_angle(cvec,nvec):
    ang = cvec.angle(nvec)
    if abs(ang - math.pi) < EPSILON: return 1/EPSILON
    if cvec.cross(nvec).z >=0 : return ang
    else: return -ang
    
    
a.put(planar_angle(base,vec_a))
a.put(planar_angle(base,vec_b))
# ---------- end decodes_2 ----------
panel_2 = Panel(decodes_2.a)  # disabled
vdis = VectorDisplay(Anchor=move.Geometry, Vector=md_slider)  # disabled
vdis_2 = VectorDisplay(Anchor=move.Geometry, Vector=md_slider_2)  # disabled
vdis_3 = VectorDisplay(Anchor=pt_3, Vector=X)  # disabled

# ---- group: culls dups
python_2 = PythonScript(crvs=python.a)  # -> out, a, b; inputs crvs: list of Curve
# ---------- python_2: Python ----------
def very_close(pa,pb,tol=0.01):
    return abs(pa.X-pb.X)<tol and abs(pa.Y-pb.Y)<tol and abs(pa.Z-pb.Z)<tol

dups = []
not_dups = []
for crv in crvs:
    is_dup = False
    for other in not_dups:
        if very_close(crv.PointAtStart,other.PointAtStart) and very_close(crv.PointAtEnd,other.PointAtEnd):
            is_dup = True
            break
            
    if is_dup: dups.append(crv)
    else: not_dups.append(crv)

a = not_dups
b = dups
# ---------- end python_2 ----------

# ----
decodes_3 = DecodesPythonScript()  # -> console, a, b; inputs lines: list; disabled
# ---------- decodes_3: Python ----------
pgon_limit = 100

gph = SpatialGraph()
for line in lines: gph.add_edge(line.spt,line.ept)
    
def rightiness(cvec,nvec):
    ang = cvec.angle(nvec)
    if round(ang,6) == round(math.pi,6) :
        return 999
    if cvec.cross(nvec).z >=0 : return ang
    else: return -ang


walked_edges = set()
"""
nds = gph.nodes.copy()
while len(nds) > 0:
    st_spt = nds.pop()"""
    
for st_spt in gph.nodes:    
    
    for st_ept in gph.edges[st_spt]:
        wpts = [st_spt,st_ept]
        #b.put([st_spt,st_ept,Circle(Plane(st_spt),0.1)])
        if not (st_spt,st_ept) in walked_edges:
            walking = True
            found_dup_edge = False
            n = 0
            while walking and n < pgon_limit:
                for cpt in gph.edges[wpts[-1]]: cpt.r = rightiness(Vec(wpts[-2],wpts[-1]),Vec(wpts[-1],cpt))
                choice = sorted(gph.edges[wpts[-1]], key=lambda cpt: cpt.r)[0]
                #print choice, choice.r
                #if choice.r == 999: print gph.edges[wpts[-1]]
                if choice is wpts[0] : walking = False
                else: wpts.append(choice)
                n += 1
                if (wpts[-2],wpts[-1]) in walked_edges:
                    found_dup_edge = True
                    break
                
            if len(wpts) > 2 and not found_dup_edge:
                try:
                    pg = PGon(wpts)
                    for n in range(len(wpts)-1): walked_edges.add((wpts[n],wpts[n+1]))
                    #b.put(wpts)
                    a.put(pg)
                except:
                    print "COULD NOT CREATE PGON - are all of these shapes closed?"
# ---------- end decodes_3 ----------

# ---- group: finds connected regions
decodes_4 = DecodesPythonScript(segs=python_2.a)  # -> console, a, b; inputs segs: list
# ---------- decodes_4: Python ----------
    
def choose(walked_pts,suitors):
    vec_base = Vec(walked_pts[-2], walked_pts[-1])
    def angle_to(pt):
        vec_suit = Vec(walked_pts[-1],pt)
        ang = vec_base.angle(vec_suit)
        if abs(ang - math.pi) < EPSILON: return 1/EPSILON
        if vec_base.cross(vec_suit).z >=0 : return ang
        else: return -ang
    
    return sorted(suitors, key=angle_to)[0]
    
gph = SpatialGraph()
for seg in segs: gph.add_edge(seg.spt,seg.ept)

pgons = []
walked_edges = set()
for pair in gph.node_pairs:        
    if pair in walked_edges: continue
    wpts = list(pair)
    valid = True
    while valid:
        choice = choose(wpts,gph.edges[wpts[-1]])
        if len(gph.edges[choice]) == 1: valid = False # dead end
        if choice is wpts[-2] : valid = False # doubled back
        if (wpts[-1],choice) in walked_edges: valid = False # already walked
        if choice is wpts[0] : break # completed loop
        wpts.append(choice)
        
    if valid and len(wpts) > 2:
        pgons.append(PGon(wpts))
        for pair in match(wpts,[0,1]): walked_edges.add(pair)


a.put(pgons)
# ---------- end decodes_4 ----------

# ----
area = Area(Geometry=decodes_4.a)  # -> Area, Centroid
offset = Offset(Curve=decodes_4.a, Distance=Slider(0.023, range=0..0.1), Plane=PlaneXY(0, 0, 0), Corners=1)
sort = SortList(Keys=area.Area, ValuesA=decodes_4.a)  # -> Keys, ValuesA; disabled
panel_3 = Panel(decodes_4.a)
split = SplitList(List=reverse(sort.ValuesA), Index=1)  # -> ListA, ListB
outermost_bounds = Curve(split.ListA)
inner_divisions = Curve(split.ListB)
pcen = PolygonCenter(Polyline=inner_divisions)  # -> CenterV, CenterE, CenterA
crv_5 = Curve(outermost_bounds)
pt_4 = Point(pcen.CenterA)

# ==== cluster Cluster
r1 = ClusterInput()
r2 = ClusterInput()
S = ClusterInput()
r1_2 = Number(r1)
r2_2 = Number(r2)
S_2 = Integer(S)
xy = XYPlane(Origin=Point(0, 0, 0))
cir = Circle(Plane=xy, Radius=r1_2)
curvepoint = PointOnCurve(cir, parameter=0.397)
cir_2 = Circle(Plane=curvepoint, Radius=r1_2)
divide = DivideCurve(Curve=cir, Count=S_2, Kinks=False)  # -> Points, Tangents, Parameters
divide_2 = DivideCurve(Curve=cir_2, Count=S_2, Kinks=False)  # -> Points, Tangents, Parameters
pt = Point([divide_2.Points, divide.Points])
pline = PolyLine(Vertices=divide.Points, Closed=True)
pline_2 = PolyLine(Vertices=divide_2.Points, Closed=True)
cir_3 = Circle(Plane=pt, Radius=r2_2)
divide_3 = DivideCurve(Curve=cir_3, Count=S_2, Kinks=False)  # -> Points, Tangents, Parameters
pline_3 = PolyLine(Vertices=divide_3.Points, Closed=True)
crv = Curve(flatten([pline_2, pline, pline_3]))
crv_2 = ClusterOutput(crv)
