# Grasshopper definition 1.08.E01.ghx (Grasshopper 0.9.75)
# plug-ins: Decodes Python Interpreter

# ----
# a
slider = Slider(1.25, range=1..20)
decodes = DecodesPythonScript(
    radius=Slider(1.942, range=1..10),
    height=slider,
    turns=Slider(1, range=0.5..5),
    falloff=Slider(0.5, range=0.001..1),
    segs_per_turn=Slider(16, range=4..64))  # -> console, a, b, c; inputs segs_per_turn: Int32
# ---------- decodes: Python ----------
"""
[noprint]
"""
PHI = 0.69126979252
def fib_pt(theta):
    r = PHI**theta
    return CS().eval_cyl(r,theta)

"""
Constructs a 3d Golden Spiral (a Golden Helix, perhaps?) as a polyline.
[noprint]
"""
pl_ccw = PLine()
ival_theta = Interval(0,math.pi*2*turns)
for theta in ival_theta.divide(segs_per_turn,True):
    pt = fib_pt(theta) * radius
    pt.z = height * ival_theta.deval(theta)**falloff
    pl_ccw.append(pt)
    

"""
Constructs a new Polyline by mirroring the existing one about the world xz plane, and joining the result.
"""
xf = Xform.mirror("world_xz")
pl_cw = PLine([p*xf for p in pl_ccw.pts])
pl_join = pl_cw.join(pl_ccw)

a.put(pl_ccw)
b.put(pl_cw)
c.put(pl_join)
# ---------- end decodes ----------

# ----
# b
slider_2 = Slider(6, range=4..16)
decodes_2 = DecodesPythonScript(pl=decodes.c, count=slider_2)  # -> console, a; inputs count: Int32
# ---------- decodes_2: Python ----------
"""
By assigning alternative bases to existing Polylines, we may perform basic translations and rotations.
"""

plines = []
for theta in Interval(0,math.pi*2)/count:
    basis = CS().on_xy(rot=theta)
    plines.append(PLine(pl.pts,basis))

a.put(plines)
# ---------- end decodes_2 ----------

decodes_3 = DecodesPythonScript()  # -> console, a, b, c, d; disabled
# ---------- decodes_3: Python ----------
def draw_cs(cs):
    ctr = cs.origin
    ctr.set_weight(0.1)
    line_x = Segment(cs.origin,cs.x_axis)
    line_y = Segment(cs.origin,cs.y_axis/2.0)
    return ctr, line_x, line_y

def fib_pt(theta):
    r=0.7236068536*(0.6126979252**theta) 
    return CylCS().eval(r,theta)

# two joined 2d fib spirals as polygon
pts = []
for theta in Interval(2*math.pi,math.pi)/10:
    pt = fib_pt(theta) * 100
    pt.set_weight(0.5)
    pts.append(pt)

line1 = PLine(pts) * Xform.rotation(angle=-math.pi/10)
mpts =[]
for pt in line1 : mpts.append(pt * Xform.mirror("world_xz"))
line2 = PLine(mpts)
line2 = line2.reverse()
line3 = line1.join(line2, 0.00001)
leaf = PGon(line3)

a.put(line1)
b.put(line2)
c.put(leaf)
d.put(draw_cs(leaf.basis))
# ---------- end decodes_3 ----------
crv = Curve(decodes_3.a)  # disabled
crv_2 = Curve(decodes_3.b)  # disabled
crv_3 = Curve(decodes_3.c)  # disabled

decodes_4 = DecodesPythonScript()  # -> console, a, b, c; disabled
# ---------- decodes_4: Python ----------
def fib_pt(theta):
    r=0.7236068536*(0.6126979252**theta) 
    return CylCS().eval(r,theta)
    

offset = True
for row in Interval()/6:
    base_size = Interval(100,40).eval(row)
    scale_down = Interval(0.9,0.85).eval(row)
    
    # two joined 2d fib spirals as polygon
    pts = [fib_pt(theta)*base_size for theta in Interval(2*math.pi,math.pi)/10]
    pts = [pt * Xform.rotation(angle=-math.pi/10) for pt in pts]
    pts.extend( [pt * Xform.mirror("world_xz") for pt in reversed(pts[:-1])] )
    seed = PGon(pts)
    
    for n in Interval()/20 :
        theta = Interval(0,math.pi).eval(n)
        if offset : theta += math.pi/20
        pt = fib_pt(theta) * Interval(100,30).eval(row)
        pt.z = Point().distance(pt) * 0.5
        c.put(pt.z) 
        vec = Point(0,0)-pt
        seed*scale_down
        seed.basis = CS(pt,vec, vec.cross(Vec(0,0,1)))
        a.put(seed)
        b.put(seed.basis)

    offset = not offset
# ---------- end decodes_4 ----------
crv_4 = Curve(decodes_4.a)  # disabled

# ----
# graphics
slider_3 = Slider(8, range=4..16)  # disabled
lineweight = Panel("0.25 to 2")
decodes_5 = DecodesPythonScript(pl_ccw=decodes.a, pl_cw=decodes.b, count=slider_3, ival_weight=lineweight)  # -> console, a, a_props, b, b_props; inputs count: Int32
# ---------- decodes_5: Python ----------
"""
By assigning alternative bases to existing Polylines, we may perform basic translations and rotations.
"""

plines = []
for theta in Interval(0,math.pi*2)/count:
    basis = CS().on_xy(rot=theta)
    plines.append(PLine(pl_cw.pts,basis))
    plines.append(PLine(pl_ccw.pts,basis))

a.put(plines)

"""
[noprint]
"""
for pl in plines:
    for i, edge in enumerate(pl.edges):
        w = ival_weight.eval(i/len(pl.edges))
        edge.set_weight(w)
        b.put(edge)
# ---------- end decodes_5 ----------
hardboil = DecodesHardBoil(Geometry=decodes_5.b, Properties=decodes_5.b_props)
