# Grasshopper definition 1.08.E02.ghx (Grasshopper 0.9.65)
# plug-ins: Decodes Python Interpreter

# ---- group: triangulation temp
decodes = DecodesPythonScript()  # -> console, a
# ---------- decodes: Python ----------
def angle_div(msh):
    new_msh = Mesh()
    new_msh.append(msh.pts)
    
    for face in msh.faces:
        pgon = PGon([msh.pts[pt] for pt in face])
        edges =[PLine([pgon.pts[l], pgon.pts[l-1]]) for l in range(len(pgon.pts))]
        #edges.sort( key = lambda edges : PLine.length )
        for edge in edges:
            print edge.length
        print 'done'
        
        
    return pgon
        
        
a.put(angle_div)
# ---------- end decodes ----------
parbaked = Mesh(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)  # disabled
decodes_2 = DecodesPythonScript(meshes=parbaked, angle_div=decodes.a)  # -> console, a; inputs meshes: list
# ---------- decodes_2: Python ----------
for mesh in meshes:
    a.put(angle_div(mesh))
# ---------- end decodes_2 ----------
geo = Geometry(decodes_2.a)  # disabled

# ---- group: triangle
pt = Point([<point referenced from the Rhino model> x3])  # disabled
decodes_3 = DecodesPythonScript(points=pt)  # -> console, a; inputs points: list
# ---------- decodes_3: Python ----------
plines = [PLine([points[l], points[l-1]]) for l in range(len(points))]

average = (plines[0].length +plines[1].length + plines[2].length)/3
print 'average = ', average

for line in plines:
    print 'length ',line.length, ' ratio ', line.length / average

print sum([ln.length / average for ln in plines])

a.put(plines)
# ---------- end decodes_3 ----------

# ---- group: single division
decodes_4 = DecodesPythonScript()  # -> console, a
# ---------- decodes_4: Python ----------
min_area = 12

def Div_mesh(msh):
    did_divide = False
    new_msh = Mesh()
    new_msh.append(msh.pts)
    for face in msh.faces:
        points = [msh.pts[pt] for pt in face]
        if PGon(points).area < min_area:
            new_msh.add_face(face[0], face[1], face[2])
        else:
            for l in range(len(points)):
                new_msh.append(PLine([points[l], points[l-1]]).eval(0.5))
            new_msh.add_face(len(new_msh)-2, len(new_msh)-1, len(new_msh)-3)
            new_msh.add_face(len(new_msh)-1, len(new_msh)-2, face[1])
            new_msh.add_face(len(new_msh)-3, len(new_msh)-1, face[2])
            new_msh.add_face(len(new_msh)-2, len(new_msh)-3, face[0])
            if not did_divide:
                did_divide = True
    return new_msh, did_divide
    
    
def Subdiv_mesh(msh):
    done = False
    while not done:
        msh, done = Div_mesh(msh)
    return msh
        
a.put(Subdiv_mesh)
# ---------- end decodes_4 ----------
parbaked_2 = Mesh(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)  # disabled
decodes_5 = DecodesPythonScript(meshes=parbaked_2, Subdiv_mesh=decodes_4.a)  # -> console, a; inputs meshes: list
# ---------- decodes_5: Python ----------
for mesh in meshes:
    a.put(Subdiv_mesh(mesh))
# ---------- end decodes_5 ----------
geo_2 = Geometry(decodes_5.a)  # disabled

# ---- group: multiple division
decodes_6 = DecodesPythonScript()  # -> console, a
# ---------- decodes_6: Python ----------
min_area = 15

def Div_mesh(msh):
    is_done = True
    new_msh = Mesh()
    new_msh.append(msh.pts)
    for face in msh.faces:
        points = [msh.pts[pt] for pt in face]
        if PGon(points).area < min_area:
            new_msh.add_face(face[0], face[1], face[2])
        else:
            for l in range(len(points)):
                new_msh.append(PLine([points[l], points[l-1]]).eval(0.5))
            new_msh.add_face(len(new_msh)-2, len(new_msh)-1, len(new_msh)-3)
            new_msh.add_face(len(new_msh)-1, len(new_msh)-2, face[1])
            new_msh.add_face(len(new_msh)-3, len(new_msh)-1, face[2])
            new_msh.add_face(len(new_msh)-2, len(new_msh)-3, face[0])
            
    for face in new_msh.faces:
        if PGon([new_msh.pts[pt] for pt in face]).area > min_area:
            is_done = False
    return new_msh, is_done
    
def Subdiv_mesh(msh):
    while Div_mesh(msh)[1] == False:
        msh = Div_mesh(msh)[0]
    return msh
        
a.put(Subdiv_mesh)
# ---------- end decodes_6 ----------
parbaked_3 = Mesh(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)  # disabled
decodes_7 = DecodesPythonScript(meshes=parbaked_3, Subdiv_mesh=decodes_6.a)  # -> console, a; inputs meshes: list; same code as decodes_5
geo_3 = Geometry(decodes_7.a)  # disabled

# ---- group: baked stuff
geo_4 = Geometry(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)  # disabled
geo_5 = Geometry(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)  # disabled
