# Grasshopper definition 1.11.E02.ghx (Grasshopper 0.9.75)
# plug-ins: Decodes Python Interpreter

tol = Number("0.01")

# ---- group: Golden Spiral
decodes = DecodesPythonScript(tol=tol, turns=Slider(6.243, range=0.5..10))  # -> console, a, b; disabled
# ---------- decodes: Python ----------
"""
Constructs a golden spiral as a Curve
"""
PHI = 0.6126979252
height = 2.0
def func(theta):
    r = PHI**theta
    z = theta/math.pi/2.0*height
    return CS().eval_cyl(r,theta*turns,z)

ival = Interval.twopi()

#########################################
crv = Curve(func,ival,tol)
a.put(crv)
b.put(crv.surrogate)
# ---------- end decodes ----------

# ---- group: Spiral
decodes_2 = DecodesPythonScript(tol=tol, rad=Slider(1.1, range=1..10), num_turns=Slider(3.5, range=1..10))  # -> console, a, b; disabled
# ---------- decodes_2: Python ----------
from math import *
two_pi = 2*pi
half_pi = 0.5*pi
#########################################

def func(t):
    x = rad*num_turns*t*cos(num_turns*t)
    y = rad*num_turns*t*sin(num_turns*t)
    return Point(x,y)
     
ival = Interval.twopi()

#########################################
crv = Curve(func,ival,tol)
a.put(crv)
b.put(crv.surrogate)
# ---------- end decodes_2 ----------

# ---- group: Hypocycloid
decodes_3 = DecodesPythonScript(tol=tol, rad=Slider(41.2, range=1..50), num_cusps=Slider(12, range=1..30))  # -> console, a, b
# ---------- decodes_3: Python ----------
from math import *
two_pi = 2*pi
half_pi = 0.5*pi
#########################################

def func(t):
    t_value = two_pi*t
    c = cos(t_value)
    s = sin(t_value)
    c_n = cos((num_cusps-1)*t_value)
    s_n = sin((num_cusps-1)*t_value)
    factor = rad/num_cusps
    x = factor*((num_cusps-1)*c - c_n)
    y = factor*((num_cusps-1)*s + s_n)
    return Point(x,y)
    

ival = Interval()

#########################################
crv = Curve(func,ival,tol)
a.put(crv)
b.put(crv.surrogate)
# ---------- end decodes_3 ----------

# ---- group: Blob shaped curves with same area
decodes_4 = DecodesPythonScript(tol=tol, rad=Slider(0.83, range=0..1), alpha=Slider(0.68, range=0..1))  # -> console, a, b; disabled
# ---------- decodes_4: Python ----------
#Blob-shaped curve family.  
#All curves corresponding to fixed radius have the same area.  

from math import *
two_pi = 2*pi
half_pi = 0.5*pi
#########################################

def func(t):
    c = cos(two_pi*t)
    s = sin(two_pi*t)
    c_theta = cos(two_pi*alpha)
    s_theta = sin(two_pi*alpha)
    fac = 1.0/sqrt(2)
    r = 30*(1 + rad*fac*c_theta*cos(4*pi*t) + rad*fac*s_theta*cos(6*pi*t))
    x = r*cos(two_pi*t)
    y = r*sin(two_pi*t)
    return Point(x,y)
     

ival = Interval()

#########################################
crv = Curve(func,ival,tol)
a.put(crv)
b.put(crv.surrogate)
# ---------- end decodes_4 ----------

# ---- group: Bow
decodes_5 = DecodesPythonScript(tol=tol, len_x=Slider(18.6, range=1..31), len_y=Slider(9.9, range=1..20))  # -> console, a, b; disabled
# ---------- decodes_5: Python ----------
from math import *
two_pi = 2*pi
half_pi = 0.5*pi
#########################################


def func(t):
    tan2 = tan(t)**2
    x = len_x*(1-tan2)*cos(t)
    y = len_y*(1-tan2)*sin(t)
    return Point(x,y)
 
eps = 0.05
ival = Interval(-pi/3 + eps, pi/3 - eps)

#########################################
crv = Curve(func,ival,tol)
a.put(crv)
b.put(crv.surrogate)
# ---------- end decodes_5 ----------

# ---- group: Ellipse
decodes_6 = DecodesPythonScript(tol=tol, len_x=Slider(15.4, range=1..50), len_y=Slider(24.9, range=1..50))  # -> console, a, b; disabled
# ---------- decodes_6: Python ----------
from math import *
two_pi = 2*pi
half_pi = 0.5*pi
#########################################

def func(t):
    x = len_x*cos(t)
    y = len_y*sin(t)
    return Point(x,y)
     
ival = Interval.twopi()


#########################################
crv = Curve(func,ival,tol)
a.put(crv)
b.put(crv.surrogate)
# ---------- end decodes_6 ----------

# ---- group: Diamond
decodes_7 = DecodesPythonScript(tol=tol, len_x=Slider(30.5, range=1..50), len_y=Slider(12.8, range=1..50))  # -> console, a, b; disabled
# ---------- decodes_7: Python ----------
from math import *
two_pi = 2*pi
half_pi = 0.5*pi
#########################################

def func(t):
    c = cos(t)
    s = sin(t)
    x = len_x*abs(c)*c
    y = len_y*abs(s)*s
    return Point(x,y)
     
ival = Interval.twopi()

#########################################
crv = Curve(func,ival,tol)
a.put(crv)
b.put(crv.surrogate)
# ---------- end decodes_7 ----------

# ---- group: Teardrop
decodes_8 = DecodesPythonScript(tol=tol, len_x=Slider(15.2, range=1..51), len_y=Slider(23.9, range=1..50), n=Slider(6, range=1..10))  # -> console, a, b; disabled
# ---------- decodes_8: Python ----------
from math import *
two_pi = 2*pi
half_pi = 0.5*pi
#########################################

def func(t):
    x = len_x*cos(t)
    y = len_y*(sin(t)*sin(0.5*t)**n)
    return Point(x,y)

ival = Interval.twopi()

#########################################
crv = Curve(func,ival,tol)
a.put(crv)
b.put(crv.surrogate)
# ---------- end decodes_8 ----------

# ---- group: Spherical knots
decodes_9 = DecodesPythonScript(
    tol=tol,
    rad_min=Slider(6, range=1..6),
    rad_max=Slider(28.35, range=6..50),
    n_theta=Slider(6, range=1..10),
    n_phi=Slider(4, range=1..10))  # -> console, a, b; disabled
# ---------- decodes_9: Python ----------
#spherical knot curves
from math import *


def func(t):
    rho = rad_min + (rad_max - rad_min)*sin(pi*t)
    phi = pi*sin(pi*n_phi*t)
    theta = 2*pi*n_theta*t
    x = rho*sin(phi)*cos(theta)
    y = rho*sin(phi)*sin(theta)
    z = rho*cos(phi)
    return Point(x,y,z)
 
ival = Interval(0,1)

#########################################
crv = Curve(func,ival,tol)
a.put(crv)
b.put(crv.surrogate)
# ---------- end decodes_9 ----------
