# Grasshopper definition 1.11.E06.ghx (Grasshopper 0.9.75)
# plug-ins: Decodes Python Interpreter

rec_w = Slider(8, range=1..8)
rec_h = Slider(4, range=1..8)
rad = Slider(3, range=0.1..3)

# ---- group: Hypocycloid
decodes = DecodesPythonScript(rad=Slider(3.4, range=1..10), num_cusps=Slider(3, range=1..30))  # -> console, a, b
# ---------- decodes: Python ----------
from math import *
two_pi = 2*pi
half_pi = 0.5*pi
#########################################

def func(t):
    t_value = two_pi*t
    c = cos(t_value)
    s = sin(t_value)
    c_n = cos((num_cusps-1)*t_value)
    s_n = sin((num_cusps-1)*t_value)
    factor = rad/num_cusps
    x = factor*((num_cusps-1)*c - c_n)
    y = factor*((num_cusps-1)*s + s_n)
    return Point(x,y)
    

ival = Interval()

#########################################
crv = Curve(func,ival,0.01)
a.put(crv)
b.put(crv.surrogate)
# ---------- end decodes ----------

# ---- group: Diamond
decodes_2 = DecodesPythonScript(len_x=Slider(5.5, range=1..10), len_y=Slider(1.6, range=1..10))  # -> console, a, b
# ---------- decodes_2: Python ----------
from math import *
two_pi = 2*pi
half_pi = 0.5*pi
#########################################

def func(t):
    c = cos(t)
    s = sin(t)
    x = len_x*abs(c)*c
    y = len_y*abs(s)*s
    return Point(x,y)
     
ival = Interval.twopi()

#########################################
crv = Curve(func,ival,0.1)
a.put(crv)
b.put(crv.surrogate)
# ---------- end decodes_2 ----------

# ---- group: Teardrop
decodes_3 = DecodesPythonScript(len_x=Slider(3.7, range=1..10), len_y=Slider(4.6, range=1..10), n=Slider(3, range=1..10))  # -> console, a, b
# ---------- decodes_3: Python ----------
from math import *
two_pi = 2*pi
half_pi = 0.5*pi
#########################################

def func(t):
    x = len_x*cos(t)
    y = len_y*(sin(t)*sin(0.5*t)**n)
    return Point(x,y)

ival = Interval.twopi()

#########################################
crv = Curve(func,ival,0.01)
a.put(crv)
b.put(crv.surrogate)
# ---------- end decodes_3 ----------

# ---- group: ordinary rect
decodes_4 = DecodesPythonScript(rec_w=rec_w, rec_h=rec_h)  # -> console, a, b
# ---------- decodes_4: Python ----------
from math import *
two_pi = 2*pi
half_pi = 0.5*pi
#########################################

def func(t):
    sub_ivals = Interval()//4
    
    # point on right edge
    if t in sub_ivals[0]:
        x = rec_w/2
        y = Interval.remap(t, sub_ivals[0], Interval(-rec_h/2,rec_h/2) )
    # point on top edge
    if t in sub_ivals[1]:
        x = Interval.remap(t, sub_ivals[1], Interval(rec_w/2,-rec_w/2))
        y = rec_h/2
    # point on left edge
    if t in sub_ivals[2]:
        x = -rec_w/2
        y = Interval.remap(t, sub_ivals[2], Interval(rec_h/2,-rec_h/2) )
    # point on bottom edge
    if t in sub_ivals[3]:
        x = Interval.remap(t, sub_ivals[3], Interval(-rec_w/2,rec_w/2))
        y = -rec_h/2
        
    return Point(x,y)


#########################################
crv = Curve(func,Interval())
a.put(crv)
crv.tol = 0.01
b.put(crv.surrogate)
# ---------- end decodes_4 ----------

# ---- group: bespoke rect
decodes_5 = DecodesPythonScript(rec_w=rec_w, rec_h=rec_h)  # -> console, a, b
# ---------- decodes_5: Python ----------
from math import *
two_pi = 2*pi
half_pi = 0.5*pi
#########################################

def func(t):
    # projections onto the bounding lines of the rectangle
    if t != 0 : proj_x = 0.5 * rec_h * cos(t)/sin(t)
    if t != half_pi : proj_y = 0.5 * rec_w * sin(t)/cos(t)
    
    # an angle related to the aspect ratio of this rectangle
    atn = atan(rec_h/rec_w)
    
    # point on top half of right edge
    if t in Interval(0,atn): 
        x = rec_w/2
        y = proj_y
    # point on top edge
    elif t in Interval(atn,pi-atn):
        x = proj_x
        y = rec_h/2
    # point on left edge
    elif t in Interval(pi-atn,pi+atn):  
        x = -rec_w/2
        y = -proj_y
    # point on bottom edge
    elif t in Interval(pi+atn,two_pi-atn):
        x = -proj_x
        y = -rec_h/2
    # point on bottom half of right edge
    elif t in Interval(two_pi-atn,two_pi): 
        x = rec_w/2
        y = proj_y
    
    return Point(x,y)

#########################################
crv = Curve(func,Interval.twopi())
a.put(crv)
crv.tol = 0.01
b.put(crv.surrogate)
# ---------- end decodes_5 ----------

# ---- group: circle
decodes_6 = DecodesPythonScript(rad=rad, ofst=Slider(0, range=-2..2))  # -> console, a, b
# ---------- decodes_6: Python ----------
from math import *
two_pi = 2*pi
half_pi = 0.5*pi
#########################################

def func(t):
    c = math.cos(t)
    s = math.sin(t)
    return Point(rad*c + ofst, rad*s)
     
#########################################
crv = Curve(func,Interval.twopi())
a.put(crv)
crv.tol = 0.01
b.put(crv.surrogate)
# ---------- end decodes_6 ----------

# ----
crv_a = Data(decodes.a)
crv_b = Data(decodes_2.a)

# ---- group: tween
decodes_7 = DecodesPythonScript(crv_a=decodes_6.a, crv_b=decodes_4.a, m=Slider(0.5, range=0..1))  # -> console, a, b
# ---------- decodes_7: Python ----------
from math import *
two_pi = 2*pi
half_pi = 0.5*pi
#########################################

"""
Tweened Curve
Defines a curve that interpolates between crv_a and crv_b at parameter m
"""
def func(t):
    return crv_a.eval(t)*(1-m) + crv_b.eval(t)*m 

crv = Curve(func,Interval())


#########################################
crv.tol = 0.005
a.put(crv.surrogate)

res_u, res_v = 3, 32

pt_grid = [[] for r in range(res_v)]

for mm in Interval().divide(res_u,True):
    def func(t):
        return crv_a.eval(t)*(1-mm) + crv_b.eval(t)*mm 
    crv = Curve(func,Interval())
    
    for v,t in enumerate(Interval()/res_v):
        pt_grid[v].append(crv.eval(t))
        

for pts in pt_grid:
    b.put(PLine(pts))
# ---------- end decodes_7 ----------

# ----
panel = Panel("8")  # disabled
panel_2 = Panel("32")  # disabled
int = Integer(panel)  # disabled
int_2 = Integer(panel_2)  # disabled

# ---- group: demonstrates projection
decodes_8 = DecodesPythonScript(crv_a=decodes_6.a, crv_b=decodes_5.a, rec_w=rec_w, rec_h=rec_h, t=Slider(0, range=0..1))  # -> console, a, b
# ---------- decodes_8: Python ----------
from math import *
half_pi = pi/2
two_pi = pi*2

pa = crv_a.eval(t)
pb = crv_b.eval(t)

a.put(Segment(pa,pb))

"""
demonstrates the projection onto the bounding lines of a rectangle
"""
rec_w = 8
rec_h = 4

t = t*pi*2
if t != 0 : 
    x_coord = 0.5 * rec_h * cos(t)/sin(t)
    print x_coord
    if abs(x_coord) < 10: b.put(Point(x_coord,rec_h/2))
if t != half_pi : 
    y_coord = 0.5 * rec_w * sin(t)/cos(t)
    print y_coord
    if abs(y_coord) < 10: b.put(Point(rec_w/2,y_coord))
# ---------- end decodes_8 ----------

# ---- group: tween
decodes_9 = DecodesPythonScript(crv_a=crv_a, crv_b=crv_b, m=Slider(0.47, range=0..1))  # -> console, a, b; disabled
# ---------- decodes_9: Python ----------
from math import *
two_pi = 2*pi
half_pi = 0.5*pi
#########################################

"""
Tweened Curve
Defines a curve that interpolates between crv_a and crv_b at parameter m
"""
def func(t):
    return crv_a.eval(t)*(1-m) + crv_b.eval(t)*m 

crv = Curve(func,Interval())


#########################################
crv.tol = 0.01
a.put(crv.surrogate)
# ---------- end decodes_9 ----------

# ----
decodes_10 = DecodesPythonScript(crv_a=crv_a, crv_b=crv_b, res_u=int, res_v=int_2)  # -> console, a, b; inputs res_u: Int32; disabled
# ---------- decodes_10: Python ----------
pt_grid = [[] for r in range(res_v)]

for mm in Interval().divide(res_u,True):
    def func(t):
        return crv_a.eval(t)*(1-mm) + crv_b.eval(t)*mm 
    crv = Curve(func,Interval(), 0.005)
    
    for v,t in enumerate(Interval()/res_v):
        pt_grid[v].append(crv.eval(t))
        
    b.put(crv.surrogate)

for pts in pt_grid:
    b.put(PLine(pts))
# ---------- end decodes_10 ----------
