# Grasshopper definition 1.12.E01.ghx (Grasshopper 0.9.75)
# plug-ins: Decodes Python Interpreter

num_rot = Slider(2.62, range=1..6)
# a. Gallery of Mathematical Surfaces
# Usage:  hook up any "out" on the left hand side to the SURF box.
number_slider = Slider(3.4, range=0..10)
height = Slider(5, range=1..5)

# ---- group: Sphere
decodes = DecodesPythonScript(
    theta_0=Slider(1.135, range=0..3.141),
    theta_1=Slider(5.394, range=3.141..6.282),
    phi_0=Slider(0.637, range=0..1.57),
    phi_1=Slider(2.586, range=1.571..3.141))  # -> console, out
# ---------- decodes: Python ----------
from math import *

"""
Cylinder
"""  
const = 2

def func(u,v):
    rho = const
    theta = u
    phi = v
    return CS().eval_sph(rho,phi,theta)
    
    
ival_u = Interval(theta_0, theta_1)
ival_v = Interval(phi_0,phi_1)
srf = Surface(func,ival_u,ival_v)

srf.tol_u = (theta_1-theta_0)/30
srf.tol_v = (phi_1 - phi_0)/20

out.put(srf)
# ---------- end decodes ----------

# ---- group: Torus
decodes_2 = DecodesPythonScript(
    R=Slider(1.56, range=1..2),
    r=Slider(0.56, range=0..1),
    theta0=Slider(-1.44, range=-3.14..-0.01),
    theta1=Slider(2.56, range=0.01..3.14))  # -> console, out
# ---------- decodes_2: Python ----------
from math import *
"""
Torus - standard parametrization as a surface of revolution 
    x = (R + r*cos(v))*cos(u)
    y = (R + r*cos(v))*sin(u)
    z = r*sin(v)
    domain = [0, 2*pi]x[0, 2*pi]
Will look primarily at the case of the ring torus when R > r > 0
    
"""

from math import *

def func(u,v):
    x = (R + r*cos(v))*cos(u)
    y = (R + r*cos(v))*sin(u)
    z = r*sin(v)
    return Point(x,y,z)

ival_u = Interval(theta0,theta1)
ival_v = Interval.twopi()
srf = Surface(func,ival_u,ival_v)
srf.tol_u = 2*pi/20
srf.tol_v = 2*pi/20

out.put(srf)
# ---------- end decodes_2 ----------

# ---- group: graph
decodes_3 = DecodesPythonScript()  # -> console, out
# ---------- decodes_3: Python ----------
"""
Graph 
Product of lines
"""

a = -1
b = 2
c = -1
d = 1

def func(u,v):
    x = u
    y = v
    z = (u - a)*(u - b)*(v - c)*(v - d)
    return Point(x,y,z)
     
ival_u = Interval(a,b)
ival_v = Interval(c,d)

srf = Surface(func, ival_u, ival_v)
srf.tol_u = 0.2
srf.tol_v = 0.1

out.put(srf)
# ---------- end decodes_3 ----------

# ---- group: Cylinder
decodes_4 = DecodesPythonScript(h=number_slider)  # -> console, out
# ---------- decodes_4: Python ----------
from math import *

"""
Cylinder
"""  
const = 2

def func(u,v):
    r = const
    theta = u
    z = v
    return CS().eval_cyl(r,theta,z)
    
    
ival_u = Interval.twopi()
ival_v = Interval(0,h)
srf = Surface(func,ival_u,ival_v)

srf.tol_u = 2*pi/30
srf.tol_v = h/10

out.put(srf)
# ---------- end decodes_4 ----------

# ---- group: Helicoid
decodes_5 = DecodesPythonScript(n=num_rot)  # -> console, out
# ---------- decodes_5: Python ----------
from math import *
"""
Helicoid
"""
r1, r2, b = 2.0/5, 1.0, 1.0/20

def func(u,v):
    r = v
    theta = u
    z = b*u
    return CS().eval_cyl(r,theta,z)
   
    
ival_u = Interval(0, 2*pi*n)
ival_v = Interval(r1,r2)
srf = Surface(func,ival_u,ival_v)

# ensure at lease 3 samples per each half-turn
n_tol = math.pi/(n*3) 
if n_tol < srf.tol_u : srf.tol_u = math.pi/(n*3)

out.put(srf)
# ---------- end decodes_5 ----------

# ---- group: Catenoid
decodes_6 = DecodesPythonScript(h=height)  # -> console, out
# ---------- decodes_6: Python ----------
from math import *

"""
Catenoid
"""

def func(u,v):
    r = cosh(v/2)
    theta = u
    z = v
    return CS().eval_cyl(r,theta,z)
    
ival_u = Interval.twopi()
ival_v = Interval(-h/2,h/2)

srf = Surface(func,ival_u,ival_v)
srf.tol_u = 2*pi/20
srf.tol_v = h/10

out.put(srf)
# ---------- end decodes_6 ----------

# ---- group: Superellipsoid
decodes_7 = DecodesPythonScript(m=Slider(0.23, range=0.1..4), n=Slider(1.22, range=0.2..4))  # -> console, out
# ---------- decodes_7: Python ----------
from math import *

"""
Superellipsoid

This surface fits into a box with dimensions determined by len_x,y,z. 
Notice that when dim_x = dim_y = dim_z and for m = n = 1, this is simply
a sphere.

"""
dim_x = 2
dim_y = 2
dim_z = 1.5

def sgn_pow(x, alpha):
    if x == 0: return 0
    return abs(x)**alpha * (x/abs(x))
    
def func(u,v):
    x = sgn_pow(sin(v),m) * sgn_pow(cos(u),n)
    y = sgn_pow(sin(v),m) * sgn_pow(sin(u),n)
    z = sgn_pow(cos(v),m)
    return Point(dim_x * x, dim_y * y, dim_z * z)
    
    
ival_u = Interval.twopi()
ival_v = Interval(0, pi)

srf = Surface(func,ival_u,ival_v)
srf.tol_u = ival_u.length/15
srf.tol_v = ival_v.length/15

out.put(srf)
# ---------- end decodes_7 ----------

# ----
surf = Data(decodes_7.out)
md_slider = MDSlider(
    slider_value=Point(0.4965209961, 0.2498035431, 0.5),
    SliderMode=0,
    x_domain=Domain(0, 1),
    y_domain=Domain(0, 1),
    z_domain=Domain(0, 1))
decodes_8 = DecodesPythonScript(surf=surf)  # -> console, a
# ---------- decodes_8: Python ----------
# this will set the resolution according to surf.tol_u and surf.tol_v
a.put(surf.surrogate)
# ---------- end decodes_8 ----------
decodes_9 = DecodesPythonScript(surf=surf, pt_uv=md_slider)  # -> console, a, b, c; inputs pt_uv: Point3d
# ---------- decodes_9: Python ----------
u = pt_uv.x
v = pt_uv.y


"""
Point on Surface
"""
pt_on_surf = surf.eval(u,v)


"""
Iso(curves and polylines) 
"""
u_fix = surf.domain_u.eval(u) 
v_fix = surf.domain_v.eval(v)
iso_u = surf.isopolyline(u_val = None, v_val = v_fix , res = 30)
iso_v = surf.isopolyline(u_val = u_fix, v_val = None, res = 30 )


a.put(pt_on_surf)
b.put(iso_u)
c.put(iso_v)
# ---------- end decodes_9 ----------
