# Grasshopper definition 1.12.E04.ghx (Grasshopper 0.9.75)
# plug-ins: Decodes Python Interpreter

# ---- group: bowl
slider = Slider(-1, range=-1..1)  # disabled
slider_2 = Slider(-0.457, range=-1..1)  # disabled
slider_3 = Slider(1, range=-1..1)  # disabled
pts = Point([Point(0.583, 0, 0), Point(0.2975609477, 0, 0.5041924453), Point(1, 0, 1)])  # disabled
slider_4 = Slider(6.28, range=0..6.28)  # disabled
slider_5 = Slider(3.78, range=0..6.28)  # disabled
decodes = DecodesPythonScript(pts=pts)  # -> console, a; inputs pts: list; disabled
# ---------- decodes: Python ----------
crv = Curve.bezier(pts)
a.put(crv)
# ---------- end decodes ----------
vec = VectorXYZ(XComponent=slider, YComponent=slider_2, ZComponent=slider_3)  # -> Vector, Length; disabled
dom = Domain(DomainStart=slider_5, DomainEnd=slider_4)  # disabled
pt = Point(Point(1, 0.145, -1))  # disabled
vdis = VectorDisplay(Anchor=pt, Vector=vec.Vector)  # disabled
decodes_2 = DecodesPythonScript(crv=decodes.a, rot_ival=dom, axis_vec=vec.Vector, base_pt=pt)  # -> console, a; inputs axis_vec: Vector3d; disabled
# ---------- decodes_2: Python ----------
from decodes.extensions.classical_surfaces import *

surf = RotationalSurface(crv,axis = Ray(base_pt,axis_vec),dom_u=rot_ival)

"""
#Encapsulates the following definition
def func(u,v):
    pt = crv.eval(v)
    angle = rot_ival.eval(u)
    xf = Xform.rotation(axis=axis_vec,angle=angle,center=base_pt )
    return pt*xf 
surf = Surface(func)
"""

a.put(surf)
# ---------- end decodes_2 ----------

# ---- group: generalized cone
alpha = Slider(0.22, range=0..1)
rad = Slider(0.61, range=0..1)
dom_2 = Domain(DomainStart=Slider(0, range=0..6.28), DomainEnd=Slider(4.19, range=0..6.28))
h = Slider(10, range=0..10)
decodes_3 = DecodesPythonScript(height=h, rad=rad, alpha=alpha, height_factor=Slider(0.446, range=0..1), rot_ival=dom_2)  # -> console, out
# ---------- decodes_3: Python ----------
"""
Cone with a blobby base
"""

def blob(t):
    c_theta = math.cos(2*math.pi*alpha)
    s_theta = math.sin(2*math.pi*alpha)
    factor = 1.0/math.sqrt(2)
    r = 5*(1 + rad*factor*c_theta*math.cos(2*t) + rad*factor*s_theta*math.cos(3*t))
    pt_out = Point(r*math.cos(t), r*math.sin(t))
    return pt_out
   
   
crv = Curve(blob, rot_ival)

def func(u,v):
    return Segment(crv.eval(u), Point(0, 0, height)).eval(v*height_factor)


surf = Surface(func)

####################
res = 25
surf.tol_u = 1.0/res

out.put(surf)
# ---------- end decodes_3 ----------

# ----
panel = Panel("0.2,0.2")  # disabled

# ---- group: bulb
slider_6 = Slider(0.2, range=0..1)  # disabled
md_slider = MDSlider(
    slider_value=Point(0.4437095828, 0.2008428806, 0.5),
    SliderMode=0,
    x_domain=Domain(0, 1),
    y_domain=Domain(0, 1),
    z_domain=Domain(0, 1))  # disabled
slider_7 = Slider(0.2, range=0..1)  # disabled
cluster = Cluster(num=slider_6, V=md_slider, num_2=slider_7)  # disabled
decodes_4 = DecodesPythonScript(pts=cluster)  # -> console, a; inputs pts: list; disabled; same code as decodes
decodes_5 = DecodesPythonScript(crv=decodes_4.a)  # -> console, a; disabled
# ---------- decodes_5: Python ----------
from decodes.extensions.classical_surfaces import RotationalSurface

surf = RotationalSurface(crv, axis=Ray(Point(), Vec.uz()), dom_u = Interval.twopi())
a.put(surf)
# ---------- end decodes_5 ----------

# ---- group: circular cone
dom_3 = Domain(DomainStart=Slider(0, range=0..6.28), DomainEnd=Slider(4, range=0..6.28))
decodes_6 = DecodesPythonScript(rad_top=Slider(7, range=0..10), rad_bot=Slider(1.57, range=0..10), height=Slider(4.84, range=0..10), rot_ival=dom_3)  # -> console, out
# ---------- decodes_6: Python ----------
"""
Cone
A right circular cone 
"""


"""
#could also use
from decodes.extensions.classical_surfaces import *
"""


rot_axis = Vec(0,0,1)
base_pt = Point(0,0,0)
ln_rot = Line(Point(rad_bot,0,0), Point(rad_top, 0, height))


def func_cone(u,v):
    xf = Xform.rotation(axis=rot_axis,angle=u,center=base_pt )
    return ln_rot.eval(v)*xf

res_u = 25
res_v = 10
srf = Surface(func_cone, rot_ival, Interval(), rot_ival.length/res_u, 1.0/res_v)

out.put(srf)
# ---------- end decodes_6 ----------

# ----
decod_es_surf = Data(decodes_3.out)
decod_es_surf_2 = Data(decodes_2.a)  # disabled
panel_2 = Panel("Conoid")  # disabled
number_slider = Slider(15, range=1..20)  # disabled

# ---- group: unrolls cone
decodes_7 = DecodesPythonScript()  # -> console, a, b
# ---------- decodes_7: Python ----------
# Unroll surface function by flattening triangles along the strip
def flatten_ptstrip(pts_a,pts_b,init_ray=Ray(Point(),Vec(0,1))):
    # From a given ray, get the starting point of the surface unrolling 
    fpts_a = [init_ray.spt]
    # Reset the distance of the ray with the distance from the bottom point to the top point of the surface
    init_ray._vec.length = pts_a[0].distance(pts_b[0])
    # Translate the starting point with the ray's vector
    fpts_b = [init_ray.spt + init_ray.vec]
    # Create a CS to lay down the unrolled surfaces
    cs_tar = CS(Point(),Vec(0,1),Vec(1,0))
    # Translate the surface points into the XY plane
    for n in range(len(pts_a)-1):
        a0, a1, b0, b1 = pts_a[n],pts_a[n+1],pts_b[n], pts_b[n+1]
        cs_src = CS(b0,Vec(b0,a0),Vec(b0,a1))
        fpts_b.append(a1*Xform.change_basis(cs_src,cs_tar))
        cs_tar = CS.on_xy(fpts_b[-1].x, fpts_b[-1].y,Vec(fpts_b[-1],fpts_a[-1]))  
        cs_src = CS(a1,Vec(a1,b0),Vec(a1,b1))
        fpts_a.append(b1*Xform.change_basis(cs_src,cs_tar))
        cs_tar = CS.on_xy(fpts_a[-1].x, fpts_a[-1].y, Vec(fpts_a[-1],fpts_b[-1]))
      # Return the flattened points
    return fpts_a , fpts_b

# Create a Mesh from points
def mesh_from_ptstrip(pts_a,pts_b):
    msh = Mesh()
    # Set the points as Mesh vertices
    for pt in pts_a + pts_b : msh.append(pt)
    # Set the Mesh faces
    for n in range(len(pts_b)):
        pi_0 = n
        pi_1 = n+1
        pi_2 = n+len(pts_b)+1
        pi_3 = n+len(pts_b)
        msh.add_face(pi_0,pi_3,pi_2, pi_1)
    return msh

    
a.put(mesh_from_ptstrip)
b.put(flatten_ptstrip)
# ---------- end decodes_7 ----------
decodes_8 = DecodesPythonScript(cone=decod_es_surf, mesh_ptstr=decodes_7.a, flat_ptstr=decodes_7.b)  # -> console, a, out, xf_out
# ---------- decodes_8: Python ----------
"""
Unwraps the given curve on the cone. 
"""

a.put(cone.surrogate)

tol = EPSILON
u0 = cone.u0
u1 = cone.u1
u_val = Interval(u0,u1).divide(int((u1-u0)/cone.tol_u),True)

# Creates lists of points for each strip.
pts = []
for u in u_val:
    strip = []
    strip.append(cone.deval(u,0))
    strip.append(cone.deval(u,1))
    pts.append(strip)

#Lay down first strip
cs_orig = CS(pts[0][0],Vec(pts[0][0],pts[0][1]),Vec(pts[0][0],pts[1][0]))
pos = Point(10,0)
fpts_a, fpts_b= flat_ptstr(pts[0],pts[1])
fmsh = mesh_ptstr(fpts_a,fpts_b)
xf = Xform.translation(Vec(fpts_b[0],pos))
out.put(fmsh*xf)
cs_flat = CS(fpts_b[0]*xf,Vec(fpts_b[0]*xf,fpts_b[1]*xf),Vec(fpts_b[0]*xf,fpts_a[0]*xf))
xf_strip = [Xform.change_basis(cs_orig, cs_flat)]
pos = fpts_a[0]*xf
vec_prev = Vec(fpts_a[0]*xf, fpts_a[1]*xf)

#Lay down the remaining strips with edges aligned
num_strips = len(pts)
for i in range(1,num_strips-1):
    cs_orig = CS(pts[i][0],Vec(pts[i][0],pts[i][1]),Vec(pts[i][0],pts[i+1][0]))
    # Unrolls the strip
    fpts_a, fpts_b= flat_ptstr(pts[i],pts[i+1])
    # Create a mesh from pts
    fmsh = mesh_ptstr(fpts_a,fpts_b)
    # Form the transformaton matrix to align the strips edge-to-edge    
    xf_trans = Xform.translation(Vec(fpts_b[0],pos))
    vec_now = Vec(fpts_b[0],fpts_b[1])
    angle = vec_now.angle(vec_prev)
    xf_rot_test = Xform.rotation(angle = angle)
    if ((vec_now*xf_rot_test-vec_prev).length2 > tol):
        angle = -angle
    xf_rot = Xform.rotation(angle = angle, center = fpts_b[0])
    xf = xf_trans*xf_rot    
    out.put(fmsh*xf)
    cs_flat = CS(fpts_b[0]*xf,Vec(fpts_b[0]*xf,fpts_b[1]*xf),Vec(fpts_b[0]*xf,fpts_a[0]*xf))
    xf_strip.append(Xform.change_basis(cs_orig, cs_flat))

    pos = fpts_a[0]*xf
    vec_prev = Vec(fpts_a[0]*xf, fpts_a[1]*xf)
    
  
xf_out.put(xf_strip)
# ---------- end decodes_8 ----------

# ---- group: unwraps a freeform curve on cone
# b
slider_8 = Slider(0.689, range=0..1)
decodes_9 = DecodesPythonScript(
    cone=decod_es_surf,
    xf_flat=decodes_8.xf_out,
    len_top=slider_8,
    len_bot=Slider(0, range=0..1),
    mid=Slider(0.507, range=0..1),
    len_mid=Slider(1, range=0..1))  # -> console, a, out, flat_out; inputs xf_flat: list
# ---------- decodes_9: Python ----------
import math

u0 = cone.u0
u1 = cone.u1

tol_u = cone.tol_u
res_u = int((u1-u0)/tol_u)

p_top = cone.deval(u0 + len_top*(u1-u0), 1)
p_bot = cone.deval(u0 + len_bot*(u1-u0), 0)
p_mid = cone.deval(u0 + len_mid*(u1-u0), mid)
a.put([p_bot, p_mid, p_top])

pts_domain = [Point(u0 + len_top*(u1-u0), 1), Point(u0 + len_mid*(u1-u0), mid), Point(u0 + len_bot*(u1-u0), 0)]
crv_domain = Curve.bezier(pts_domain)

def func_crv_cone(t):
    domain_pt = crv_domain.eval(t)
    u = domain_pt.x
    v = domain_pt.y
    return cone.deval(u,v)    

def func_crv_flat(t):
   domain_pt = crv_domain.eval(t)
   u = domain_pt.x
   strip = int(math.floor((u-u0)/tol_u))
   if strip == res_u: strip = res_u-1
   return func_crv_cone(t)*xf_flat[strip]
    
crv_cone = Curve(func_crv_cone, Interval())
crv_cone.tol = cone.tol_u
out.put(crv_cone.surrogate)

crv_flat = Curve(func_crv_flat, Interval())
crv_flat.tol = cone.tol_u
flat_out.put(crv_flat.surrogate)
# ---------- end decodes_9 ----------

# ----
# a
decodes_10 = DecodesPythonScript(rot_surf=decod_es_surf_2, res=number_slider)  # -> console, out, a, b, c; inputs res: Int32; disabled
# ---------- decodes_10: Python ----------
from math import *


# NOTE: dot product of zero should be replaced with test for nearing EPSILON

#########################################

axis = Ray(rot_surf.center, rot_surf.axis)
pline = rot_surf.isopolyline(u_val = 0, res = res)

for seg in pline.edges: 
    cpt, t, rad = axis.near(seg.spt)
    dot = Vec(cpt, seg.spt).dot(seg.vec)
    
    #if part of a cylinder
    if dot == 0: side = seg
    else:
        d = rad/tan(seg.vec.angle(axis.vec))
        #if part of a cone, with seg.spt at the base
        if dot < 0:
            apex = cpt + axis.vec*d
            side = Segment(seg.spt, apex)
            
        #if part of a cone, with seg.ept at the base
        if dot > 0:
            # redefine cpt and radius
            cpt, t, rad = axis.near(seg.ept)
            apex = cpt - axis.vec*d
            side = Segment(seg.ept, apex)       
    
    base = Circle(Plane(cpt, axis.vec), rad) 
   

#########################################

    if dot != 0: 
        a.put(apex)
    else:
        a.put(False)
    b.put(side)
    c.put(base)


rot_surf.tol_u = 1.0/20
rot_surf.tol_v = 1.0/res
#out.put(rot_surf.surrogate)
out.put(pline)
# ---------- end decodes_10 ----------

base = Geometry(decodes_10.c)  # disabled
apex = Data(decodes_10.a)  # disabled
side = Geometry(decodes_10.b)  # disabled

# ==== cluster Cluster
V = ClusterInput()
num = ClusterInput()
num_2 = ClusterInput()
vcomp = Decompose(Vector=V)  # -> XComponent, YComponent, ZComponent
num_3 = Number(num)
num_4 = Number(num_2)
pt = PointXYZ(XComponent=vcomp.XComponent, YComponent=vcomp.ZComponent, ZComponent=vcomp.YComponent, System=PlaneXY(0, 0, 0))
pt_2 = PointXYZ(XComponent=num_4, YComponent=0, ZComponent=0, System=PlaneXY(0, 0, 0))
pt_3 = PointXYZ(XComponent=num_3, YComponent=0, ZComponent=1, System=PlaneXY(0, 0, 0))
pt_4 = Point([pt_2, pt, pt_3])
pt_5 = ClusterOutput(pt_4)
