# Grasshopper definition 1.12.E05.ghx (Grasshopper 0.9.76)
# plug-ins: Decodes Python Interpreter

# ---- group: Mult-Bump Surface on a Flat Surface Base
pt = Point([Point(-10.15780771, 18.60628363, 0), Point(4.747078961, 11.27249505, 0), Point(6.903776371, 18.84800505, 0), Point(20.86249309, 16.84084866, 0)])
pt_2 = Point([Point(-10, 23.18683519, 0), Point(0, 34.67390436, 0), Point(13, 30.59938581, 0), Point(21, 22.12047506, 0)])
decodes = DecodesPythonScript(pts_a=pt, pts_b=pt_2)  # -> console, a, b; inputs pts_a: list, pts_b: list
# ---------- decodes: Python ----------
#Ruled Surface constructed by connecting points of two generating curves
crv_a = Curve.bezier(pts_a)
crv_b = Curve.bezier(pts_b)

def func(u,v):
    rule = Segment(crv_a.eval(u), crv_b.eval(u))
    return rule.eval(v)

surf = Surface(func)
a.put(surf)
b.put(surf.surrogate)
# ---------- end decodes ----------
decodes_2 = DecodesPythonScript()  # -> console, a
# ---------- decodes_2: Python ----------
#Generat rectangles on the unit domain 

rects_uv = []

u0, v0 = 0.1,0.3
dim_u, dim_v = 0.3, 0.6
rects_uv.append(PGon.rectangle(Point(u0 + dim_u/2, v0 + dim_v/2), dim_u, dim_v))

u0, v0 = 0.3,0.1
dim_u, dim_v = 0.4, 0.5
rects_uv.append(PGon.rectangle(Point(u0 + dim_u/2, v0 + dim_v/2), dim_u, dim_v))

u0, v0 = 0.6,0.1
dim_u, dim_v = 0.3, 0.3
rects_uv.append(PGon.rectangle(Point(u0 + dim_u/2, v0 + dim_v/2), dim_u, dim_v))

u0, v0 = 0.6,0.6
dim_u, dim_v = 0.3, 0.3
rects_uv.append(PGon.rectangle(Point(u0 + dim_u/2, v0 + dim_v/2), dim_u, dim_v))

u0, v0 = 0.4, 0.3
dim_u, dim_v = 0.6, 0.2
rects_uv.append(PGon.rectangle(Point(u0 + dim_u/2, v0 + dim_v/2), dim_u, dim_v))

a.put(rects_uv)
# ---------- end decodes_2 ----------
decodes_3 = DecodesPythonScript(base_surf=decodes.a, bnds_disp=decodes_2.a)  # -> console, a; inputs bnds_disp: list
# ---------- decodes_3: Python ----------
from math import *
h_fac = 6.06


bnds_disp = [Bounds.encompass(bnds.pts) for bnds in bnds_disp]
#for bnds in bnds_disp: b.put(bnds.to_pline())

def displace(u,v,bnds,factor):
    upi = Interval.remap(u, bnds.ival_x, Interval.twopi())
    vpi = Interval.remap(v, bnds.ival_y, Interval.twopi())
    h = factor * bnds.dim_x * bnds.dim_y
    return h*(1-cos(upi))*(1-cos(vpi))

#########################################

def func(u,v):
    pt = base_surf.eval(u,v)
    for bnds in bnds_disp:
        if Point(u,v) in bnds: pt.z += displace(u,v,bnds,h_fac)
    return pt

srf = Surface(func)

#########################################

srf.tol_u = 1.0/30
srf.tol_v = 1.0/10
a.put(srf.surrogate)
# ---------- end decodes_3 ----------

# ----
fib = Fibonacci(SeedA=2, SeedB=3, Number=3)
division = Division(A=Slider(1.5, range=1..2), B=fib)
division_2 = Division(A=Slider(0.25, range=0..1), B=fib)
pt_3 = ConstructPoint(XCoordinate=graft(division), YCoordinate=division, ZCoordinate=0)  # -> simplify(Point)
dom = ConstructDomain(DomainStart=division_2, DomainEnd=expr("-x", division_2))
rectangle = Rectangle(Plane=pt_3, XSize=graft(dom), YSize=dom, Radius=0)  # -> flatten(Rectangle), Length

# ---- group: Multi-Bump Surface on Rectangular Base
rec = Rectangle({Plane=PlaneXY(3.710359873, -20.91328204, 0), Size=Domain2(u=0..28.90654306, v=0..11.52508594)})
rec_2 = Rectangle([{Plane=PlaneXY(7.28771703, -17.25622163, 0), Size=Domain2(u=0..4.657243506, v=0..5.634198111)}, {Plane=PlaneXY(19.11185912, -19.20999992, 0), Size=Domain2(u=0..11.73483406, v=0..6.191921792)}, {Plane=PlaneXY(15.745606, -16.81814451, 0), Size=Domain2(u=0..12.05151995, v=0..6.127361312)}])
decodes_4 = DecodesPythonScript(bnds_srf=rec, bnds_disp=rec_2, h_fac=Slider(0.011, range=0..0.05))  # -> console, a; inputs bnds_disp: list
# ---------- decodes_4: Python ----------
from math import *
two_pi = math.pi * 2

bnds_srf = Bounds.encompass(bnds_srf.pts)
print bnds_srf.ival_x, bnds_srf.ival_y

bnds_disp = [Bounds.encompass(bnds.pts) for bnds in bnds_disp]
#b.put(bnds_srf.to_pline())

#########################################

"""
Multi-bump Surface with Rectangular Base
Sum of smooth bumps on each inner rectangle
"""


def displace(u,v,bnds,factor):
    upi = Interval.remap(u, bnds.ival_x, Interval.twopi())
    vpi = Interval.remap(v, bnds.ival_y, Interval.twopi())
    h = factor*bnds.dim_x*bnds.dim_y
    return h*(1-cos(upi))*(1-cos(vpi))

def func(u,v):
    #initialize pt with no height
    pt = bnds_srf.eval(u,v)
    #if in Bounds, then bump up height
    for bnds in bnds_disp:
         if pt in bnds: pt.z += displace(pt.x,pt.y,bnds,h_fac)
    return pt

srf = Surface(func)


#########################################
srf.tol_u = 1.0/20
srf.tol_v = 1.0/20
a.put(srf.surrogate)
# ---------- end decodes_4 ----------

# ---- group: Single Smooth Bump on a Rectangle
decodes_5 = DecodesPythonScript(h=Slider(0.79, range=0..2))  # -> console, out
# ---------- decodes_5: Python ----------
from math import *

a,b = -2,2
c,d = -6,-1

#########################################


"""
Smooth Bump
Graph evaluating to zero at the boundary of rectangle
"""
bnds = Bounds(ival_x = Interval(a,b), ival_y = Interval(c,d))
def func(u,v):
    upi = Interval.remap(u, bnds.ival_x, Interval.twopi())
    vpi = Interval.remap(v, bnds.ival_y, Interval.twopi())
    z = h*(1-cos(upi))*(1-cos(vpi))
    return Point(u,v,z)
  

srf = Surface(func, bnds.ival_x, bnds.ival_y)


#########################################
out.put(srf.surrogate)
# ---------- end decodes_5 ----------

# ---- group: Multi-Bump Surface on a Freeform Surface Base
pt_4 = Point([Point(-10, 0, 2), Point(0, 0, 10), Point(13, 0, 10), Point(25.81705155, 0, 2)])
pt_5 = Point([Point(-10.27764533, -8, 0), Point(0, -8, -2), Point(9.970901996, -8, -4), Point(25.7344314, -8, -6)])
pt_6 = Point([Point(-9.216924353, 10, -6), Point(-0.003694267862, 10, -4), Point(12.35718016, 10, -2), Point(25.81705155, 10, 0)])
decodes_6 = DecodesPythonScript(pts_a=pt_6, pts_b=pt_4, pts_c=pt_5)  # -> console, a, b; inputs pts_a: list, pts_b: list, pts_c: list; disabled
# ---------- decodes_6: Python ----------
#Bezier surface
cpts = []
for i in range(len(pts_a)):
    row = [pts_a[i],pts_b[i],pts_c[i]]
    cpts.append(row)

def bezier_surf(cpts):
    crvs_row = [Curve.bezier(cpts[i]) for i in range(len(cpts))]
    def func(u,v):
        pts = [crv.eval(u) for crv in crvs_row]
        return Curve.bezier(pts).eval(v)
    return Surface(func)
surf = bezier_surf(cpts)
a.put(surf)
b.put(surf.surrogate)
# ---------- end decodes_6 ----------
decodes_7 = DecodesPythonScript(base_surf=decodes_6.a, bnds_disp=rectangle.Rectangle)  # -> console, a; inputs bnds_disp: list
# ---------- decodes_7: Python ----------
from math import *
h_fac = 20.06

bnds_disp = [Bounds.encompass(bnds.pts) for bnds in bnds_disp]
#for bnds in bnds_disp: b.put(bnds.to_pline())

def displace(u,v,bnds,factor):
    upi = Interval.remap(u, bnds.ival_x, Interval.twopi())
    vpi = Interval.remap(v, bnds.ival_y, Interval.twopi())
    h = factor * bnds.dim_x * bnds.dim_y
    return h*(1-cos(upi))*(1-cos(vpi))

#########################################

def func(u,v):
    pt = base_surf.eval(u,v)
    for bnds in bnds_disp:
        vec = base_surf.eval_pln(u,v).normal
        if Point(u,v) in bnds: pt += vec * displace(u,v,bnds,h_fac)
    return pt

srf = Surface(func)


#########################################
#srf.tol_u, srf.tol_v = 1.0/10, 1.0/20
#srf.tol_u, srf.tol_v = 1.0/40, 1.0/60 # 6 min
a.put(srf.surrogate)
# ---------- end decodes_7 ----------
mesh = Mesh(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)
mesh_2 = Mesh(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)
