# Grasshopper definition 1.12.E06.ghx (Grasshopper 0.9.75)
# plug-ins: Decodes Python Interpreter

# ----
# a. Gallery of Translational Surfaces
# Usage:  match up outies on the left hand side to innies on right-hand side
# OR
# mix and match them at your own risk!
len_x = Slider(9.36, range=1..10)  # disabled
len_y = Slider(4.41, range=1..10)  # disabled
height = Slider(-2.21, range=-20..20)  # disabled
len_x_2 = Slider(2.78, range=1..10)  # disabled
len_y_2 = Slider(4.02, range=1..10)  # disabled
len_z = Slider(4, range=-20..20)  # disabled
height_2 = Slider(1.79, range=1..6)  # disabled
skew = Slider(0.39, range=0..1)  # disabled
len = Slider(8.58, range=4..13)  # disabled
panel = Panel("Skew Hat")  # disabled
panel_2 = Panel("Wavy")  # disabled
panel_3 = Panel("Hyperbolic Paraboloid")  # disabled
panel_4 = Panel("Elliptic Paraboloid")  # disabled
decodes = DecodesPythonScript()  # -> console, a, b; disabled
# ---------- decodes: Python ----------
from math import *
"""
Wavy Translational Surface
"""

def func_gen(t):
    return Point(t, 0, sin(t))

def func_dir(t):
    return Point(0, 2*t, -t*t)
    
crv_a = Curve(func_gen,Interval(0,4.5*pi))
crv_b = Curve(func_dir, Interval(-2,2))

a.put(crv_a)
b.put(crv_b)
# ---------- end decodes ----------
decodes_2 = DecodesPythonScript(hei=height_2, len=len, skw=skew)  # -> console, a, b; disabled
# ---------- decodes_2: Python ----------
"""
Skew Hat
"""
from math import *

def func_gen(t):
    xf_rot = Xform.rotation(angle = skw*pi/4)
    return xf_rot*Point(t, 0, (hei/2)*(1-cos(2*pi*t/len)))

def func_dir(t):
    xf_rot = Xform.rotation(angle = -skw*pi/4)
    return xf_rot*Point(0, t, (hei/2)*(1-cos(2*pi*t/len)))

crv_a = Curve(func_gen,Interval(0, len))
crv_b = Curve(func_dir,Interval(0, len))
a.put(crv_a)
b.put(crv_b)
# ---------- end decodes_2 ----------
decodes_3 = DecodesPythonScript(len=len_x, wid=len_y, hei=height)  # -> console, a, b; disabled
# ---------- decodes_3: Python ----------
def func_gen(t):
    return Point(len*t, 0, hei*t*t)

def func_dir(t):
    return Point(0, wid*t, hei*t*t)

crv_a = Curve(func_gen,Interval(-1,1))
crv_b = Curve(func_dir, Interval(-1,1))


a.put(crv_a)
b.put(crv_b)
# ---------- end decodes_3 ----------
decodes_4 = DecodesPythonScript(len=len_x_2, wid=len_y_2, hei=len_z)  # -> console, a, b; disabled
# ---------- decodes_4: Python ----------
def func_gen(t):
    return Point(len*t, 0, hei*t*t)

def func_dir(t):
    return Point(0, wid*t, -hei*t*t)

crv_a = Curve(func_gen,Interval(-1,1))
crv_b = Curve(func_dir, Interval(-1,1))


a.put(crv_a)
b.put(crv_b)
# ---------- end decodes_4 ----------
decodes_5 = DecodesPythonScript(directrix=decodes_3.a, generator=decodes_3.b)  # -> console, out; disabled
# ---------- decodes_5: Python ----------
from decodes.extensions.classical_surfaces import TranslationalSurface

#specify origin to be a point of intersection of the generator and directrix
origin = Point() 

surf = TranslationalSurface(generator, directrix, origin)

"""
#Encapsulates the following definition

def func(u,v):
    vec = directrix.eval(u) - origin
    return generator.eval(v) + vec
surf = Surface(func) 
"""
surf.tol_u = 1.0/20
surf.tol_v = 1.0/20
out.put(surf.surrogate)
# ---------- end decodes_5 ----------

# ---- group: Construction Type I
# Tangent Surface of a Helix
number_slider = Slider(1.8, range=1..4)
# b. Gallery of Ruled Surfaces
# Usage:  hook up "outies" on left-hand side to "innies" on right-hand side
number_slider_2 = Slider(9.67, range=1..10)
rad = Slider(6.1, range=1..10)
panel_5 = Panel("Mobius Band")  # disabled
panel_6 = Panel("Conoid")  # disabled
decodes_6 = DecodesPythonScript(rad=rad)  # -> console, base, dir, ival
# ---------- decodes_6: Python ----------
from math import cos, sin, pi

wid = 4.0

#Spherical bowtie
def func_d(t):
    x = cos(t/2)*cos(t)
    y = cos(t/2)*sin(t)
    z = sin(t/2)
    return Point(x,y,z)    
     
curve_b = Curve.circle(rad=rad)
curve_d = Curve(func_d, Interval.twopi())
ival_v = Interval(-wid/2,wid/2)

base.put(curve_b)
dir.put(curve_d)
ival.put(ival_v)
# ---------- end decodes_6 ----------
decodes_7 = DecodesPythonScript(height=Slider(5.82, range=1..28), turns=Slider(1.8, range=1..4), k=Slider(1.34, range=1..3))  # -> console, base, dir, ival
# ---------- decodes_7: Python ----------
from math import *
two_pi = 2*pi
"""
Tangent Surface of a Helix
"""

rad_min = 0.2
rad_mult = 1.0
humps = 1.75

#sinusoidal profile helix
def func_b(t):
    rad = rad_min + rad_mult * ( sin(pi*t*humps) + 1 )
    theta = turns * two_pi * t**k
    return CS().eval_cyl(rad, theta, t*height)
curve_b = Curve(func_b,Interval())

#curve tangent along helix, calculated analytically
def func_d(t):
    rad = rad_min + rad_mult * ( sin(pi*t*humps) + 1 )
    theta = turns * two_pi * t**k
    #derivative of rad with respect to t
    d_rad = rad_mult*pi*humps*cos(pi*t*humps)
    #derivative of theta with respect to t
    d_theta = 2*pi*k*(t**(k-1))
    d_x = d_rad*cos(theta)- rad*d_theta*sin(theta)
    d_y = d_rad*sin(theta)+ rad*d_theta*cos(theta)
    d_z = height
    return Point(d_x, d_y, d_z)

curve_d = Curve(func_d, Interval())

ival_v = Interval(0, 0.4)

base.put(curve_b)
dir.put(curve_d)
ival.put(ival_v)
# ---------- end decodes_7 ----------
decodes_8 = DecodesPythonScript(hei=number_slider_2, trns=number_slider)  # -> console, base, dir, ival; inputs trns: Int32
# ---------- decodes_8: Python ----------
from math import *
two_pi = 2*pi

wid = 2

curve_b = Segment(Point(), Point(0, 0, hei)) 
curve_d = Curve.circle( ival = Interval(0, trns*two_pi) )
ival_v = Interval(0, wid)

base.put(curve_b)
dir.put(curve_d)
ival.put(ival_v)
# ---------- end decodes_8 ----------
decodes_9 = DecodesPythonScript(base_crv=decodes_6.base, director_crv=decodes_6.dir, ival_v=decodes_6.ival)  # -> console, out; disabled
# ---------- decodes_9: Python ----------
"""
Ruled surface constructed by a straight line moving along a base curve
with direction given by directrix.
"""


def func(u,v):
    return base_crv.eval(u) + director_crv.eval(u)*v
    
surf = Surface(func, Interval(), ival_v) 
surf.tol_u = 1.0/50
out.put(surf.surrogate)
# ---------- end decodes_9 ----------

# ---- group: Construction Type II
# Hyperboloid as Ruled Surface
len_z_2 = Slider(4, range=-20..20)
len_x_3 = Slider(2.78, range=1..10)
len_y_3 = Slider(2.61, range=1..10)
rad_2 = Slider(2.82, range=0..10)
length = Slider(7.7, range=0..10)
twist = Slider(-2.22, range=-3.14..3.14)
len_y_4 = Slider(1.13, range=1..10)
len_x_4 = Slider(2.78, range=1..10)
panel_8 = Panel("\"Torqued Ellipse\"")  # disabled
decodes_10 = DecodesPythonScript(len=len_x_4, wid=len_y_4, hei=Slider(2.38, range=1..10))  # -> console, a, b
# ---------- decodes_10: Python ----------
"""
Torqued Ellipse
Inspired by Richard Serra sculpture series with same name
"""
from math import *

#ellipse
def func_a(t):
    x = len*cos(t)
    y = wid*sin(t)
    return Point(x,y)
crv_a = Curve(func_a, Interval(0, 1.9*pi))

  
#ellipse with height, shifted center and phase
def func_b(t):
    x = wid*cos(t)
    y = len*sin(t)
    return Point(x-0.5,y,hei)
crv_b = Curve(func_b, Interval(0.1*pi, 2*pi))

a.put(crv_a)
b.put(crv_b)
# ---------- end decodes_10 ----------
decodes_11 = DecodesPythonScript(twist=twist, rad=rad_2, length=length)  # -> console, a, b
# ---------- decodes_11: Python ----------
from math import *


#circle with height and shifted start point
def circle_twist(t):
    x = rad*cos(t+twist)
    y = rad*sin(t+twist)
    #height expressed in terms of length and twist
    z = sqrt(length*length-4*(sin(twist/2))**2) 
    return Point(x,y,z)

a.put(Curve.circle(Point(), rad))
b.put(Curve(circle_twist, Interval.twopi()))
# ---------- end decodes_11 ----------
decodes_12 = DecodesPythonScript(len=len_x_3, wid=len_y_3, hei=len_z_2)  # -> console, a, b
# ---------- decodes_12: Python ----------
crv_a = Segment(Point(len, 0, hei), Point(0, wid, -hei))
crv_b = Segment(Point(0, -wid, -hei), Point(-len, 0, hei))

a.put(crv_a)
b.put(crv_b)
# ---------- end decodes_12 ----------
decodes_13 = DecodesPythonScript(crv_a=decodes_12.a, crv_b=decodes_12.b)  # -> console, out
# ---------- decodes_13: Python ----------
#Ruled Surface constructed by connecting points of two generating curves

def func(u,v):
    rule = Segment(crv_a.eval(u), crv_b.eval(u))
    return rule.eval(v)

surf = Surface(func)



#############################
res = 25
surf.tol_u = 1.0/res
out.put(surf.surrogate)
#drawing the rulings
for u in Interval().divide(res, True):
    out.put(surf.isopolyline(u_val = u))
#drawing the initial curves
out.put(surf.isopolyline(v_val = 0))
out.put(surf.isopolyline(v_val = 1))
# ---------- end decodes_13 ----------

# ----
# Rotational Surface
# Note: construction given using Classical Surfaces extension.
# Other parametrizations of rotational surfaces given explicitly in other examples.
slider = Slider(-1, range=-1..1)  # disabled
slider_2 = Slider(-0.457, range=-1..1)  # disabled
slider_3 = Slider(1, range=-1..1)  # disabled
slider_4 = Slider(6.28, range=0..6.28)  # disabled
slider_5 = Slider(3.47, range=0..6.28)  # disabled
pts = Point([Point(0.583, 0, 0), Point(0.2975609477, 0, 0.5041924453), Point(1, 0, 1)])  # disabled
vec = VectorXYZ(XComponent=slider, YComponent=slider_2, ZComponent=slider_3)  # -> Vector, Length; disabled
decodes_14 = DecodesPythonScript(pts=pts)  # -> console, a; inputs pts: list; disabled
# ---------- decodes_14: Python ----------
crv = Curve.bezier(pts)
a.put(crv)
# ---------- end decodes_14 ----------
dom = Domain(DomainStart=slider_5, DomainEnd=slider_4)  # disabled
pt = Point(Point(1, 0.145, -1))  # disabled
vdis = VectorDisplay(Anchor=pt, Vector=vec.Vector)  # disabled
decodes_15 = DecodesPythonScript(crv=decodes_14.a, rot_ival=dom, axis_vec=vec.Vector, base_pt=pt)  # -> console, out; inputs axis_vec: Vector3d; disabled
# ---------- decodes_15: Python ----------
from decodes.extensions.classical_surfaces import *

surf = RotationalSurface(crv,axis = Ray(base_pt,axis_vec),dom_u=rot_ival)


"""
#Encapsulates the following definition
def func(u,v):
    pt = crv.eval(v)
    angle = rot_ival.eval(u)
    xf = Xform.rotation(axis=axis_vec,angle=angle,center=base_pt )
    return pt*xf 

surf = Surface(func)
"""

out.put(surf.surrogate)
# ---------- end decodes_15 ----------
