# Grasshopper definition 1.10.E01.gh (Grasshopper 0.9.75)
# plug-ins: Decodes Python Interpreter

# ---- group: Field Class v0.1
# Development of Field Class
decodes = DecodesPythonScript()  # -> console, a; disabled
# ---------- decodes: Python ----------
#########################################

"""
Field Class v0.1
A Field is composed of a Bounds and a resolution (an integer number of divisions to perform on the Bounds).
The same number of divisions will be made in both the x- and y-axes.
"""

class Field():
    
    def __init__(self, bnd, res):
        self.bnds = bnd
        self.res = res
        
    def to_plines(self):
        return [sbnds.to_pline() for sbnds in self.bnds.subbounds(self.res)]
        
#########################################



a.put(Field)
# ---------- end decodes ----------

# ---- group: Field Test Rig v0.1
number_slider = Slider(4, range=3..20)  # disabled
# Step 1 - d
rec = Rectangle({Plane=PlaneXY(-14.2332728, -14.44007175, 0), Size=Domain2(u=0..38.8900754, v=0..26.77215336)})  # disabled
decodes_2 = DecodesPythonScript(Field=decodes.a, rect=rec, res=number_slider)  # -> console, a, b; inputs res: Int32; disabled
# ---------- decodes_2: Python ----------
def pgon_bounds_to_world_bounds(pg):
    o = pg.basis.origin
    b = pg.bounds
    ival_x = Interval(b.ival_x.a + o.x, b.ival_x.b + o.x)
    ival_y = Interval(b.ival_y.a + o.y, b.ival_y.b + o.y)
    print ival_x, ival_y
    return Bounds(ival_x=ival_x, ival_y=ival_y)
    
#########################################
    
bnd = pgon_bounds_to_world_bounds(rect)
fld = Field( bnd , res )


#########################################
a.put(fld)
b.put(fld.to_plines())
# ---------- end decodes_2 ----------

# ---- group: Node Class v1.1
decodes_3 = DecodesPythonScript()  # -> console, a
# ---------- decodes_3: Python ----------
#########################################

"""
Node Class v1.1

"""

class Node(Point):
    max_step = 0.25
    max_dist = 1.0
    
    """
    Node is initialized with a position and a bounds
    """
    def __init__(self, pos, bnds):
        self.set_pos(pos)
        self.bnds = bnds
        
        self.tvec = Vec()
        
        
    def set_tvec(self,others):
        others = [node for node in others if node is not self]
        
        self.tvec = Vec(self).normalized(0.1)
        if len(others) == 1: self.tvec += Vec(others[0], self).normalized(0.1)
        if len(others) > 1:
            others = sorted(others, key=lambda other: self.distance2(other))
            v = Vec(others[0],self).normalized() + Vec(others[1],self).normalized()
            if v.length > 0: self.tvec += v
        
        #self.tvec = Vec.random(constrain2d = True)
        self.tvec = self.tvec.limited(Node.max_step)
    
    
    @property
    def in_bounds(self):
        return self in self.bnds
        
        
        
    """
    Unaltered Methods
    [noprint]
    """
    
    def set_pos(self,pos): self.x, self.y, self.z = pos.x, pos.y, pos.z
    
    def translate(self):
        self.set_pos(self + self.tvec)
        self.tvec = Vec()

#########################################
    @property
    def do_translate(self):
        """ If this property is set to false, outies will not translate this geometry into external formats, and pass along the class as-is.
        """
        return False


a.put(Node)
# ---------- end decodes_3 ----------

# ---- group: Node Class v0.1
# Development of Node Class
decodes_4 = DecodesPythonScript()  # -> console, a
# ---------- decodes_4: Python ----------
#########################################

"""
Node Class v0.1
A Node is a special kind of Point that is capable of translating its spatial position.
The Node Class stores a maximum translation distance that is applicable to all Nodes.
Functionality is added to redefine the position of a Node to match the position of a given Point.
"""

class Node(Point):
    max_step = 0.5
    
    def __init__(self, pos):
        self.set_pos(pos)
        
    def translate(self):
        tvec = Vec(Point(),self).limited(Node.max_step)
        self.set_pos(self + tvec)
        
    def set_pos(self,pos): self.x, self.y, self.z = pos.x, pos.y, pos.z
        

#########################################
a.put(Node)
# ---------- end decodes_4 ----------

# ----
rec_2 = Rectangle({Plane=PlaneXY(-15.18839667, -16.19195569, 0), Size=Domain2(u=0..41.70819681, v=0..29.80163387)})

# ---- group: Thread Simulation v0.1
decodes_5 = DecodesPythonScript(Node=decodes_4.a)  # -> console, a, a_props, b, b_props
# ---------- decodes_5: Python ----------
from math import *
cp = Point()
line_len = 10.0
pt_count = 10
initial_pts = [Point(cp.x + x,cp.y + sin(n/pt_count*pi*2)) for n, x in enumerate(Interval(-line_len/2,line_len/2)/pt_count)]
a.put(initial_pts)
SIM_STEPS = 20

#########################################

"""
Thread Simulation v0.1

"""


"""
Initialize Thread
Our "thread" is not formalized as a type, but rather is simply an ordered collection of Nodes. We may visualize this yarn simply by constructing a PLine.
"""
thread = [Node(pt) for pt in initial_pts]

"""
Simulate Thread Expansion
This collection of Nodes may "grow" simply by calling the translate function of each Node for as many steps as we wish to simulate.
"""
for t in range(SIM_STEPS):
    for nod in thread: nod.translate()
    
    
#########################################
        
    stp_ival = Interval(0,SIM_STEPS)
    wei_ival = Interval(0.025,0.05)
    clr_a = Color(0.75)
    clr_b = Color(0.25)
        
    pl = PLine(thread)
    pl.set_color(Color.interpolate(clr_a,clr_b,stp_ival.deval(t)))
    pl.set_weight(Interval.remap(t,stp_ival,wei_ival))
    b.put(pl)
# ---------- end decodes_5 ----------

# ---- group: Thread Test Rig v0.1
item = ListItem(List=decodes_5.b, Index=Slider(0, range=0..19), Wrap=True)

# ----
# Step 1 - a
hardboil = DecodesHardBoil(Geometry=decodes_5.b, Properties=decodes_5.b_props)

geo = Geometry([Line((-13.2311667, -4.043234927, 0), (-13.79172122, -3.366495168, 0)), Line((-13.79172122, -3.366495168, 0), (-14.46322997, -2.788424097, 0)), Line((-14.46322997, -2.788424097, 0), (-13.98683793, -2.624210395, 0)), Line((-13.98683793, -2.624210395, 0), (-13.11380331, -2.25575182, 0)), Line((-13.11380331, -2.25575182, 0), (-13.6758153, -1.937590495, 0)), Line((-13.6758153, -1.937590495, 0), (-14.52909614, -1.759644623, 0))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])
geo_2 = Geometry([Line((-11.4663407, -5.755711756, 0), (-11.93736902, -5.539401231, 0)), Line((-11.93736902, -5.539401231, 0), (-12.40839734, -5.323090706, 0)), Line((-12.40839734, -5.323090706, 0), (-12.60798377, -4.428921455, 0)), Line((-12.60798377, -4.428921455, 0), (-13.2892637, -4.732856212, 0)), Line((-13.2892637, -4.732856212, 0), (-13.74413166, -4.963084639, 0)), Line((-13.74413166, -4.963084639, 0), (-14.18685967, -5.433589255, 0))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])

# ---- group: Field Class v0.2
decodes_6 = DecodesPythonScript()  # -> console, a; disabled
# ---------- decodes_6: Python ----------
#########################################

"""
Field Class v0.2
A Field is recomposed as a Bounds and two sets of Intervals that decompose the x- and y-intervals of the Bounds of this Field.
Rather than storing the resolution as a member, we may leave it implied by the number of divisions in these sets of Intervals.
Functionality is added for retrieving the sub-Bounds of this Field that encompasses a given Point.
"""

class Field():
    
    def __init__(self, bnd, res):
        self.bnds = bnd
        # Intervals are assumed to be immutable, and are marked here as private
        self._ivals_u = bnd.ival_x // res
        self._ivals_v = bnd.ival_y // res
        
    @property
    def res(self): return len(self._ivals_u)
        
    """
    Bounds At
    Returns the sub-Bounds of this Field that corresponds with a given u- and v- coordinate. U and V are not spatial coordinates, but rather are integer numbers that refer to the stored lists of u- and v- intervals.
    """
    def bnds_at(self,u,v):
        return Bounds(ival_x = self._ivals_u[u], ival_y = self._ivals_v[v])
        
    """
    Bounds Of
    Returns the u-v coordinates related to the sub-Bounds of this Field that encompasses a given spatial Point.
    Returns False if the given Point does not lie within the Bounds of this Field.
    """
    def bnds_of(self,pt):
        if not pt in self.bnds: return False
        
        for u, ival_u in enumerate(self._ivals_u):
            if pt.x in ival_u: break
        for v, ival_v in enumerate(self._ivals_v):
            if pt.y in ival_v: break
        
        return(u,v)
        
    """
    To Polylines
    """
    def to_plines(self):
        coords = [(u,v) for u in range(self.res) for v in range(self.res)]
        return [self.bnds_at(u,v).to_pline() for u,v in coords]    
        
#########################################

        
a.put(Field)
# ---------- end decodes_6 ----------

# ---- group: Field Test Rig v0.1
# Step 2 - e
number_slider_2 = Slider(7, range=3..20)  # disabled
rec_3 = Rectangle({Plane=PlaneXY(-14.2332728, -14.44007175, 0), Size=Domain2(u=0..38.8900754, v=0..26.77215336)})  # disabled
decodes_7 = DecodesPythonScript(Field=decodes_6.a, rect=rec_3, res=number_slider_2)  # -> console, a, b; inputs res: Int32; disabled; same code as decodes_2

# ---- group: Node Class v0.2
decodes_8 = DecodesPythonScript()  # -> console, a
# ---------- decodes_8: Python ----------
#########################################

"""
Node Class v0.2
A Node is recomposed as a special kind of Point that has a parent and a child, and is capable of moving away from them.
A Node remembers a translation vector, so that the definition of a desired vector of movement may be separated from the actual translation of this Node.
The Node Class stores a maximum desired distance from its related Nodes.
"""


class Node(Point):
    max_step = 0.5
    max_dist = 2.0
    
    """
    Upon construction, a Node may identify its parent Node. 
    It is the responsibility of this Node to inform its parent of its construction.
    It has no children at this time, as it will be the responsibilty of any future children to inform this Node of their construction.
    
    """
    def __init__(self, pos, pnt=False):
        self.set_pos(pos)
        
        self.parent = pnt
        # inform the parent of this Node that this Node is his child
        if pnt: pnt.child = self
        self.child = False
        
        # an initial desired vector of movement
        self.tvec = Vec()
        
    """
    Tranlate Node
    Moves this node along its desired vector, and resets desired vector to zero. 
    """
    def translate(self):
        self.set_pos(self + self.tvec)
        self.tvec = Vec()
        
    """
    Set Translation Vector
    Defines a desired vector of movement for this Node so that it moves away from all related Nodes
    """
    def set_tvec(self,others):
        if self.parent: self.tvec += Vec(self.parent,self).normalized()
        if self.child: self.tvec += Vec(self.child,self).normalized()
        self.tvec = self.tvec.limited(Node.max_step)
        
    """
    Segment Constructor
    Produces a line segment between this Node and its parent Node.
    Necessary because as new Nodes are added to the thread, the order of Nodes in the thread collection is not maintained.
    """
    @property
    def seg(self):
        if not self.parent: return False
        return Segment(self,self.parent)
        
        
    """
    Unaltered Methods
    [noprint]
    """
    def set_pos(self,pos): self.x, self.y, self.z = pos.x, pos.y, pos.z
        

#########################################
a.put(Node)
# ---------- end decodes_8 ----------

# ---- group: Thread Simulation v0.2
decodes_9 = DecodesPythonScript(Node=decodes_8.a)  # -> console, a, a_props, b, b_props, c, c_props
# ---------- decodes_9: Python ----------
from math import *
cp = Point()
line_len = 10.0
pt_count = 10
initial_pts = [Point(cp.x + x,cp.y + sin(n/pt_count*pi*2)) for n, x in enumerate(Interval(-line_len/2,line_len/2)/pt_count)]
a.put(initial_pts)
SIM_STEPS = 18
OUTPUT_EVERY_N_STEP = 2
styled_segs = [] # for making svg

#########################################

"""
Thread Simulation v0.2

"""


"""
Initialize Thread
The collection of Nodes is initialized in much the same way, but must account for the assigning of parent-child relationships. 
The first Node added is parentless, and the last Node added is childless.
"""
thread = [Node(initial_pts[0])]
for pt in initial_pts[1:]:
    thread.append( Node(pt,thread[-1]) )
    

"""
Simulate Thread Expansion
Since Nodes now respond to one another, we must separate setting the desired vector of translation from the actual movement of the Node. Otherwise, a parent Node would translate out of position before a child Node has a chance to move.
Nodes are added when the distance between child and parent grows too large. These new nodes are added at the end of our thread collection, which results in a thread ordered by Node "age" rather than position along the thread. For this reason, visualizing the thread relies upon parent-child relationships, and is embedded in the Node.seg method.
"""
for t in range(SIM_STEPS):
    # set the translation vector of each node
    for nod in thread: nod.set_tvec(thread)
    # translate each node
    for nod in thread: nod.translate()
    
    # check for segments that are too long
    for nod in thread:
        if nod.parent:
            # if true, we'll insert a new node between this node and his parent
            if nod.distance(nod.parent) > Node.max_dist:
                # create a new node
                new_node = Node(Point.interpolate(nod,nod.parent), nod.parent)
                # tell this new node that i am his son
                new_node.child = nod
                # tell my parent that he has a new child
                nod.parent.child = new_node
                # tell myself to remember that this new node is my parent
                nod.parent = new_node
                # add this new node to the thread
                thread.append(new_node)
    
#########################################
    if len(thread) > 200: 
        print "TAKE IT EASY, BUDDY! We're recording each step, maybe switch over to simply returning the result of the final step of this simulation"
        break
    print t, "\tnode count: ", "%02d" % (len(thread),)
    b.put([nod.seg for nod in thread if nod.seg])
    
    stp_ival = Interval(0,SIM_STEPS)
    wei_ival = Interval(0.025,0.05)
    clr_a = Color(0.75)
    clr_b = Color(0.25)
    segs = []
    for nod in thread:
        if nod.parent:
            seg = Segment(Point(nod.seg.spt),Point(nod.seg.ept)) # we must copy this segment
            seg.set_color(Color.interpolate(clr_a,clr_b,stp_ival.deval(t)))
            seg.set_weight(Interval.remap(t,stp_ival,wei_ival))
            segs.append(seg)
    if t%OUTPUT_EVERY_N_STEP==0: styled_segs.append(segs)
    
styled_segs.reverse
c.put(styled_segs)
# ---------- end decodes_9 ----------

# ---- group: Thread Test Rig v0.2
branch = TreeBranch(Tree=decodes_9.b, Path=Slider(0, range=0..19), MaintainPaths=True)
line = Line(branch)

# ----
# Step 2 - b
hardboil_2 = DecodesHardBoil(Geometry=decodes_9.c, Properties=decodes_9.c_props)

# ---- group: Field Class v0.3
decodes_10 = DecodesPythonScript()  # -> console, a; disabled
# ---------- decodes_10: Python ----------
#########################################

"""
Field Class v0.3
Functionality is added for retrieving all sub-Bounds of this Field that are adjacent to the bounds that encompasses a given Point.
"""

class Field():
    
    def __init__(self, bnd, res):
        self.bnds = bnd
        self._ivals_u = bnd.ival_x // res
        self._ivals_v = bnd.ival_y // res
                
    """
    Bounds Near
    Returns a list of sub-Bounds of this Field relevant to a given Point.
    This includes the sub-Bounds that encompasses the given Point and those that are adjacent to this sub-Bounds.
    """
    def bnds_near(self,pt):
        u,v = self.bnds_of(pt)
        # an error has been intentionally left on this line of code
        crds = [ (u-1,v-1),(u,v-1),(u+1,v-1),(u-1,v+1),(u,v),(u+1,v),(u-1,v+1),(u,v+1),(u+1,v+1) ]
        def is_valid(crd):
            return crd[0]>=0 and crd[1]>=0 and crd[0]<self.res and crd[1]<self.res
        return [self.bnds_at(crd[0],crd[1]) for crd in crds if is_valid(crd) ]
        
    """
    Unaltered Methods
    [noprint]
    """
    @property
    def res(self): return len(self._ivals_u)    
    
    def bnds_at(self,u,v):
        return Bounds(ival_x = self._ivals_u[u], ival_y = self._ivals_v[v])
        
    def bnds_of(self,pt):
        if not pt in self.bnds: return False
        
        for u, ival_u in enumerate(self._ivals_u):
            if pt.x in ival_u: break
        for v, ival_v in enumerate(self._ivals_v):
            if pt.y in ival_v: break
        
        return(u,v)

#########################################
    def to_plines(self):
        ret = []
        for u in range(self.res):
            for v in range(self.res):
                ret.append ( self.bnds_at(u,v).to_pline() )
        return ret
        
a.put(Field)
# ---------- end decodes_10 ----------

# ---- group: Field Test Rig v0.2
number_slider_3 = Slider(10, range=3..20)  # disabled
rec_4 = Rectangle({Plane=PlaneXY(-14.2332728, -14.44007175, 0), Size=Domain2(u=0..38.8900754, v=0..26.77215336)})  # disabled
md_slider = MDSlider(
    slider_value=Point(0.6884014606, 0.3795986176, 0.5),
    SliderMode=0,
    x_domain=Domain(-30, 30),
    y_domain=Domain(-30, 30),
    z_domain=Domain(0, 1))  # disabled
decodes_11 = DecodesPythonScript(Field=decodes_10.a, rect=rec_4, res=number_slider_3)  # -> console, a, b; inputs res: Int32; disabled; same code as decodes_2
# Step 3 - f
pt = Point(md_slider)  # disabled
decodes_12 = DecodesPythonScript(fld=decodes_11.a, pt=pt)  # -> console, a, b; disabled
# ---------- decodes_12: Python ----------
#########################################

crds = fld.bnds_of(pt)
print crds

if crds:
    bnds = fld.bnds_at(crds[0],crds[1])
    nbnds = fld.bnds_near(pt)


#########################################
if crds: 
    a.put(bnds.to_pline())
    b.put([bnd.to_pline() for bnd in nbnds])
# ---------- end decodes_12 ----------

# ---- group: Node Class v0.3
decodes_13 = DecodesPythonScript()  # -> console, a; disabled
# ---------- decodes_13: Python ----------
#########################################

"""
Node Class v0.3

"""

class Node(Point):
    rov = 1.0
    max_step = rov * 0.5
    max_dist = 4.0
    
    """
    Constructor Unaltered
    [noprint]
    """
    def __init__(self, pos, pnt=False):
        self.set_pos(pos)
        self.parent = pnt
        # inform the parent of this Node that this Node is his child
        if pnt: pnt.child = self
        self.child = False
        self.tvec = Vec()
        
    """
    Set Translation Vector
    
    """
    def set_tvec(self,others):
        """
        find nearby nodes not connected to this node
        """
        bnds = Bounds.unit_square(Node.rov*2,self)
        def is_nearby_and_unrelated(other, bnds):
            if other is self: return False
            if other is self.parent or other is self.child: return False
            if other not in bnds: return False
            return other.distance(self) < Node.rov
        
        nears = [other for other in others if is_nearby_and_unrelated(other, bnds)]
        
        if len(nears) > 0:
            # we have some unrelated nodes nearby, move to avoid collison
            #print "COLLISON"
            nearest = Point.near(self,nears)
            self.tvec = Vec(nearest,self).normalized(Node.rov*0.25)
        else:
            # we have no unrelated nodes nearby, move to expand length of yarn
            if self.parent: self.tvec += Vec(self.parent,self).normalized()
            if self.child: self.tvec += Vec(self.child,self).normalized()
        
        self.tvec = self.tvec.limited(Node.max_step)
        
        
        
    """
    Unaltered Methods
    [noprint]
    """
        
    def translate(self):
        self.set_pos(self + self.tvec)
        self.tvec = Vec()
        
    def set_pos(self,pos): self.x, self.y, self.z = pos.x, pos.y, pos.z
        
    @property
    def seg(self):
        if not self.parent: return False
        return Segment(self,self.parent)
        

#########################################
a.put(Node)
# ---------- end decodes_13 ----------

# ---- group: Thread Simulation v0.2
decodes_14 = DecodesPythonScript(Node=decodes_13.a)  # -> console, a, a_props, b, b_props, c, c_props; disabled
# ---------- decodes_14: Python ----------
from math import *
cp = Point()
line_len = 10.0
pt_count = 10
initial_pts = [Point(cp.x + x,cp.y + sin(n/pt_count*pi*2)) for n, x in enumerate(Interval(-line_len/2,line_len/2)/pt_count)]
a.put(initial_pts)
SIM_STEPS = 15 # TOO MANY?
OUTPUT_EVERY_N_STEP = 2
styled_segs = [] # for making svg

#########################################

"""
Thread Simulation v0.2

"""


"""
Initialize Thread
"""
thread = [Node(initial_pts[0])]
for pt in initial_pts[1:]:
    thread.append( Node(pt,thread[-1]) )
    

"""
Simulate
"""
for t in range(SIM_STEPS):
    # set the translation vector of each node
    for nod in thread: nod.set_tvec(thread)
    # translate each node
    for nod in thread: nod.translate()
    
    # check for segments that are too long
    for nod in thread:
        if nod.parent:
            # if true, we'll insert a new node between this node and his parent
            if nod.distance(nod.parent) > Node.max_dist:
                # create a new node
                new_node = Node(Point.interpolate(nod,nod.parent), nod.parent)
                # tell this new node that i am his son
                new_node.child = nod
                # tell my parent that he has a new child
                nod.parent.child = new_node
                # tell myself to remember that this new node is my parent
                nod.parent = new_node
                # add this new node to the thread
                thread.append(new_node)
    
#########################################
    if len(thread) > 100: 
        print "TAKE IT EASY, BUDDY! We're recording each step, maybe switch over to simply returning the result of the final step of this simulation"
        break
    print t, "\tnode count: ", "%02d" % (len(thread),)
    b.put([nod.seg for nod in thread if nod.seg])
    
    stp_ival = Interval(0,SIM_STEPS)
    wei_ival = Interval(0.025,0.05)
    clr_a = Color(0.75)
    clr_b = Color(0.25)
    segs = []
    for nod in thread:
        if nod.parent:
            seg = Segment(Point(nod.seg.spt),Point(nod.seg.ept)) # we must copy this segment
            seg.set_color(Color.interpolate(clr_a,clr_b,stp_ival.deval(t)))
            seg.set_weight(Interval.remap(t,stp_ival,wei_ival))
            segs.append(seg)
    if t%OUTPUT_EVERY_N_STEP==0: styled_segs.append(segs)
    
styled_segs.reverse
c.put(styled_segs)
# ---------- end decodes_14 ----------

# ---- group: Thread Test Rig v0.2
number_slider_4 = Slider(5, range=0..19)  # disabled
branch_2 = TreeBranch(Tree=decodes_14.b, Path=number_slider_4, MaintainPaths=True)  # disabled
line_2 = Line(branch_2)  # disabled

# ---- group: Field Class v0.4
decodes_15 = DecodesPythonScript()  # -> console, a; disabled
# ---------- decodes_15: Python ----------
#########################################

"""
Field Class v0.4
A Field is recomposed as a Bounds, two sets of Intervals, and a dictionary of sub-Bounds that decompose the Bounds of this Field indexed by u-v coordinates
"""

class Field():
    
    def __init__(self, bnd, res):
        self.bnds = bnd
        self._ivals_u = bnd.ival_x // res
        self._ivals_v = bnd.ival_y // res
        
        """
        A dictionary of sub-Bounds that decompose the Bounds of this Field, indexed by tuples of u-v coordinates.
        The addition of these sub-Bounds allows Field objects to 'pre-compute' data that will be accessed often. 
        However, it also duplicates information represented by the two sets of Intervals, and thereby presents the risk of these data moving out of sync.
        Dictionary is assumed to be immutable, and is marked here as private
        """
        self._sbnds = {}
        for u in range(self.res):
            for v in range(self.res):
                self._sbnds[(u,v)] = Bounds(ival_x = self._ivals_u[u], ival_y = self._ivals_v[v])
        
    """
    Bounds At
    Modified to use pre-computed sub-Bounds dictionary
    """
    def bnds_at(self,u,v):
        return self._sbnds[(u,v)]        
        
        
    """
    Unaltered Methods
    [noprint]
    """
    @property
    def res(self): return len(self._ivals_u)    
    
        
    def bnds_of(self,pt):
        if not pt in self.bnds: return False
        
        for u, ival_u in enumerate(self._ivals_u):
            if pt.x in ival_u: break
        for v, ival_v in enumerate(self._ivals_v):
            if pt.y in ival_v: break
        
        return(u,v)
        
    def bnds_near(self,pt):
        u,v = self.bnds_of(pt)
        # an error has been intentionally left on this line of code
        crds = [ (u-1,v-1),(u,v-1),(u+1,v-1),(u-1,v+1),(u,v),(u+1,v),(u-1,v+1),(u,v+1),(u+1,v+1) ]
        def is_valid(crd):
            return crd[0]>=0 and crd[1]>=0 and crd[0]<self.res and crd[1]<self.res
        return [self.bnds_at(crd[0],crd[1]) for crd in crds if is_valid(crd) ]        
        
#########################################
    def to_plines(self):
        ret = []
        for u in range(self.res):
            for v in range(self.res):
                ret.append ( self.bnds_at(u,v).to_pline() )
        return ret

a.put(Field)
# ---------- end decodes_15 ----------

# ---- group: Field Test Rig v0.2
number_slider_5 = Slider(10, range=3..20)  # disabled
rec_5 = Rectangle({Plane=PlaneXY(-14.2332728, -14.44007175, 0), Size=Domain2(u=0..38.8900754, v=0..26.77215336)})  # disabled
md_slider_2 = MDSlider(
    slider_value=Point(0.6233971119, 0.4775953293, 0.5),
    SliderMode=0,
    x_domain=Domain(-30, 30),
    y_domain=Domain(-30, 30),
    z_domain=Domain(0, 1))  # disabled
decodes_16 = DecodesPythonScript(Field=decodes_15.a, rect=rec_5, res=number_slider_5)  # -> console, a, b; inputs res: Int32; disabled; same code as decodes_2
# Step 4 - g
pt_2 = Point(md_slider_2)  # disabled
decodes_17 = DecodesPythonScript(fld=decodes_16.a, pt=pt_2)  # -> console, a, b; disabled; same code as decodes_12

# ----
# Step 3 - c
hardboil_3 = DecodesHardBoil(Geometry=decodes_14.c, Properties=decodes_14.c_props)  # disabled

# ---- group: 25 simulation steps, 380 nodes
pt_3 = Point([Point(-14.84391951, -7.646135543, 0), Point(-1.097782169, -2.843374727, 0), Point(-9.274769099, 11.47994055, 0), Point(1.821633839, 12.57679385, 0), Point(-1.595342696, -0.1095158462, 0), Point(0.2110429058, -0.6830160907, 0)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])
line_3 = Line([Line((-1.097782169, -2.843374727, 0), (-1.677082023, -2.52832582, 0)), Line((-9.274769099, 11.47994055, 0), (-9.120997362, 10.45012639, 0)), Line((1.821633839, 12.57679385, 0), (1.343742169, 11.67058974, 0)), Line((-1.595342696, -0.1095158462, 0), (-0.8963751567, 1.298859803, 0)), Line((0.2110429058, -0.6830160907, 0), (-0.7064125022, -0.1577119474, 0)), Line((2.05246778, -0.7796496555, 0), (1.071101503, 0.8992252975, 0))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])
circle = Circle([{Plane=PlaneXY(-14.84391951, -7.646135543, 0), Radius=1}, {Plane=PlaneXY(-1.097782169, -2.843374727, 0), Radius=1}, {Plane=PlaneXY(-9.274769099, 11.47994055, 0), Radius=1}, {Plane=PlaneXY(1.821633839, 12.57679385, 0), Radius=1}, {Plane=PlaneXY(-1.595342696, -0.1095158462, 0), Radius=1}, {Plane=PlaneXY(0.2110429058, -0.6830160907, 0), Radius=1}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])

# ---- group: Field Class v1.0
decodes_18 = DecodesPythonScript()  # -> console, a; disabled
# ---------- decodes_18: Python ----------
#########################################

"""
Field Class v1.0
A Field is recomposed as a Bounds, two sets of Intervals, a dictionary of sub-Bounds, and a dictionary of Point-like objects
TODO
"""

class Field():
    
    def __init__(self, bnd, res):
        self.bnds = bnd
        self._ivals_u = bnd.ival_x // res
        self._ivals_v = bnd.ival_y // res
                
        self._sbnds = {}
        for u in range(self.res):
            for v in range(self.res):
                self._sbnds[(u,v)] = Bounds(ival_x = self._ivals_u[u], ival_y = self._ivals_v[v])
        
        """
        A dictionary that stores Point-like objects.
        """
        self.pt_dict = {}
        for u in range(self.res):
            for v in range(self.res):
                self.pt_dict[(u,v)] = []        
        
        
    """
    Append
    """
    def append(self,pt):
        crd = self.bnds_of(pt)
        if not crd: return False
        else:
            if pt in self.pt_dict[crd[0],crd[1]]: return False
            self.pt_dict[crd[0],crd[1]].append(pt)
        return True
        
    """
    Points At
    TODO
    """        
    def pts_at(self,u,v):
        return self.pt_dict[(u,v)]         
        
        
    """
    Bounds Near and Points Near
    TODO
    [pseudo]
    """   
    def _crds_near(self,u,v):
        crds = [ (u-1,v-1),(u,v-1),(u+1,v-1),(u-1,v),(u,v),(u+1,v),(u-1,v+1),(u,v+1),(u+1,v+1) ]
        return [crd for crd in crds if crd[0]>=0 and crd[1]>=0 and crd[0]<self.res and crd[1]<self.res ]
        
    def bnds_near(self,pt):
        u,v = self.bnds_of(pt)
        return [ self.bnds_at(crd[0],crd[1]) for crd in self._crds_near(u,v) ]
        
    def pts_near(self,pt):
        ret = []
        u,v = self.bnds_of(pt)
        for crd in self._crds_near(u,v):
            ret.extend(self.pts_at(crd[0],crd[1]))
        return ret
        
    """
    Unaltered Methods
    [noprint]
    """
    @property
    def res(self): return len(self._ivals_u)
    
    def bnds_at(self,u,v):
        return self._sbnds[(u,v)]
        
    def bnds_of(self,pt):
        if not pt in self.bnds: return False
        
        for u, ival_u in enumerate(self._ivals_u):
            if pt.x in ival_u: break
        for v, ival_v in enumerate(self._ivals_v):
            if pt.y in ival_v: break
        
        return(u,v)

#########################################
    def to_plines(self):
        ret = []
        for u in range(self.res):
            for v in range(self.res):
                ret.append ( self.bnds_at(u,v).to_pline() )
        return ret

a.put(Field)
# ---------- end decodes_18 ----------

# ---- group: Field Test Rig v0.3
number_slider_6 = Slider(1, range=0..1)  # disabled
rec_6 = Rectangle({Plane=PlaneXY(-14.2332728, -14.44007175, 0), Size=Domain2(u=0..38.8900754, v=0..26.77215336)})  # disabled
ofst_rect = OFSTRECT(rec=rec_6, ofst=number_slider_6)  # disabled
pop2d = Populate2D(Region=ofst_rect, Count=100, Seed=1)  # disabled
number_slider_7 = Slider(6, range=3..20)  # disabled
# Step 5 - h
md_slider_3 = MDSlider(
    slider_value=Point(0.5265190601, 0.5119714737, 0.5),
    SliderMode=0,
    x_domain=Domain(-30, 30),
    y_domain=Domain(-30, 30),
    z_domain=Domain(0, 1))  # disabled
decodes_19 = DecodesPythonScript(Field=decodes_18.a, rect=rec_6, res=number_slider_7, pts=pop2d)  # -> console, a, b; inputs res: Int32, pts: list; disabled
# ---------- decodes_19: Python ----------
def pgon_bounds_to_world_bounds(pg):
    o = pg.basis.origin
    b = pg.bounds
    ival_x = Interval(b.ival_x.a + o.x, b.ival_x.b + o.x)
    ival_y = Interval(b.ival_y.a + o.y, b.ival_y.b + o.y)
    print ival_x, ival_y
    return Bounds(ival_x=ival_x, ival_y=ival_y)
    
#########################################
    
bnd = pgon_bounds_to_world_bounds(rect)


fld = Field( bnd , res )

for pt in pts:
    fld.append(pt)

#########################################
a.put(fld)
b.put(fld.to_plines())
# ---------- end decodes_19 ----------
pt_4 = Point(md_slider_3)  # disabled
decodes_20 = DecodesPythonScript(fld=decodes_19.a, pt=pt_4)  # -> console, a, b; disabled
# ---------- decodes_20: Python ----------
#########################################

crds = fld.bnds_of(pt)
print crds

if crds:
    bnds = fld.bnds_at(crds[0],crds[1])
    nbnds = fld.bnds_near(pt)
    npts = fld.pts_near(pt)



#########################################
if crds: 
    a.put([bnd.to_pline() for bnd in nbnds])
    b.put(npts)
# ---------- end decodes_20 ----------
geo_3 = Geometry(decodes_20.b)  # disabled

# ---- group: final version of Field Class
field_class = Data(decodes_18.a)  # disabled

# ---- group: not in PY files
rec_7 = Rectangle({Plane=PlaneXY(-15.18839667, -16.19195569, 0), Size=Domain2(u=0..41.70819681, v=0..29.80163387)})  # disabled
decodes_21 = DecodesPythonScript()  # -> console, a
# ---------- decodes_21: Python ----------
#########################################
class Node(Point):
    max_step = 1.0
    
    def __init__(self, pos, bnds):
        self.set_pos(pos)
        self.bnds = bnds
        
        self.tvec = Vec()
        
    def translate(self):
        self.set_pos(self + self.tvec)
        self.tvec = Vec()
        
    def set_tvec(self):
        self.tvec = Vec.random(constrain2d = True)
        self.tvec = self.tvec.limited(Node.max_step)
    
    def set_pos(self,pos):
        self.x, self.y, self.z = pos.x, pos.y, pos.z
    
    @property
    def in_bounds(self):
        return self in self.bnds
        

#########################################
a.put(Node)
# ---------- end decodes_21 ----------
field_class_2 = Data(field_class)  # disabled
md_slider_4 = MDSlider(
    slider_value=Point(0.657771349, 0.574473381, 0.5),
    SliderMode=0,
    x_domain=Domain(-30, 30),
    y_domain=Domain(-30, 30),
    z_domain=Domain(0, 1))  # disabled
decodes_22 = DecodesPythonScript(Field=field_class_2, Node=decodes_21.a, rect=rec_7)  # -> console, a, b, c
# ---------- decodes_22: Python ----------
from math import *

def pgon_bounds_to_world_bounds(pg):
    o = pg.basis.origin
    b = pg.bounds
    ival_x = Interval(b.ival_x.a + o.x, b.ival_x.b + o.x)
    ival_y = Interval(b.ival_y.a + o.y, b.ival_y.b + o.y)
    #print ival_x, ival_y
    return Bounds(ival_x=ival_x, ival_y=ival_y)
    
bnd = pgon_bounds_to_world_bounds(rect)
cp = bnd.cpt
line_len = 10.0
initial_pts = [Point(cp.x + x,cp.y) for x in Interval(-line_len/2,line_len/2)/10]
b.put(initial_pts)

FIELD_RES = 10
SIM_STEPS =  1

#########################################

"""
Initialize Field
"""
fld = Field( bnd , FIELD_RES )

"""
Initialize Thread
"""
thread = []
for pt in initial_pts:
    u,v = fld.bnds_of(pt)
    node = Node(pt,fld.bnds_at(u,v))
    thread.append(node)
    fld.append(node)


"""
Simulate
"""
for t in range(SIM_STEPS):
    for node in thread: node.set_tvec()
    for node in thread: node.translate()
        
    for (u,v) in fld.pt_dict:
        fld.pt_dict[(u,v)] = [node for node in fld.pt_dict[(u,v)] if node.in_bounds]
    
    for node in thread:
        if not node.in_bounds:
            if node not in fld.bnds: node.set_pos(fld.bnds.near_pt(node)) # node has exited our canvas
            u,v = fld.bnds_of(node)
            node.bnds = fld.bnds_at(u,v)
            fld.append(node)
                
    print t, "\tnode count: ", "%04d" % (len(thread),)


#########################################
a.put(fld)
for k,v in fld.pt_dict.items():
    #if len(v)>0: print k,v
    c.put(v)
# ---------- end decodes_22 ----------
pt_5 = Point(md_slider_4)  # disabled
pt_6 = Point(flatten(decodes_22.c))  # disabled
pt_7 = Point(decodes_22.b)  # disabled
decodes_23 = DecodesPythonScript(fld=decodes_22.a, pt=pt_5)  # -> console, a, b; disabled; same code as decodes_20
panel = Panel(pt_6)  # disabled
pline = PolyLine(Vertices=pt_6, Closed=False)  # disabled
geo_4 = Geometry(decodes_23.b)  # disabled

# ----
# Incorporation of  Field Class
field_class_3 = Data(field_class)  # disabled

# ---- group: Thread Simulation v1.1
decodes_24 = DecodesPythonScript(Field=field_class_3, Node=decodes_3.a, rect=rec_2)  # -> console, a, b, c, d
# ---------- decodes_24: Python ----------
from math import *

def pgon_bounds_to_world_bounds(pg):
    o = pg.basis.origin
    b = pg.bounds
    ival_x = Interval(b.ival_x.a + o.x, b.ival_x.b + o.x)
    ival_y = Interval(b.ival_y.a + o.y, b.ival_y.b + o.y)
    #print ival_x, ival_y
    return Bounds(ival_x=ival_x, ival_y=ival_y)
    

bnd = pgon_bounds_to_world_bounds(rect)
cp = bnd.cpt
line_len = 10.0
initial_pts = [Point(cp.x + x,cp.y) for x in Interval(-line_len/2,line_len/2)/10]
b.put(initial_pts)

FIELD_RES = 100
SIM_STEPS =  1

#########################################

"""
Thread Simulation v1.1

"""


"""
Initialize Field
"""
fld = Field( bnd , FIELD_RES )


"""
Initialize Thread
"""
thread = []
for pt in initial_pts:
    u,v = fld.bnds_of(pt)
    node = Node(pt,fld.bnds_at(u,v))
    thread.append(node)
    fld.append(node)


"""
Simulate
"""
for t in range(SIM_STEPS):
    # calculate translation for each node
    for node in thread: node.set_tvec(fld.pts_near(node))
    
    # translate each node
    for node in thread: node.translate()
    
    # update field
    #
    # remove out of bounds nodes from the dictionary
    for (u,v) in fld.pt_dict:
        fld.pt_dict[(u,v)] = [node for node in fld.pt_dict[(u,v)] if node.in_bounds]
    # update the bounds of any out of bounds nodes
    for node in thread:
        if not node.in_bounds:
            if node not in fld.bnds: node.set_pos(fld.bnds.near_pt(node)) # node has exited our canvas
            u,v = fld.bnds_of(node)
            node.bnds = fld.bnds_at(u,v)
            fld.append(node)
                
    
    # add extra nodes where needed
    next_thread = [thread[0]]
    for n in range(1,len(thread)):
        if thread[n].distance(thread[n-1]) > Node.max_dist:
            #print "too long!", thread[n].distance(thread[n-1])
            pt = Point.interpolate(thread[n],thread[n-1])
            u,v = fld.bnds_of(pt)
            node = Node(pt,fld.bnds_at(u,v))
            next_thread.append(node)
            fld.append(node)
            
        next_thread.append(thread[n])
    thread = next_thread
    
    print t, "\tnode count: ", "%04d" % (len(thread),)
    
#########################################
    
    # draw thread
    for n in range(len(thread)-1):
        c.put(Segment(thread[n],thread[n+1]))

# draw thread
for n in range(len(thread)-1):
    d.put(Segment(thread[n],thread[n+1]))


a.put(fld)
# ---------- end decodes_24 ----------

# ---- group: Thread Test Rig v1.1
md_slider_5 = MDSlider(
    slider_value=Point(0.6390249729, 0.4725961685, 0.5),
    SliderMode=0,
    x_domain=Domain(-30, 30),
    y_domain=Domain(-30, 30),
    z_domain=Domain(0, 1))
# Step 1 - i
pt_8 = Point(md_slider_5)
decodes_25 = DecodesPythonScript(fld=decodes_24.a, pt=pt_8)  # -> console, a, b
# ---------- decodes_25: Python ----------
#########################################


crds = fld.bnds_of(pt)
print crds

if crds:
    bnds = fld.bnds_at(crds[0],crds[1])
    nbnds = fld.bnds_near(pt)
    npts = fld.pts_near(pt)
    


#########################################
if crds: 
    a.put([bnd.to_pline() for bnd in nbnds])
    for node in npts : b.put(Point(node))
# ---------- end decodes_25 ----------
geo_5 = Geometry(decodes_25.b)

# ----
pt_9 = Point(decodes_24.b)
geo_6 = Geometry(decodes_24.d)
panel_2 = Panel(pt_9)
field_class_4 = Data(field_class)  # disabled

# ==== cluster OFSTRECT
ofst = ClusterInput()
rec = ClusterInput()
ofst_2 = Number(ofst)
rec_2 = Rectangle(rec)
drec = DeconstuctRectangle(Rectangle=rec_2)  # -> BasePlane, XInterval, YInterval
dedomain = DeconstructDomain(Domain=drec.XInterval)  # -> Start, End
dedomain_2 = DeconstructDomain(Domain=drec.YInterval)  # -> Start, End
subtraction = Subtraction(A=dedomain.Start, B=ofst_2)
addition = Addition(A=dedomain.End, B=ofst_2)
subtraction_2 = Subtraction(A=dedomain_2.Start, B=ofst_2)
addition_2 = Addition(A=dedomain_2.End, B=ofst_2)
dom = ConstructDomain(DomainStart=subtraction_2, DomainEnd=addition_2)
dom_2 = ConstructDomain(DomainStart=subtraction, DomainEnd=addition)
rectangle = Rectangle(Plane=drec.BasePlane, XSize=dom_2, YSize=dom, Radius=0)  # -> Rectangle, Length
rec_3 = Rectangle(rectangle.Rectangle)
rec_4 = ClusterOutput(rec_3)
