# Grasshopper definition 1.10.E02.gh (Grasshopper 0.9.75)
# plug-ins: Decodes Python Interpreter

decodes = DecodesPythonScript()  # -> console, a
# ---------- decodes: Python ----------
from math import *
two_pi = 2*pi
#########################################

class Triangle():
    
    def __init__(self, pt_a, pt_b, pt_c):
        self.pa = pt_a
        self.pb = pt_b
        self.pc = pt_c
        
    def to_pgon(self):
        return PGon([self.pa,self.pb,self.pc])
        
        
#########################################
a.put(Triangle)
# ---------- end decodes ----------
decodes_2 = DecodesPythonScript()  # -> console, a
# ---------- decodes_2: Python ----------
class Triangle():
    
    def __init__(self, pt_a, pt_b, pt_c):
        self.pa = pt_a
        self.pb = pt_b
        self.pc = pt_c
        
    @property
    def edges(self): 
        e0 = Segment(self.pa,self.pb)
        e1 = Segment(self.pb,self.pc)
        e2 = Segment(self.pc,self.pa)
        return [e0,e1,e2]
    
    @property
    def pts(self): return [self.pa,self.pb,self.pc]
    
    @property
    def centroid(self): return Point.centroid(self.pts)
        
    @property
    def plane(self): 
        vec = self.edges[0].vec.cross(Vec(self.pa,self.pc))
        return Plane(self.centroid,vec)
        
        
    def to_pgon(self):
        return PGon(self.pts)
        
        
a.put(Triangle)
# ---------- end decodes_2 ----------
decodes_3 = DecodesPythonScript()  # -> console, a
# ---------- decodes_3: Python ----------
class Triangle():
    
    def __init__(self, pt_a, pt_b, pt_c):
        self.pa = pt_a
        self.pb = pt_b
        self.pc = pt_c
        
    @property
    def edges(self): return [self.edge(0),self.edge(1),self.edge(2)]
    
    @property
    def pts(self): return [self.pa,self.pb,self.pc]
    
    @property
    def centroid(self): return Point.centroid(self.pts)
        
    @property
    def plane(self): 
        vec = self.edges[0].vec.cross(Vec(self.pa,self.pc))
        return Plane(self.centroid,vec)
        
    @property
    def perimeter(self): return sum([e.length for e in self.edges])
        
    @property
    def area(self):
        #http://www.mathopenref.com/heronsformula.html
        p = self.perimeter/2.0
        a = self.edge(0).length
        b = self.edge(1).length
        c = self.edge(2).length
        return (p*(p-a)*(p-b)*(p-c))**0.5
        
        
    @property
    def circumcenter(self):
        #http://www.mathopenref.com/trianglecircumcenter.html
        xsec = Intersector()
        bsec_ab = self.edge_bisector(0)
        bsec_bc = self.edge_bisector(1)
        if xsec.of(bsec_ab,bsec_bc):
            return xsec[0]
        return False
        
    @property
    def circumcircle(self):
        #http://www.mathopenref.com/trianglecircumcircle.html
        pt = self.circumcenter
        vec = self.edges[0].vec.cross(Vec(self.pa,self.pc))
        pln = Plane(pt,vec)
        return Circle(pln,pt.distance(self.pa))
        
    @property
    def incenter(self):
        #http://www.mathopenref.com/triangleincenter.html
        xsec = Intersector()
        bsec_ab = self.angle_bisector(0)
        bsec_bc = self.angle_bisector(1)
        if xsec.of(bsec_ab,bsec_bc):
            return xsec[0]
        return False
        
    @property
    def incircle(self):
        #http://www.mathopenref.com/triangleincircle.html
        pt = self.incenter
        vec = self.edges[0].vec.cross(Vec(self.pa,self.pc))
        pln = Plane(pt,vec)
        rad = 2.0*self.area/self.perimeter
        return Circle(pln,rad)
        
    def edge(self,index):
        if index == 0 : return Segment(self.pa,self.pb)
        elif index == 1 : return Segment(self.pb,self.pc)
        elif index == 2 : return Segment(self.pc,self.pa)
        else: return False
        
    def altitude(self,base_index):
        #http://www.mathopenref.com/altitude.html
        edge = self.edges[base_index]
        if base_index == 0 : pt = self.pc
        elif base_index == 1 : pt = self.pa
        elif base_index == 2 : pt = self.pb
        else: return False
        
        npt,t,dist = Line(edge.spt,edge.ept).near(pt) #returns a near point, its t-val, and the dist
        return dist, Segment(npt,pt)
        
    def edge_bisector(self,index):
        edge = self.edge(index)
        pt = edge.midpoint
        vec = edge.vec.cross(self.plane.normal)
        return Line(pt,vec.inverted())
        
    def angle_bisector(self,index):
        if index == 0 : 
            va,vb = Vec(self.pa,self.pb),Vec(self.pa,self.pc)
        elif index == 1 : 
            va,vb = Vec(self.pb,self.pc),Vec(self.pb,self.pa)
        elif index == 2 : 
            va,vb = Vec(self.pc,self.pa),Vec(self.pc,self.pb)
        else: return False
        
        vec = Vec.bisector(va,vb)
        return Line(self.pts[index],vec)
        
        
    def pedal_tri(self,pt):
        pts = [e.near_pt(pt) for e in self.edges]
        return Tri(pts[0],pts[1],pts[2])
        
    def to_pgon(self):
        return PGon(self.pts)
        
        
a.put(Triangle)
# ---------- end decodes_3 ----------

decodes_4 = DecodesPythonScript()  # -> console, a; same code as decodes_3
decodes_5 = DecodesPythonScript(Triangle=decodes_4.a)  # -> console, a
# ---------- decodes_5: Python ----------
class RightTriangle(Triangle):
    
    def __init__(self, cs, width, height):
        self.basis = cs
        self.w = width
        self.h = height
        
    @property
    def pa(self): return self.basis.origin
        
    @property
    def pb(self): return self.basis.eval(self.w,0)
    
    @property
    def pc(self): return self.basis.eval(0,self.h)
    
    @property
    def area(self):
        return (self.w*self.h)/2.0
    
a.put(RightTriangle)
# ---------- end decodes_5 ----------

_3d = Point([Point(2.647056879, -7.522220344, 2.009673685), Point(5.476669405, -3.896191895, 0), Point(8.123726285, -5.601543206, -1.227712709)])
on_xy = Point([Point(2.647056879, 1.962473204, 0), Point(5.476669405, 5.796141787, 0), Point(8.123726285, 2.14502885, 0)])

_3d_2 = Point([Point(2.647056879, -7.522220344, 2.009673685), Point(5.476669405, -3.896191895, 0), Point(8.123726285, -5.601543206, -1.227712709)])
on_xy_2 = Point([Point(2.647056879, 1.962473204, 0), Point(5.476669405, 5.796141787, 0), Point(8.123726285, 2.14502885, 0)])
pt = Point(_3d_2)

decodes_6 = DecodesPythonScript(Triangle=decodes.a, pts=on_xy)  # -> console, a; inputs pts: list
# ---------- decodes_6: Python ----------
tri_a = Triangle(pts[0],pts[1],pts[2])

a.put(tri_a.to_pgon())
# ---------- end decodes_6 ----------
decodes_7 = DecodesPythonScript(Triangle=decodes_2.a, pts=pt)  # -> console, a, b, c; inputs pts: list
# ---------- decodes_7: Python ----------
tri_a = Triangle(pts[0],pts[1],pts[2])

a.put(tri_a.to_pgon())
b.put(tri_a.centroid)
c.put(tri_a.plane)
# ---------- end decodes_7 ----------
points = PointList(Points=pt, Tags=True, Lines=False, Size=Slider(0.5, range=0..10))
pln = Plane(PlaneXY(15.77242439, 3.905201103, 0))

_3d_3 = Point([Point(2.647056879, -7.522220344, 2.009673685), Point(5.476669405, -1.016411367, 0.1481595166), Point(12.05312814, -5.601543206, -1.227712709)])
acute = Point([Point(2.647056879, -13.77136095, 2.009673685), Point(5.476669405, -11.92566373, 0.1481595166), Point(16.02138921, -12.76813844, -1.227712709)])
on_xy_3 = Point([Point(2.647056879, 1.962473204, 0), Point(5.476669405, 5.796141787, 0), Point(8.123726285, 2.14502885, 0)])
pt_2 = Point(on_xy_3)

decodes_8 = DecodesPythonScript(RightTriangle=decodes_5.a, cs=pln, w=Slider(2.63, range=0.01..3), h=Slider(2.78, range=0.01..3))  # -> console, a, b
# ---------- decodes_8: Python ----------
tri = RightTriangle(cs,w,h)


a.put(tri.to_pgon())

b.put(tri.circumcenter)
b.put(tri.circumcircle)
b.put(tri.incenter)
b.put(tri.incircle)
b.put(tri.pedal_tri(tri.incenter).to_pgon())
# ---------- end decodes_8 ----------
md_slider = MDSlider(
    slider_value=Point(0.454750061, 0.4749984741, 0.5),
    SliderMode=0,
    x_domain=Domain(-5, 5),
    y_domain=Domain(-5, 5),
    z_domain=Domain(0, 1))
decodes_9 = DecodesPythonScript(Triangle=decodes_3.a, pts=pt_2, idx=Slider(0, range=0..2))  # -> console, a, b, c, d, e, f, g; inputs pts: list, idx: Int32
# ---------- decodes_9: Python ----------
tri_a = Triangle(pts[0],pts[1],pts[2])

print 'perimeter ',tri_a.perimeter
print 'area',tri_a.area

a.put(tri_a.to_pgon())
b.put(tri_a.plane)
b.put(tri_a.altitude(idx))
c.put(tri_a.edge_bisector(idx))
c.put(tri_a.angle_bisector(idx))
d.put(tri_a.circumcenter)
e.put(tri_a.circumcircle)
f.put(tri_a.incenter)
g.put(tri_a.incircle)
g.put(tri_a.pedal_tri(tri_a.incenter).to_pgon())
# ---------- end decodes_9 ----------
decodes_10 = DecodesPythonScript(Triangle=decodes_3.a, pts=pt_2, pt=md_slider)  # -> console, a, b; inputs pts: list
# ---------- decodes_10: Python ----------
tri_a = Triangle(pts[0],pts[1],pts[2])

cent = tri_a.centroid
cs = CS(cent,Vec(cent,tri_a.pa),Vec(cent,tri_a.pb))
pt = cs.eval(pt)

a.put(pt)
b.put(tri_a.to_pgon())
b.put(tri_a.pedal_tri(pt).to_pgon())
# ---------- end decodes_10 ----------
panel = Panel(decodes_9.b)
panel_2 = Panel(decodes_9.console)
